# Grasshopper definition from_link.gh (Grasshopper 1.0.7)

panel = Panel("http://ugdsolver.de/fcm/?ft=t3&fp=0&fgv=5&fgh=7&frat=1.395&ftypo2=gut_gut_gut_gut_gut_gut&mirrh=0&mirrv=1&roth=1&rotv=2&konh=0&konv=0&mat=&c00=0&c01=0&c10=0&c11=0.7")
panel_2 = Panel("http://ugdsolver.de/fcm/?ft=d4&fp=0&fgv=5&fgh=7&frat=1.395&ftypo2=47p_47p_47p_47p_47p&mirrh=0&mirrv=1&roth=1&rotv=2&konh=0&konv=0&mat=&mid=0.391%2C0.313%2C0.5")
panel_3 = Panel("http://ugdsolver.de/fcm/?ft=t3&fp=0&fgv=5&fgh=8&frat=1.2&ftypo2=1vf9_282d_1vf9_1vf9_1vf9_1vf9&mirrh=0&mirrv=0&roth=3&rotv=0&konh=1&konv=0&mat=&c00=0&c01=0&c10=2&c11=0")
panel_4 = Panel("http://ugdsolver.de/fcm/?ft=t3&fp=0&fgv=5&fgh=8&frat=1.2&ftypo2=1vf9_1vf9_1vf9_1vf9_1vf9_1vf9&mirrh=0&mirrv=0&roth=0&rotv=0&konh=0&konv=0&mat=&c00=0&c01=2&c10=0&c11=2")
panel_5 = Panel("http://ugdsolver.de/fcm/?ft=t1&fp=0&fgv=5&fgh=8&frat=1.2&ftypo2=2mpbt5h_2mhzpll_2mphemt_2mphemt_2mphemt&mirrh=0&mirrv=1&roth=0&rotv=0&konh=0&konv=0&mat=&c00=0&c01=0&c10=0.7")
panel_6 = Panel("http://ugdsolver.de/fcm/?ft=d2&fp=0&fgv=4&fgh=6&frat=1.395&ftypo2=11x_11x_11x_11x&mirrh=1&mirrv=0&roth=1&rotv=1&konh=0&konv=0&mat=&c00=0&c01=0&c10=0&c11=0.7")
# https://facademaker.alucobond.com/?ft=d2&fp=0&fgv=5&fgh=7&frat=1.3953488372093024&ftypo=ttvvvvv&mirrh=0&mirrv=0&roth=0&rotv=0&konh=0&konv=0&mat=&c00=0&c01=0&c10=0&c11=0.7
panel_7 = Panel("http://ugdsolver.de/fcm/?ft=t1&fp=0&fgv=5&fgh=8&frat=1.2&ftypo2=2mphemt_2mphemt_2mphemt_2mphemt_2mphemt&mirrh=0&mirrv=1&roth=0&rotv=0&konh=0&konv=0&mat=&c00=0&c01=0&c10=0.7")
panel_8 = Panel("http://ugdsolver.de/fcm/?ft=t1&fp=0&fgv=5&fgh=7&frat=1.395&ftypo2=5x3c5x_5x3c5x_5x3c5x_5x3c5x_5x3c5x&mirrh=0&mirrv=0&roth=2&rotv=2&konh=1&konv=1&mat=&c00=0&c01=0&c10=0.7")
panel_9 = Panel("http://ugdsolver.de/fcm/?ft=t2&fp=0&fgv=5&fgh=7&frat=1.395&ftypo2=1h9u1h_1h9u1h_1h9u1h_1h9u1h_1h9u1h&mirrh=0&mirrv=1&roth=1&rotv=2&konh=0&konv=0&mat=&c00=0&c01=0&c10=0.7")
panel_10 = Panel("http://ugdsolver.de/fcm/?ft=t3&fp=0&fgv=5&fgh=8&frat=1.2&ftypo2=1vf9_1vf9_1vf9_1vf9_1vf9_1vf9&mirrh=0&mirrv=0&roth=0&rotv=0&konh=0&konv=0&mat=&c00=2&c01=0&c10=2&c11=0.833")
panel_11 = Panel("http://ugdsolver.de/fcm/?ft=d2&fp=0&fgv=5&fgh=7&frat=1.395&ftypo2=4eu_47k_4gl_47p_47p&mirrh=1&mirrv=0&roth=1&rotv=1&konh=0&konv=0&mat=&c00=0&c01=0&c10=0&c11=0.7")
panel_12 = Panel("http://ugdsolver.de/fcm/?ft=q4&fp=0&fgv=5&fgh=7&frat=1.395&ftypo2=4ee_47k_4gl_47p_47p&mirrh=1&mirrv=0&roth=1&rotv=1&konh=0&konv=0&mat=&c00=0&c01=0.2&c10=0.8&c11=0.4&mid=0.5%2C0.5%2C")
panel_13 = Panel("http://ugdsolver.de/fcm/?ft=d2&fp=0&fgv=5&fgh=7&frat=1.395&ftypo2=4eu_47k_4gl_47p_47p&mirrh=1&mirrv=0&roth=1&rotv=1&konh=0&konv=0&mat=&c00=0&c01=0&c10=0&c11=0.7")
stringreading = GhPythonScript(string=panel_13)  # -> out, flatten(data_dict)
# ---------- stringreading: Python ----------
import sys
import Rhino.Geometry as rg

import os
import Grasshopper

path=os.path.dirname(Grasshopper.Instances.ActiveCanvas.Document.FilePath)
path=os.path.dirname(path)
path=os.path.join(path, "src")
sys.path.append(path)

import read_link as rl
reload(rl)

data_dict=[rl.string_reader(string)]
# ---------- end stringreading ----------

# ---- group: Overwriting Link Data
list = ValueList({"square": "d2", "squareLift": "q1lift", "squareSkewed": "t4", "diamond": "t3", "quadSquare": "q4", "pyramid": "d4", "isoscelesTriangle": "t1", "rightTriangle": "t2"}, selected="square")
print_dict = GhPythonScript(
    data_dict=stringreading.data_dict,
    overwrite_h_mir=Toggle(False),
    h_mir=Toggle(False),
    overwrite_v_mir=Toggle(False),
    v_mir=Toggle(False),
    overwrite_h_kon=Toggle(False),
    h_kon=Toggle(False),
    overwrite_v_kon=Toggle(False),
    v_kon=Toggle(False),
    overwrite_rot_h=Toggle(False),
    roth=Slider(0, range=0..3),
    overwrite_rot_v=Toggle(False),
    rotv=Slider(2, range=0..3),
    overwrite_f=Toggle(True),
    f=list,
    overwrite_frat=Toggle(False),
    frat_v=Slider(1.5, range=0.5..2.5))  # -> flatten(out), data_dict; inputs overwrite_h_mir: Boolean, h_mir: Boolean, overwrite_v_mir: Boolean, v_mir: Boolean, overwrite_h_kon: Boolean, h_kon: Boolean, overwrite_v_kon: Boolean, v_kon: Boolean, overwrite_rot_h: Boolean, roth: Int32, overwrite_rot_v: Boolean, rotv: Int32, overwrite_f: Boolean, overwrite_frat: Boolean
# ---------- print_dict: Python ----------
string=''
for key, item in data_dict.items():
    string+="{} : {}\n".format(key, item)
if overwrite_h_mir:
    data_dict['mirrh']=h_mir
if overwrite_v_mir:
    data_dict['mirrv']=v_mir
if overwrite_h_kon:
    data_dict['konh']=h_kon
if overwrite_v_kon:
    data_dict['konv']=v_kon
if overwrite_rot_h:
    data_dict['roth']=roth
if overwrite_rot_v:
    data_dict['rotv']=rotv
if overwrite_frat:
    data_dict['frat']=frat_v
if overwrite_f:
    try:
        data_dict['a']
        data_dict['b']
        data_dict['hc']
    except:
        data_dict['a']=.25
        data_dict['b']=.25
        data_dict['hc']=50.
    data_dict['ft']=f

print(string)
data_dict=[data_dict]
# ---------- end print_dict ----------

# ----
print_dict_2 = GhPythonScript(x=print_dict.data_dict)  # -> flatten(out)
# ---------- print_dict_2: Python ----------
string=''
for key, item in x.items():
    string+="{} : {}\n".format(key, item)
    
print(string)
print(x)
# ---------- end print_dict_2 ----------
panel_14 = Panel(stringreading.out)

# ---- group: cassette sizes
cassette_thickness = Slider(377.007, range=0..500)
cassette_width = Slider(614.037, range=0..10000)
cassette_height = Slider(1022.235, range=0..10000)
toggle = BooleanToggle(False)

# ----
panel_15 = Panel(print_dict_2)

# ---- group: Construction Parameters
list_2 = ValueList({"Straight": "flat", "Clockwise": "clockwise", "Counter-Clockwise": "counter_clockwise", "Alternating-A": "alternating_A", "Alternating-B": "alternating_B", "Flaps": "flaps", "EasyFix-A": "easyFix_A", "EasyFix-B": "easyFix_B"}, selected="EasyFix-A")
parameter_assignment = GhPythonScript(
    hole_r=Slider(5, range=0..10),
    hole_l_a=Slider(53.303, range=0..100),
    hole_l_b=Slider(100, range=0..100),
    hole_h=Slider(100, range=0..100),
    flap_l_max=Slider(350, range=0..350),
    flap_h_max=Slider(50, range=0..250),
    angle=Slider(45.5, range=30..60),
    correction_val=Slider(1, range=0..50),
    flap_h=Slider(30, range=0..100),
    flap_w=Slider(80, range=0..100),
    mesh_correction_val=Toggle(False),
    show_correction_val=Toggle(True),
    fold_idx=Slider(0, range=0..1),
    min_pt_height=Slider(92.9, range=0..100),
    orient=Toggle(True),
    pattern=list_2)  # -> out, construction_parameters; inputs mesh_correction_val: Boolean, show_correction_val: Boolean, fold_idx: Int32, orient: Boolean
# ---------- parameter_assignment: Python ----------
construction_parameters = {
    "hole_r":5.,
    "hole_l_a":100,
    "hole_l_b":100,
    "hole_h":50,
    "flap_l_max" : 100.,
    "flap_h_max" : 30.,
    "correction_val" : .7,
    "flap_h" : 20.0,
    "flap_w" : 40.0,
    "side_angle": 1.5707963268,
    "mesh_correction_val" : False,
    "show_correction_val" : True,
    "fold_idx" : 0,
    "min_pt_height" : 50.,
    "orient" : True,
    "pattern" : "flat"
}

input_parameters = {
    "hole_r":hole_r,
    "hole_l_a":hole_l_a,
    "hole_l_b":hole_l_b,
    "hole_h":hole_h,
    "flap_l_max" : flap_l_max,
    "flap_h_max" : flap_h_max,
    "correction_val" : correction_val,
    "flap_h" : flap_h,
    "flap_w" : flap_w,
    "side_angle": angle * 3.1415926536 / 180.,
    "mesh_correction_val" : mesh_correction_val,
    "show_correction_val" : show_correction_val,
    "fold_idx" : fold_idx,
    "min_pt_height" : min_pt_height,
    "orient" : orient,
    "pattern" : pattern
}

for key, value in input_parameters.items():
    if not(value is None):
        construction_parameters[key]=value
        
construction_parameters=[construction_parameters]
# ---------- end parameter_assignment ----------

# ----
stringreading_2 = GhPythonScript(
    data_dict=print_dict.data_dict,
    set_x_spacing=toggle,
    x_spacing=cassette_width,
    z_spacing=cassette_height,
    y_delta=cassette_thickness,
    other_parameters=parameter_assignment.construction_parameters)  # -> out, f, flatten(data_dict); inputs set_x_spacing: Boolean
# ---------- stringreading_2: Python ----------
import sys
import Rhino.Geometry as rg

import os
import Grasshopper

path=os.path.dirname(Grasshopper.Instances.ActiveCanvas.Document.FilePath)
path=os.path.dirname(path)
path=os.path.join(path, "src")
sys.path.append(path)

import facade_from_dict as ffd
reload(ffd)

if not(set_x_spacing):
    x_spacing=None
f=ffd.facade_from_dict(data_dict, x_spacing=x_spacing, z_spacing=z_spacing, y_delta=y_delta, other_parameters=other_parameters)
data_dict=[data_dict]
# ---------- end stringreading_2 ----------
panel_16 = Panel(stringreading_2.out)

# ---- group: Unfolding Parameters
list_3 = ValueList({"Optimal Width": 0, "Optimal Length": 1, "Optimal Area": 2}, selected="Optimal Length")
optimization = GhPythonScript(
    iterations=Slider(146, range=10..1000),
    max_width=Slider(2660.7, range=0..10000),
    max_length=Slider(3200, range=0..10000),
    optimization=list_3)  # -> out, opt_dict; inputs iterations: Int32, optimization: Int32
# ---------- optimization: Python ----------
optimization_dict = {
    "iterations" : iterations,
    "max_w" : max_width,
    "max_l" : max_length,
}

optimization_dict["preference"] = ["width","length","area"][optimization]
opt_dict=[optimization_dict]
# ---------- end optimization ----------

# ----
genmesh = GhPythonScript(f=stringreading_2.f)  # -> out, all_objects, mshs
# ---------- genmesh: Python ----------
mshs=f.populate()
all_objects=f.all_base_objects
print(f)
# ---------- end genmesh ----------
medges = MeshEdges(Mesh=genmesh.mshs)  # -> NakedEdges, InteriorEdges, NonManifoldEdges
unfoldingoptimization = GhPythonScript(optimization_parameters=optimization.opt_dict, objects=genmesh.all_objects)  # -> out, unfolded_objs, outline_crv, panel, intra_flap_folds, body_flap_folds, top_face_folds, holes, tag_location, tag_name; inputs objects: list
# ---------- unfoldingoptimization: Python ----------
from Rhino.Geometry import Plane, Point3d, Vector3d

h_pos=0.

outline_crv=[]
panel=[]
top_face_folds=[]
body_flap_folds=[]
intra_flap_folds=[]
holes=[]

# optimization_parameters={"iterations":50, "max_w":2200, "max_l": 3600, "preference":"width"}

tag_name=[]
tag_location=[]

for d_o in objects:
    unfolded_objs=d_o.get_2d(optimization_parameters=optimization_parameters)
    tag_name.append(str(d_o))
    tag_location.append(Point3d(0,h_pos,0))
    hs=[1000.]
    w_pos=0.
    for u_o in unfolded_objs:
        pln=Plane(
                Point3d(w_pos, h_pos,0.),
                Vector3d.XAxis,
                Vector3d.YAxis,
            )
        data_dict=u_o.bake_dict(pln)
            
        outline_crv.append(data_dict["outline_crv"])
        panel.append(data_dict["panel"])
        top_face_folds.extend(data_dict["top_face_folds"])
        body_flap_folds.extend(data_dict["body_flap_folds"])
        intra_flap_folds.extend(data_dict["intra_flap_folds"])
        holes.extend(data_dict["holes"])
        w_pos+=u_o.width
        hs.append(u_o.height)
    m_h=max(hs)
    h_pos+=m_h
    tag_location[-1].Y+=m_h*.5
# ---------- end unfoldingoptimization ----------
panel_17 = Panel(unfoldingoptimization.out)

# ---- group: 3D Visualization
gate = StreamGate(Stream=genmesh.mshs, Gate=Toggle(True))  # -> Target0, Target1
geo = Geometry(gate.Target1)

# ---- group: Panels
gate_2 = StreamGate(Stream=unfoldingoptimization.panel, Gate=Toggle(True))  # -> Target0, Target1
geo_2 = Geometry(gate_2.Target1)

# ---- group: Unfolded Objects
toggle_2 = BooleanToggle(True)
merge = Merge(
    Data1=unfoldingoptimization.outline_crv,
    Data2=unfoldingoptimization.intra_flap_folds,
    Data3=unfoldingoptimization.body_flap_folds,
    Data4=unfoldingoptimization.top_face_folds,
    Data5=unfoldingoptimization.holes)
gate_3 = StreamGate(Stream=merge, Gate=toggle_2)  # -> Target0, Target1
gate_4 = StreamGate(Stream=unfoldingoptimization.tag_location, Gate=toggle_2)  # -> Target0, Target1
geo_3 = Geometry(gate_3.Target1)
tag = TextTag(Location=gate_4.Target1, Text=unfoldingoptimization.tag_name)

# ----
naming = GhPythonScript(outline="outline_A", main_folds="main_B", secondary_folds="sec_C", tertiary_folds="ter_D", holes="holes")  # -> out, name_dict
# ---------- naming: Python ----------
data_dict={
    "outline":outline,
    "main_folds":main_folds,
    "sec_folds":secondary_folds,
    "inner_folds":tertiary_folds,
    "holes":holes,
}

name_dict=[data_dict]
# ---------- end naming ----------
colour = ColourPicker(PickedColour=RGB(42, 156, 140))
colour_2 = ColourPicker(PickedColour=RGB(119, 56, 201))
baking = GhPythonScript(
    bake_me=Button(),
    outlines=unfoldingoptimization.outline_crv,
    main_folds=unfoldingoptimization.body_flap_folds,
    sec_folds=unfoldingoptimization.top_face_folds,
    inner_folds=unfoldingoptimization.intra_flap_folds,
    holes=unfoldingoptimization.holes,
    name_dict=naming.name_dict)  # -> out, a; inputs bake_me: Boolean, outlines: list, main_folds: list, sec_folds: list, inner_folds: list, holes: list
# ---------- baking: Python ----------
import sys
import Rhino.Geometry as rg

import os
import Grasshopper

path=os.path.dirname(Grasshopper.Instances.ActiveCanvas.Document.FilePath)
path=os.path.dirname(path)
path=os.path.join(path, "src")
sys.path.append(path)

import baking as bk
reload(bk)

if bake_me:
    bk.bake(outlines, main_folds, sec_folds, inner_folds, holes, ghdoc, name_dict=name_dict)
# ---------- end baking ----------
colour_3 = ColourPicker(PickedColour=RGB(255, 105, 180))
panel_20 = Panel(baking.out)
colour_4 = ColourPicker(PickedColour=RGB(83, 194, 27))
colour_5 = ColourPicker(PickedColour=RGB(201, 148, 56))
coloring = GhPythonScript(
    names=naming.name_dict,
    outline=colour_3,
    main_folds=colour,
    secondary_folds=colour_5,
    tertiary_folds=colour_2,
    holes=colour_4)  # -> out, name_dict
# ---------- coloring: Python ----------
import sys
import Rhino.Geometry as rg

import os
import Grasshopper

path=os.path.dirname(Grasshopper.Instances.ActiveCanvas.Document.FilePath)
path=os.path.dirname(path)
path=os.path.join(path, "src")
sys.path.append(path)

import baking as bk
reload(bk)

c_dict={
    "outline":outline,
    "main_folds":main_folds,
    "sec_folds":secondary_folds,
    "inner_folds":tertiary_folds,
    "holes":holes,
}

for key, name in names.items():
    bk.set_color(name,tuple(c_dict[key]), ghdoc)
# ---------- end coloring ----------
