# Grasshopper definition link_reading_simple.gh (Grasshopper 1.0.7)

# http://ugdsolver.de/fcm/?ft=d2&fp=0&fgv=5&fgh=7&frat=1.395&ftypo2=47p_47p_47p_47p_47p&mirrh=0&mirrv=0&roth=0&rotv=0&konh=0&konv=0&mat=&c00=0&c01=0&c10=0&c11=0.7
# http://ugdsolver.de/fcm/?ft=q1lift&fp=0&fgv=5&fgh=7&frat=1.395&ftypo2=4eu_47k_4gl_47p_47p&mirrh=0&mirrv=0&roth=0&rotv=0&konh=0&konv=0&mat=&c00=0&c01=0.7&c10=0&c11=0.7
# http://ugdsolver.de/fcm/?ft=d2&fp=0&fgv=5&fgh=7&frat=1.395&ftypo2=47p_47p_47p_47p_47p&mirrh=0&mirrv=0&roth=0&rotv=0&konh=0&konv=0&mat=&c00=0&c01=0&c10=0&c11=0.7
# http://ugdsolver.de/fcm/?ft=d2&fp=0&fgv=5&fgh=7&frat=1.395&ftypo2=4eu_47k_4gl_47p_47p&mirrh=1&mirrv=0&roth=1&rotv=1&konh=0&konv=0&mat=&c00=0&c01=0&c10=0&c11=0.7
# http://ugdsolver.de/fcm/?ft=d4&fp=0&fgv=5&fgh=7&frat=1.395&ftypo2=4eu_47k_4gl_47p_47p&mirrh=1&mirrv=0&roth=1&rotv=1&konh=0&konv=0&mat=&mid=0.7%2C0.348%2C0.5
# http://ugdsolver.de/fcm/?ft=q4&fp=0&fgv=5&fgh=7&frat=1.395&ftypo2=4eu_47k_4gl_47p_47p&mirrh=1&mirrv=0&roth=1&rotv=1&konh=0&konv=0&mat=&c00=0&c01=0.2&c10=0.8&c11=0.4&mid=0.5%2C0.5%2C
# http://ugdsolver.de/fcm/?ft=t1&fp=0&fgv=5&fgh=7&frat=1.395&ftypo2=5x3c5x_5x3c5x_5x3c5x_5x3c5x_5x3c5x&mirrh=1&mirrv=0&roth=1&rotv=1&konh=0&konv=0&mat=&c00=0&c01=0&c10=0.7
# http://ugdsolver.de/fcm/?ft=t1&fp=0&fgv=5&fgh=8&frat=1.267&ftypo2=2mphemt_2mphemt_2mphemt_2mphemt_2mphemt&mirrh=1&mirrv=0&roth=1&rotv=1&konh=0&konv=0&mat=&c00=0&c01=0&c10=0.527
# http://ugdsolver.de/fcm/?ft=t2&fp=0&fgv=5&fgh=8&frat=1.267&ftypo2=nodcnp_nodcnp_nodcnp_nodcnp_nodcnp&mirrh=1&mirrv=0&roth=1&rotv=1&konh=0&konv=0&mat=&c00=0&c01=0&c10=0.7
# http://ugdsolver.de/fcm/?ft=t3&fp=0&fgv=5&fgh=8&frat=1.267&ftypo2=1vf9_1vf9_1vf9_1vf9_1vf9_1vf9&mirrh=1&mirrv=0&roth=1&rotv=1&konh=0&konv=0&mat=&c00=0&c01=0&c10=0&c11=0.7
# http://ugdsolver.de/fcm/?ft=t4&fp=0&fgv=5&fgh=8&frat=1.267&ftypo2=1vf9_1vf9_1vf9_1vf9_1vf9&mirrh=1&mirrv=0&roth=1&rotv=1&konh=0&konv=0&mat=&c00=1&c01=1&c10=0&c11=0&mid=0.7%2C0%2C0
# http://ugdsolver.de/fcm/?ft=d2&fp=0&fgv=4&fgh=6&frat=1.395&ftypo2=11x_11x_11x_11x&mirrh=1&mirrv=0&roth=1&rotv=1&konh=0&konv=0&mat=&c00=0&c01=0&c10=0&c11=0.7
panel = Panel("""http://jonass-imac.local/facade-maker/index.php?ft=d2&fp=0&fgv=5&fgh=7&frat=1.3953488372093024&ftypo=vvvvvvv&mirrh=0&mirrv=0&roth=0&rotv=0&konh=0&konv=0&mat=&c00=0&c01=0&c10=0&c11=0.7
http://jonass-imac.local/facade-maker/index.php?ft=d2&fp=0&fgv=5&fgh=7&frat=1.3953488372093024&ftypo=vvvvvvv&mirrh=0&mirrv=0&roth=0&rotv=0&konh=0&konv=0&mat=&c00=0&c01=0&c10=0&c11=0.7
http://localhost/facade-maker/?ft=q1lift&fp=0&fgv=5&fgh=7&frat=1.3953488372093024&ftypo=vvvvvvv&mirrh=0&mirrv=0&roth=0&rotv=0&konh=0&konv=0&mat=&c00=0&c01=0.5&c10=0&c11=0.5
http://localhost/facade-maker/?ft=d2&fp=0&fgv=5&fgh=7&frat=1.3953488372093024&ftypo=vvvvvvv&mirrh=0&mirrv=0&roth=0&rotv=0&konh=0&konv=0&mat=&c00=0&c01=0&c10=0&c11=0.7
http://localhost/facade-maker/?ft=d2&fp=0&fgv=5&fgh=7&frat=1.3953488372093024&ftypo=vvvvvvv&mirrh=0&mirrv=0&roth=0&rotv=0&konh=0&konv=0&mat=&c00=0&c01=0&c10=0&c11=0.7
http://localhost/facade-maker/?ft=d2&fp=0&fgv=5&fgh=7&frat=1.3953488372093024&ftypo=vvvvvvv&mirrh=0&mirrv=0&roth=0&rotv=0&konh=0&konv=0&mat=&c00=0&c01=0&c10=0&c11=0.7
http://jonass-imac.local/facade-maker/index.php?ft=d2&fp=0&fgv=5&fgh=5&frat=1.942&ftypo=ttvvv&mirrh=0&mirrv=0&roth=0&rotv=0&konh=0&konv=0&mat=&c00=0&c01=0&c10=0&c11=0.7
http://jonass-imac.local/facade-maker/index.php?ft=q1lift&fp=0&fgv=5&fgh=5&frat=1.942&ftypo=ttvvv&mirrh=0&mirrv=0&roth=0&rotv=0&konh=0&konv=0&mat=&c00=0&c01=0.5&c10=0&c11=0.5
http://jonass-imac.local/facade-maker/index.php?ft=q1lift&fp=0&fgv=5&fgh=5&frat=1.942&ftypo=ttvvv&mirrh=0&mirrv=0&roth=1&rotv=1&konh=1&konv=1&mat=&c00=0&c01=0.5&c10=0&c11=0.5
http://jonass-imac.local/facade-maker/index.php?ft=q1lift&fp=0&fgv=5&fgh=5&frat=1.942&ftypo=ttvvv&mirrh=1&mirrv=0&roth=2&rotv=1&konh=1&konv=1&mat=&c00=0&c01=0.5&c10=0&c11=0.5
http://jonass-imac.local/facade-maker/index.php?ft=q1lift&fp=0&fgv=5&fgh=5&frat=1.942&ftypo=ttvvv&mirrh=1&mirrv=0&roth=2&rotv=1&konh=1&konv=1&mat=&c00=1&c01=1&c10=0&c11=0
http://jonass-imac.local/facade-maker/index.php?ft=q1lift&fp=0&fgv=5&fgh=5&frat=1.942&ftypo=ttvvv&mirrh=1&mirrv=0&roth=2&rotv=1&konh=1&konv=1&mat=&c00=1&c01=1&c10=0&c11=0
http://jonass-imac.local/facade-maker/index.php?ft=q1lift&fp=0&fgv=5&fgh=5&frat=1.942&ftypo=ttvvv&mirrh=1&mirrv=0&roth=2&rotv=1&konh=1&konv=1&mat=&c00=1&c01=1&c10=0&c11=0
http://jonass-imac.local/facade-maker/index.php?ft=d4&fp=0&fgv=5&fgh=5&frat=1.942&ftypo=ttvvv&mirrh=1&mirrv=0&roth=2&rotv=1&konh=1&konv=1&mat=&mid=0.3263597856369532%2C0.3488372093023256%2C0.5
http://jonass-imac.local/facade-maker/index.php?ft=d4&fp=0&fgv=5&fgh=5&frat=1.942&ftypo=ttvvv&mirrh=1&mirrv=0&roth=2&rotv=1&konh=1&konv=1&mat=&mid=0.3263597856369532%2C0.3488372093023256%2C0.5
http://jonass-imac.local/facade-maker/index.php?ft=q4&fp=0&fgv=5&fgh=8&frat=1.3373488492743915&ftypo=vvttvvvv&mirrh=1&mirrv=0&roth=1&rotv=3&konh=1&konv=0&mat=&c00=0&c01=0.2&c10=0.8&c11=1&mid=0.4217472966403055%2C0.3488372093023256%2C
http://jonass-imac.local/facade-maker/index.php?ft=q4&fp=0&fgv=5&fgh=8&frat=1.3373488492743915&ftypo=1111vvvv&mirrh=0&mirrv=0&roth=3&rotv=1&konh=0&konv=0&mat=&c00=0&c01=0.2&c10=0.8&c11=1&mid=0.4217472966403055%2C0.3488372093023256%2C
http://localhost/facade-maker/?ft=q1&fp=0&fgv=5&fgh=8&frat=1.244176287983739&ftypo=llllllll&mirrh=1&mirrv=1&roth=0&rotv=0&konh=1&konv=1&mat=
http://localhost/facade-maker/?ft=d4&fp=0&fgv=5&fgh=7&frat=1.3953488372093024&ftypo=vvvvvvv&mirrh=0&mirrv=0&roth=0&rotv=0&konh=0&konv=0&mat=&mid=0.5%2C0.5%2C1
http://localhost/facade-maker/?ft=d4&fp=0&fgv=5&fgh=7&frat=1.3953488372093024&ftypo=vvvvvvv&mirrh=0&mirrv=0&roth=0&rotv=0&konh=0&konv=0&mat=&mid=0.5%2C0.5%2C-1
http://localhost/facade-maker/?ft=d4&fp=0&fgv=5&fgh=7&frat=1.3953488372093024&ftypo=vvvvvvv&mirrh=0&mirrv=0&roth=0&rotv=0&konh=1&konv=1&mat=&mid=0.5%2C0.5%2C-1
http://ugdsolver.de/fcm/?ft=t2&fp=0&fgv=5&fgh=7&frat=1.395&ftypo2=1h9u1h_1h9u1h_1h9u1h_1h9u1h_1h9u1h&mirrh=0&mirrv=0&roth=0&rotv=0&konh=0&konv=0&mat=&c00=0&c01=0&c10=0.7
http://ugdsolver.de/fcm/?ft=d2&fp=0&fgv=5&fgh=7&frat=1.395&ftypo2=7di_12g_7e1_7kp_502&mirrh=0&mirrv=0&roth=0&rotv=0&konh=0&konv=0&mat=&c00=0&c01=0&c10=0&c11=0.7""")
panel_2 = Panel("http://ugdsolver.de/fcm/?ft=t1&fp=0&fgv=5&fgh=7&frat=1.395&ftypo2=5x3c5x_5x3c5x_5x3c5x_5x3c5x_5x3c5x&mirrh=0&mirrv=0&roth=2&rotv=2&konh=1&konv=1&mat=&c00=0&c01=0&c10=0.7")
panel_3 = Panel("http://ugdsolver.de/fcm/?ft=d2&fp=0&fgv=4&fgh=6&frat=1.395&ftypo2=11x_11x_11x_11x&mirrh=1&mirrv=0&roth=1&rotv=1&konh=0&konv=0&mat=&c00=0&c01=0&c10=0&c11=0.7")
panel_4 = Panel("http://ugdsolver.de/fcm/?ft=d2&fp=0&fgv=5&fgh=7&frat=1.395&ftypo2=47p_47p_47p_47p_47p&mirrh=0&mirrv=1&roth=1&rotv=2&konh=0&konv=0&mat=&c00=1&c01=0&c10=1&c11=0.7")
panel_5 = Panel("http://ugdsolver.de/fcm/?ft=d2&fp=0&fgv=5&fgh=7&frat=1.395&ftypo2=47p_47p_47p_47p_47p&mirrh=1&mirrv=0&roth=1&rotv=1&konh=0&konv=0&mat=&c00=1&c01=0&c10=1&c11=0.7")
panel_6 = Panel("http://ugdsolver.de/fcm/?ft=d2&fp=0&fgv=5&fgh=7&frat=1.395&ftypo2=4eu_47k_4gl_47p_47p&mirrh=1&mirrv=0&roth=1&rotv=1&konh=0&konv=0&mat=&c00=0&c01=0&c10=0&c11=0.7")
panel_7 = Panel("http://ugdsolver.de/fcm/?ft=q1lift&fp=0&fgv=5&fgh=7&frat=1.395&ftypo2=47p_47p_47p_47p_47p&mirrh=1&mirrv=0&roth=1&rotv=1&konh=0&konv=0&mat=&c00=0&c01=0.7&c10=0&c11=0.7")
panel_8 = Panel("http://ugdsolver.de/fcm/?ft=t1&fp=0&fgv=5&fgh=7&frat=1.395&ftypo2=5x3c5x_5x3c5x_5x3c5x_5x3c5x_5x3c5x&mirrh=0&mirrv=1&roth=1&rotv=2&konh=0&konv=0&mat=&c00=0&c01=0&c10=0.7")
panel_9 = Panel("http://ugdsolver.de/fcm/?ft=t2&fp=0&fgv=5&fgh=7&frat=1.395&ftypo2=1h9u1h_1h9u1h_1h9u1h_1h9u1h_1h9u1h&mirrh=0&mirrv=1&roth=1&rotv=2&konh=0&konv=0&mat=&c00=0&c01=0&c10=0.7")
panel_10 = Panel("http://ugdsolver.de/fcm/?ft=d4&fp=0&fgv=5&fgh=8&frat=1.2&ftypo2=gut_gut_gut_gut_gut&mirrh=0&mirrv=0&roth=2&rotv=0&konh=0&konv=0&mat=&mid=0.751%2C0.651%2C0.5")
panel_11 = Panel("http://ugdsolver.de/fcm/?ft=t4&fp=0&fgv=5&fgh=8&frat=1.2&ftypo2=1vf9_1vf9_1vf9_1vf9_1vf9&mirrh=1&mirrv=1&roth=0&rotv=0&konh=1&konv=0&mat=&c00=1&c01=1&c10=0&c11=0&mid=0.7%2C0%2C0")
panel_12 = Panel("http://ugdsolver.de/fcm/?ft=t4&fp=0&fgv=5&fgh=8&frat=1.2&ftypo2=1vf9_1vf9_1vf9_1vf9_1vf9&mirrh=1&mirrv=1&roth=3&rotv=1&konh=0&konv=1&mat=&c00=1&c01=2&c10=0&c11=0&mid=0.7%2C0%2C0")
panel_13 = Panel("http://ugdsolver.de/fcm/?ft=d4&fp=0&fgv=5&fgh=8&frat=1.267&ftypo2=gut_gut_gut_gut_gut&mirrh=1&mirrv=0&roth=1&rotv=1&konh=0&konv=0&mat=&mid=0.5%2C0.5%2C-1")
# https://facademaker.alucobond.com/?ft=d2&fp=0&fgv=5&fgh=7&frat=1.3953488372093024&ftypo=ttvvvvv&mirrh=0&mirrv=0&roth=0&rotv=0&konh=0&konv=0&mat=&c00=0&c01=0&c10=0&c11=0.7
panel_14 = Panel("http://ugdsolver.de/fcm/?ft=d2&fp=0&fgv=5&fgh=7&frat=1.395&ftypo2=4eu_47k_4gl_47p_47p&mirrh=1&mirrv=0&roth=1&rotv=1&konh=0&konv=0&mat=&c00=0&c01=0&c10=0&c11=0.7")
python = GhPythonScript(x=panel)  # -> out, a
# ---------- python: Python ----------
a = x.split('\n')
# ---------- end python ----------
panel_15 = Panel("http://ugdsolver.de/fcm/?ft=q4&fp=0&fgv=5&fgh=7&frat=1.395&ftypo2=4ee_47k_4gl_47p_47p&mirrh=1&mirrv=0&roth=1&rotv=1&konh=0&konv=0&mat=&c00=0&c01=0.2&c10=0.8&c11=0.4&mid=0.5%2C0.5%2C")
panel_16 = Panel("http://ugdsolver.de/fcm/?ft=q4&fp=0&fgv=5&fgh=8&frat=1.2&ftypo2=gut_gut_gut_gut_gut&mirrh=0&mirrv=1&roth=2&rotv=1&konh=0&konv=0&mat=&c00=0&c01=0.2&c10=0.8&c11=0.4&mid=0.344%2C0.313%2C")
panel_17 = Panel("http://ugdsolver.de/fcm/?ft=t3&fp=0&fgv=5&fgh=8&frat=1.2&ftypo2=1vf9_1vf9_1vf9_1vf9_1vf9_1vf9&mirrh=0&mirrv=0&roth=0&rotv=0&konh=0&konv=0&mat=&c00=2&c01=0&c10=2&c11=0.833")
item = ListItem(List=python.a, Index=Slider(12, range=0..15), Wrap=True)
panel_18 = Panel(item)
stringreading = GhPythonScript(string=panel_15)  # -> out, flatten(data_dict)
# ---------- stringreading: Python ----------
import sys
import Rhino.Geometry as rg

import os
import Grasshopper

path=os.path.dirname(Grasshopper.Instances.ActiveCanvas.Document.FilePath)
path=os.path.dirname(path)
path+="/src"
sys.path.append(path)

import read_link as rl
reload(rl)

data_dict=[rl.string_reader(string)]
# ---------- end stringreading ----------
panel_19 = Panel(stringreading.out)
item_2 = ListItem(List=stringreading.data_dict, Index=0, Wrap=True)
print_dict = GhPythonScript(
    x=stringreading.data_dict,
    h_mir=Toggle(True),
    v_mir=Toggle(True),
    h_kon=Toggle(False),
    v_kon=Toggle(False),
    roth=Slider(0, range=0..3),
    rotv=Slider(0, range=0..3))  # -> flatten(out), data_dict; inputs h_mir: Boolean, v_mir: Boolean, h_kon: Boolean, v_kon: Boolean, roth: Int32, rotv: Int32
# ---------- print_dict: Python ----------
string=''
for key, item in x.items():
    string+="{} : {}\n".format(key, item)
x['mirrh']=h_mir
x['mirrv']=v_mir
x['konh']=h_kon
x['konv']=v_kon
x['roth']=roth
x['rotv']=rotv
#x['ft']='t4'
print(string)
data_dict=[x]
# ---------- end print_dict ----------
stringreading_2 = GhPythonScript()  # -> out, f, flatten(data_dict)
# ---------- stringreading_2: Python ----------
import sys
import Rhino.Geometry as rg

import os
import Grasshopper

path=os.path.dirname(Grasshopper.Instances.ActiveCanvas.Document.FilePath)
path=os.path.dirname(path)
path+="/src"
sys.path.append(path)

import debugging_tools as dbt
reload(dbt)

f=dbt.list_counter(
    [
        [
            [
                rg.Point3d(0,0,0),
                rg.Point3d(0,0,10),
                rg.Point3d(0,10,10),
            ],
            [
                rg.Point3d(10,10,20),
                rg.Point3d(10,40,20),
                rg.Point3d(10,50,60),
            ]
        ],
        [
            [
                rg.Point3d(100,0,0),
                rg.Point3d(100,100,0),
                rg.Point3d(0,100,0),
                rg.Point3d(0,0,0),
            ]
        ]
    ]
)

print(f)
# ---------- end stringreading_2 ----------
stringreading_3 = GhPythonScript(data_dict=stringreading.data_dict)  # -> out, f, flatten(data_dict)
# ---------- stringreading_3: Python ----------
import sys
import Rhino.Geometry as rg

import os
import Grasshopper

path=os.path.dirname(Grasshopper.Instances.ActiveCanvas.Document.FilePath)
path=os.path.dirname(path)
path+="/src"
sys.path.append(path)

import front_end_set as fes
reload(fes)

print(data_dict["hs"])

f=fes.SquareSet(
    x=data_dict["x_spacing"],
    y=data_dict["z_spacing"],
    hs=data_dict["hs"]
)
# ---------- end stringreading_3 ----------
print_dict_2 = GhPythonScript(x=stringreading.data_dict)  # -> flatten(out)
# ---------- print_dict_2: Python ----------
string=''
for key, item in x.items():
    string+="{} : {}\n".format(key, item)
    
print(string)
print(x)
# ---------- end print_dict_2 ----------
stringreading_4 = GhPythonScript(data_dict=item_2)  # -> out, f, ptsss, flatten(data_dict)
# ---------- stringreading_4: Python ----------
import sys
import Rhino.Geometry as rg

import os
import Grasshopper

path=os.path.dirname(Grasshopper.Instances.ActiveCanvas.Document.FilePath)
path=os.path.dirname(path)
path+="/src"
sys.path.append(path)

import front_end_set as fes
reload(fes)

print(data_dict["hs"])

f=fes.SquareSet(
    x=data_dict["x_spacing"],
    y=data_dict["z_spacing"],
    hs=data_dict["hs"]
)

f.h_kon()
ptsss=f.generate()
print(f.generate())
# ---------- end stringreading_4 ----------
panel_20 = Panel(stringreading_2.out)
panel_21 = Panel(print_dict_2)
panel_22 = Panel(print_dict.out)
number_slider = Slider(4, range=0..10)
relay = Relay()
list = ValueList({"Straight": "flat", "Clockwise": "clockwise", "Counter-Clockwise": "counter_clockwise", "Alternating-A": "alternating_A", "Alternating-B": "alternating_B", "Flaps": "flaps"}, selected="Alternating-A")
item_3 = ListItem(List=relay, Index=0, Wrap=True)
list_2 = ValueList({"x constrained": 0, "y constrained": 1, "xy constrained": 2, "free": 3}, selected="free")
python_2 = GhPythonScript(x=item_3)  # -> out, a
# ---------- python_2: Python ----------
print(x)
# ---------- end python_2 ----------
list_3 = ValueList({"Optimal Width": 0, "Optimal Length": 1, "Optimal Area": 2}, selected="Optimal Length")
parameter_assignment = GhPythonScript(
    flap_h_max=Slider(10, range=0..10),
    correction_val=Slider(10, range=0..10),
    flap_h=Slider(3.568, range=0..10),
    flap_w=Slider(3.418, range=0..10),
    mesh_correction_val=Toggle(False),
    show_correction_val=Toggle(True),
    fold_idx=Slider(1, range=0..1),
    orient=Toggle(True),
    pattern=list)  # -> out, construction_parameters; inputs mesh_correction_val: Boolean, show_correction_val: Boolean, fold_idx: Int32, orient: Boolean
# ---------- parameter_assignment: Python ----------
construction_parameters = {
    "flap_h_max" : 30.,
    "correction_val" : .7,
    "flap_h" : 20.0,
    "flap_w" : 40.0,
    "mesh_correction_val" : False,
    "show_correction_val" : True,
    "fold_idx" : 0,
    "min_pt_height" : 50.,
    "orient" : True,
    "pattern" : "flat"
}

input_parameters = {
    "flap_h_max" : flap_h_max,
    "correction_val" : correction_val,
    "flap_h" : flap_h,
    "flap_w" : flap_w,
    "mesh_correction_val" : mesh_correction_val,
    "show_correction_val" : show_correction_val,
    "fold_idx" : fold_idx,
    "min_pt_height" : min_pt_height,
    "orient" : orient,
    "pattern" : pattern
}

for key, value in input_parameters.items():
    if not(value is None):
        construction_parameters[key]=value
        
construction_parameters=[construction_parameters]
# ---------- end parameter_assignment ----------
stringreading_5 = GhPythonScript(
    data_dict=stringreading.data_dict,
    z_spacing=Slider(1985.273, range=0..10000),
    y_delta=Slider(500, range=0..500),
    other_parameters=parameter_assignment.construction_parameters)  # -> out, f, flatten(data_dict)
# ---------- stringreading_5: Python ----------
import sys
import Rhino.Geometry as rg

import os
import Grasshopper

path=os.path.dirname(Grasshopper.Instances.ActiveCanvas.Document.FilePath)
path=os.path.dirname(path)
path+="/src"
sys.path.append(path)

import facade_from_dict as ffd
reload(ffd)

f=ffd.facade_from_dict(data_dict, z_spacing=z_spacing, y_delta=y_delta, other_parameters=other_parameters)
data_dict=[data_dict]
# ---------- end stringreading_5 ----------
genmesh = GhPythonScript(f=stringreading_5.f)  # -> out, vis_mesh, b_pts, d2s, mshs
# ---------- genmesh: Python ----------
mshs=f.populate()
d2s=f.all_base_objects
print(f)
print(d2s)
# ---------- end genmesh ----------
panel_23 = Panel(stringreading_5.out)
panel_24 = Panel(genmesh.d2s)
mesh = Mesh(genmesh.mshs)
python_3 = GhPythonScript(D2s=genmesh.d2s)  # -> Out, A
medges = MeshEdges(Mesh=mesh)  # -> NakedEdges, InteriorEdges, NonManifoldEdges
item_4 = ListItem(List=stringreading_5.out, Index=Slider(39, range=0..100), Wrap=True)
python_4 = GhPythonScript(x=genmesh.d2s)  # -> out, unfolded_objs, outline_crv, panel, intra_flap_folds, body_flap_folds, top_face_folds, tag_location, tag_name; inputs x: list
# ---------- python_4: Python ----------
from Rhino.Geometry import Plane, Point3d, Vector3d

h_pos=0.

outline_crv=[]
panel=[]
top_face_folds=[]
body_flap_folds=[]
intra_flap_folds=[]

optimization_parameters={"iterations":50, "max_w":2200, "max_l": 3600, "preference":"width"}

tag_name=[]
tag_location=[]

for d_o in x:
    unfolded_objs=d_o.get_2d(optimization_parameters=optimization_parameters)
    tag_name.append(str(d_o))
    tag_location.append(Point3d(0,h_pos,0))
    hs=[1000.]
    w_pos=0.
    for u_o in unfolded_objs:
        pln=Plane(
                Point3d(w_pos, h_pos,0.),
                Vector3d.XAxis,
                Vector3d.YAxis,
            )
        data_dict=u_o.bake_dict(pln)
            
        outline_crv.append(data_dict["outline_crv"])
        panel.append(data_dict["panel"])
        top_face_folds.extend(data_dict["top_face_folds"])
        body_flap_folds.extend(data_dict["body_flap_folds"])
        intra_flap_folds.extend(data_dict["intra_flap_folds"])
        w_pos+=u_o.width
        hs.append(u_o.height)
    m_h=max(hs)
    h_pos+=m_h
    tag_location[-1].Y+=m_h*.5
# ---------- end python_4 ----------
python_5 = GhPythonScript(string=item_4)  # -> out, sub_string, pts_a, pts_b, pl_a, pl_b
# ---------- python_5: Python ----------
from Rhino.Geometry import Point3d, Polyline

sub_string=[]
pts=[]

for ln in string.split(', '):
    splitted=ln.split(' [')[1]
    splitted=splitted.split(']')[0]
    splitted=[float(val) for val in splitted.split(',')]
    x,y,z=splitted
    sub_string.append(Point3d(x,y,z))
    
print(sub_string)
pts_a=sub_string[32:]
pl_a=[Polyline([pts_a[i*4+j%4] for j in range(5)]).ToNurbsCurve() for i in range(int(len(pts_a) / 4))]
pts_b=sub_string[:32]
pl_b=[Polyline([pts_b[i*4+j%4] for j in range(5)]).ToNurbsCurve() for i in range(int(len(pts_b) / 4))]
# ---------- end python_5 ----------
tag = TextTag(Location=python_4.tag_location, Text=python_4.tag_name)
pt = Point(python_5.pts_a)
pt_2 = Point(python_5.pts_b)
split = SplitList(List=python_5.pl_a, Index=number_slider)  # -> ListA, ListB
split_2 = SplitList(List=python_5.pl_b, Index=number_slider)  # -> ListA, ListB
crv = Curve(split.ListB)
crv_2 = Curve(split.ListA)
crv_3 = Curve(split_2.ListA)
crv_4 = Curve(split_2.ListB)
panel_25 = Panel(python_5.out)
number_slider_2 = Slider(1.1, range=-10..10)
python_6 = GhPythonScript(
    width=Slider(200, range=0..1000),
    length=Slider(1000, range=0..1000),
    constraint_idx=list_2,
    bottom_0=Slider(47.7, range=0..100),
    bottom_1=Slider(97.1, range=0..100),
    top_0=Slider(100, range=0..100),
    top_1=Slider(43.7, range=0..250),
    xy_constraint_idx=Slider(1, range=0..3),
    tangent_shift=Slider(0.7, range=0..4))  # -> out, boundary, folds; inputs xy_constraint_idx: Int32
# ---------- python_6: Python ----------
import Rhino.Geometry as rg

def pt_on_plane(pln, pt):
    n=pln.Normal
    p0=pln.Origin
    l0=pt
    l=rg.Vector3d(0,0,1)
    
    t=(p0-l0)*n / (l*n)
    
    return rg.Point3d(l0 + l*t)

delta=tangent_shift*length

boundary=[
    rg.Point3d(delta,length,0.0),
    rg.Point3d(0.0,0.0,0.0),
    rg.Point3d(width,0.0,0.0),
    rg.Point3d(width+delta,length,0.0)
]

if constraint_idx == 0:
    main_heigth_bottom=bottom_0 if bottom_0>0.1 else bottom_1
    main_heigth_top=top_0 if top_0>0.1 else top_1
    h_0=main_heigth_bottom
    h_1=main_heigth_bottom
    h_2=main_heigth_top
    h_3=main_heigth_top
    
    h_list=[h_2, h_0, h_1, h_3]
    
    folds=False
    
elif constraint_idx == 1:
    main_heigth_left=bottom_0 if bottom_0>0.1 else top_0
    main_heigth_right=bottom_1 if bottom_1>0.1 else top_1
    h_0=main_heigth_left
    h_1=main_heigth_right
    h_2=main_heigth_left
    h_3=main_heigth_right
    
    h_list=[h_2, h_0, h_1, h_3]
    
    folds=False
    
elif constraint_idx == 2:
    h_0=bottom_0
    h_1=bottom_1
    h_2=top_0
    h_3=top_1
    
    h_list=[h_2, h_0, h_1, h_3]
    for i,val in enumerate(h_list):
        boundary[i].Z=val
        
    pt=boundary.pop(xy_constraint_idx)
    pln=rg.Plane(boundary[0], boundary[1], boundary[2])
    
    new_height=pt_on_plane(pln, pt).Z
    if new_height > 0.1:
        h_list[xy_constraint_idx]=new_height
    else:
        difference=.01 - new_height
        h_list=[val+difference for val in h_list]
        h_list[xy_constraint_idx]=.01
        
    folds=False
    
elif constraint_idx == 3:
    h_0=bottom_0
    h_1=bottom_1
    h_2=top_0
    h_3=top_1
    
    h_list=[h_2, h_0, h_1, h_3]
    
    folds=True

boundary=[
    rg.Point3d(delta,length,0.0),
    rg.Point3d(0.0,0.0,0.0),
    rg.Point3d(width,0.0,0.0),
    rg.Point3d(width+delta,length,0.0)
]

for i,val in enumerate(h_list):
    boundary[i].Z=val
# ---------- end python_6 ----------
number_slider_3 = Slider(100, range=0..100)
panel_27 = Panel(python_2.out)
optimization = GhPythonScript(
    iterations=Slider(50, range=10..1000),
    max_width=Slider(3656.2, range=0..10000),
    max_length=Slider(4116.5, range=0..10000),
    optimization=list_3)  # -> out, opt_dict; inputs iterations: Int32, optimization: Int32
# ---------- optimization: Python ----------
optimization_dict = {
    "iterations" : iterations,
    "max_w" : max_width,
    "max_l" : max_length,
}

optimization_dict["preference"] = ["width","length","area"][optimization]
opt_dict=[optimization_dict]
# ---------- end optimization ----------
objectsgeneration = GhPythonScript(
    input_lists=stringreading_4.ptsss,
    construction_parameters=parameter_assignment.construction_parameters,
    optimization_parameters=optimization.opt_dict)  # -> out, vis_mesh, b_pts, d2s; inputs input_lists: list, b_pt: Point3d
# ---------- objectsgeneration: Python ----------
import sys
import Rhino.Geometry as rg

import os
import Grasshopper

path=os.path.dirname(Grasshopper.Instances.ActiveCanvas.Document.FilePath)
path=os.path.dirname(path)
path+="/src"
sys.path.append(path)

import base_object as bo
reload(bo)

a_b_o=bo.BaseObject.simple_square(input_lists[0][0],other_parameters=construction_parameters)
print(a_b_o)
print(a_b_o.objs)
d2s=a_b_o.get_2d(optimization_parameters=optimization_parameters)
print(len(d2s))
b_pts=d2s[0].b_pts
d2s=[d2s[0].bake_dict()]
# ---------- end objectsgeneration ----------
panel_28 = Panel(objectsgeneration.d2s)
list_4 = ValueList({"Straight": 0, "Clockwise": 1, "Counter-Clockwise": 2, "Alternating-A": 3, "Alternating-B": 4, "Flaps": 5}, selected="Clockwise")
toggle = BooleanToggle(False)
toggle_2 = BooleanToggle(False)
panel_29 = Panel(python_4.out)
panel_30 = Panel(item_4)
panel_31 = Panel(genmesh.out)
objectsgeneration_2 = GhPythonScript(construction_parameters=parameter_assignment.construction_parameters, optimization_parameters=optimization.opt_dict)  # -> out, vis_mesh, b_pts, d2s, mshs; inputs input_lists: list, b_pt: Point3d
# ---------- objectsgeneration_2: Python ----------
import sys
import Rhino.Geometry as rg

import os
import Grasshopper

path=os.path.dirname(Grasshopper.Instances.ActiveCanvas.Document.FilePath)
path=os.path.dirname(path)
path+="/src"
sys.path.append(path)

import facade as fc
reload(fc)

a_facade=fc.FacademakerFacade(
    x_spacing=data_dict["xy_dim"]*1000.*data_dict["frat"],
    z_spacing=data_dict["xy_dim"]*1000.,
    x_count=int(data_dict["fgh"]),
    z_count=int(data_dict["fgv"])
)
a_facade.set_selection_pattern(data_dict["ftypo"],0)
a_facade.set_multi_squares(input_lists, construction_parameters)
mshs=a_facade.populate()
print(mshs)
print(a_facade.layer_shift)
print(a_facade.all_base_objects)
# ---------- end objectsgeneration_2 ----------
medges_2 = MeshEdges(Mesh=objectsgeneration_2.mshs)  # -> NakedEdges, InteriorEdges, NonManifoldEdges
mesh_2 = Mesh(objectsgeneration_2.mshs)
panel_32 = Panel(objectsgeneration_2.out)
