# Grasshopper definition merging.gh (Grasshopper 1.0.7)

panel = Panel("""http://jonass-imac.local/facade-maker/index.php?ft=d2&fp=0&fgv=5&fgh=7&frat=1.3953488372093024&ftypo=vvvvvvv&mirrh=0&mirrv=0&roth=0&rotv=0&konh=0&konv=0&mat=&c00=0&c01=0&c10=0&c11=0.7
http://jonass-imac.local/facade-maker/index.php?ft=d2&fp=0&fgv=5&fgh=7&frat=1.3953488372093024&ftypo=vvvvvvv&mirrh=0&mirrv=0&roth=0&rotv=0&konh=0&konv=0&mat=&c00=0&c01=0&c10=0&c11=0.7
http://localhost/facade-maker/?ft=q1lift&fp=0&fgv=5&fgh=7&frat=1.3953488372093024&ftypo=vvvvvvv&mirrh=0&mirrv=0&roth=0&rotv=0&konh=0&konv=0&mat=&c00=0&c01=0.5&c10=0&c11=0.5
http://localhost/facade-maker/?ft=d2&fp=0&fgv=5&fgh=7&frat=1.3953488372093024&ftypo=vvvvvvv&mirrh=0&mirrv=0&roth=0&rotv=0&konh=0&konv=0&mat=&c00=0&c01=0&c10=0&c11=0.7
http://localhost/facade-maker/?ft=d2&fp=0&fgv=5&fgh=7&frat=1.3953488372093024&ftypo=vvvvvvv&mirrh=0&mirrv=0&roth=0&rotv=0&konh=0&konv=0&mat=&c00=0&c01=0&c10=0&c11=0.7
http://localhost/facade-maker/?ft=d2&fp=0&fgv=5&fgh=7&frat=1.3953488372093024&ftypo=vvvvvvv&mirrh=0&mirrv=0&roth=0&rotv=0&konh=0&konv=0&mat=&c00=0&c01=0&c10=0&c11=0.7
http://jonass-imac.local/facade-maker/index.php?ft=d2&fp=0&fgv=5&fgh=5&frat=1.942&ftypo=ttvvv&mirrh=0&mirrv=0&roth=0&rotv=0&konh=0&konv=0&mat=&c00=0&c01=0&c10=0&c11=0.7
http://jonass-imac.local/facade-maker/index.php?ft=q1lift&fp=0&fgv=5&fgh=5&frat=1.942&ftypo=ttvvv&mirrh=0&mirrv=0&roth=0&rotv=0&konh=0&konv=0&mat=&c00=0&c01=0.5&c10=0&c11=0.5
http://jonass-imac.local/facade-maker/index.php?ft=q1lift&fp=0&fgv=5&fgh=5&frat=1.942&ftypo=ttvvv&mirrh=0&mirrv=0&roth=1&rotv=1&konh=1&konv=1&mat=&c00=0&c01=0.5&c10=0&c11=0.5
http://jonass-imac.local/facade-maker/index.php?ft=q1lift&fp=0&fgv=5&fgh=5&frat=1.942&ftypo=ttvvv&mirrh=1&mirrv=0&roth=2&rotv=1&konh=1&konv=1&mat=&c00=0&c01=0.5&c10=0&c11=0.5
http://jonass-imac.local/facade-maker/index.php?ft=q1lift&fp=0&fgv=5&fgh=5&frat=1.942&ftypo=ttvvv&mirrh=1&mirrv=0&roth=2&rotv=1&konh=1&konv=1&mat=&c00=1&c01=1&c10=0&c11=0
http://jonass-imac.local/facade-maker/index.php?ft=q1lift&fp=0&fgv=5&fgh=5&frat=1.942&ftypo=ttvvv&mirrh=1&mirrv=0&roth=2&rotv=1&konh=1&konv=1&mat=&c00=1&c01=1&c10=0&c11=0
http://jonass-imac.local/facade-maker/index.php?ft=q1lift&fp=0&fgv=5&fgh=5&frat=1.942&ftypo=ttvvv&mirrh=1&mirrv=0&roth=2&rotv=1&konh=1&konv=1&mat=&c00=1&c01=1&c10=0&c11=0
http://jonass-imac.local/facade-maker/index.php?ft=d4&fp=0&fgv=5&fgh=5&frat=1.942&ftypo=ttvvv&mirrh=1&mirrv=0&roth=2&rotv=1&konh=1&konv=1&mat=&mid=0.3263597856369532%2C0.3488372093023256%2C0.5
http://jonass-imac.local/facade-maker/index.php?ft=d4&fp=0&fgv=5&fgh=5&frat=1.942&ftypo=ttvvv&mirrh=1&mirrv=0&roth=2&rotv=1&konh=1&konv=1&mat=&mid=0.3263597856369532%2C0.3488372093023256%2C0.5
http://jonass-imac.local/facade-maker/index.php?ft=q4&fp=0&fgv=5&fgh=8&frat=1.3373488492743915&ftypo=vvttvvvv&mirrh=1&mirrv=0&roth=1&rotv=3&konh=1&konv=0&mat=&c00=0&c01=0.2&c10=0.8&c11=1&mid=0.4217472966403055%2C0.3488372093023256%2C
http://jonass-imac.local/facade-maker/index.php?ft=q4&fp=0&fgv=5&fgh=8&frat=1.3373488492743915&ftypo=1111vvvv&mirrh=0&mirrv=0&roth=3&rotv=1&konh=0&konv=0&mat=&c00=0&c01=0.2&c10=0.8&c11=1&mid=0.4217472966403055%2C0.3488372093023256%2C
http://localhost/facade-maker/?ft=q1&fp=0&fgv=5&fgh=8&frat=1.244176287983739&ftypo=llllllll&mirrh=1&mirrv=1&roth=0&rotv=0&konh=1&konv=1&mat=
http://localhost/facade-maker/?ft=d4&fp=0&fgv=5&fgh=7&frat=1.3953488372093024&ftypo=vvvvvvv&mirrh=0&mirrv=0&roth=0&rotv=0&konh=0&konv=0&mat=&mid=0.5%2C0.5%2C1
http://localhost/facade-maker/?ft=d4&fp=0&fgv=5&fgh=7&frat=1.3953488372093024&ftypo=vvvvvvv&mirrh=0&mirrv=0&roth=0&rotv=0&konh=0&konv=0&mat=&mid=0.5%2C0.5%2C-1
http://localhost/facade-maker/?ft=d4&fp=0&fgv=5&fgh=7&frat=1.3953488372093024&ftypo=vvvvvvv&mirrh=0&mirrv=0&roth=0&rotv=0&konh=1&konv=1&mat=&mid=0.5%2C0.5%2C-1
http://ugdsolver.de/fcm/?ft=t2&fp=0&fgv=5&fgh=7&frat=1.395&ftypo2=1h9u1h_1h9u1h_1h9u1h_1h9u1h_1h9u1h&mirrh=0&mirrv=0&roth=0&rotv=0&konh=0&konv=0&mat=&c00=0&c01=0&c10=0.7
http://ugdsolver.de/fcm/?ft=d2&fp=0&fgv=5&fgh=7&frat=1.395&ftypo2=7di_12g_7e1_7kp_502&mirrh=0&mirrv=0&roth=0&rotv=0&konh=0&konv=0&mat=&c00=0&c01=0&c10=0&c11=0.7""")
# http://jonass-imac.local/facade-maker/index.php?ft=d4&fp=0&fgv=5&fgh=5&frat=1.942&ftypo=ttvvv&mirrh=1&mirrv=0&roth=2&rotv=1&konh=1&konv=1&mat=&mid=0.3263597856369532%2C0.3488372093023256%2C0.5
panel_2 = Panel("http://localhost/facade-maker/?ft=q1&fp=0&fgv=5&fgh=8&frat=1.244176287983739&ftypo=llllllll&mirrh=1&mirrv=1&roth=0&rotv=0&konh=1&konv=1&mat=")
number_slider = Slider(0, range=0..3)
number_slider_2 = Slider(1, range=0..3)
python = GhPythonScript(x=panel)  # -> out, a
# ---------- python: Python ----------
a = x.split('\n')
# ---------- end python ----------
number_slider_3 = Slider(2, range=1..10)
number_slider_4 = Slider(2, range=1..10)
list = ValueList({"x constrained": 0, "y constrained": 1, "xy constrained": 2, "free": 3}, selected="free")
list_2 = ValueList({"x constrained": 0, "y constrained": 1, "xy constrained": 2, "free": 3}, selected="free")
panel_3 = Panel("http://localhost/facade-maker/?ft=q1&fp=0&fgv=5&fgh=8&frat=1.244176287983739&ftypo=llllllll&mirrh=1&mirrv=1&roth=0&rotv=0&konh=1&konv=1&mat=")
list_3 = ValueList({"Optimal Width": 0, "Optimal Length": 1, "Optimal Area": 2}, selected="Optimal Width")
list_4 = ValueList({"Optimal Width": 0, "Optimal Length": 1, "Optimal Area": 2}, selected="Optimal Width")
list_5 = ValueList({"Optimal Width": 0, "Optimal Length": 1, "Optimal Area": 2}, selected="Optimal Width")
num = Number()
item = ListItem(List=python.a, Index=Slider(0, range=0..100), Wrap=True)
python_2 = GhPythonScript()  # -> Out, A
string_reading = GhPythonScript(input_string=item)  # -> out, data_dict
# ---------- string_reading: Python ----------
import sys, os

path = ghenv.Component.OnPingDocument().FilePath
path = os.path.dirname(path)
path = os.path.dirname(path)
sys.path.append(path + "/link_reading")

print("############## <sys.path> ###################################")
print('\n'.join(sys.path) )
print("################# </> #######################################")

import read_link as rl
reload(rl)
        
data_dict = [rl.string_reader(input_string)]
# ---------- end string_reading ----------
python_3 = GhPythonScript(
    width=Slider(200, range=0..1000),
    length=Slider(1000, range=0..1000),
    constraint_idx=list,
    bottom_0=Slider(100, range=0..100),
    bottom_1=Slider(34.6, range=0..100),
    top_0=Slider(35, range=0..100),
    top_1=Slider(149.7, range=0..250),
    xy_constraint_idx=number_slider)  # -> out, boundary, folds; inputs xy_constraint_idx: Int32
# ---------- python_3: Python ----------
import Rhino.Geometry as rg

def pt_on_plane(pln, pt):
    n=pln.Normal
    p0=pln.Origin
    l0=pt
    l=rg.Vector3d(0,0,1)
    
    t=(p0-l0)*n / (l*n)
    
    return rg.Point3d(l0 + l*t)

boundary=[
    rg.Point3d(0.0,length,0.0),
    rg.Point3d(0.0,0.0,0.0),
    rg.Point3d(width,0.0,0.0),
    rg.Point3d(width,length,0.0)
]

if constraint_idx == 0:
    main_heigth_bottom=bottom_0 if bottom_0>0.1 else bottom_1
    main_heigth_top=top_0 if top_0>0.1 else top_1
    h_0=main_heigth_bottom
    h_1=main_heigth_bottom
    h_2=main_heigth_top
    h_3=main_heigth_top
    
    h_list=[h_2, h_0, h_1, h_3]
    
    folds=False
    
elif constraint_idx == 1:
    main_heigth_left=bottom_0 if bottom_0>0.1 else top_0
    main_heigth_right=bottom_1 if bottom_1>0.1 else top_1
    h_0=main_heigth_left
    h_1=main_heigth_right
    h_2=main_heigth_left
    h_3=main_heigth_right
    
    h_list=[h_2, h_0, h_1, h_3]
    
    folds=False
    
elif constraint_idx == 2:
    h_0=bottom_0
    h_1=bottom_1
    h_2=top_0
    h_3=top_1
    
    h_list=[h_2, h_0, h_1, h_3]
    for i,val in enumerate(h_list):
        boundary[i].Z=val
        
    pt=boundary.pop(xy_constraint_idx)
    pln=rg.Plane(boundary[0], boundary[1], boundary[2])
    
    new_height=pt_on_plane(pln, pt).Z
    if new_height > 0.1:
        h_list[xy_constraint_idx]=new_height
    else:
        difference=.01 - new_height
        h_list=[val+difference for val in h_list]
        h_list[xy_constraint_idx]=.01
        
    folds=False
    
elif constraint_idx == 3:
    h_0=bottom_0
    h_1=bottom_1
    h_2=top_0
    h_3=top_1
    
    h_list=[h_2, h_0, h_1, h_3]
    
    folds=True

boundary=[
    rg.Point3d(0.0,length,0.0),
    rg.Point3d(0.0,0.0,0.0),
    rg.Point3d(width,0.0,0.0),
    rg.Point3d(width,length,0.0)
]

for i,val in enumerate(h_list):
    boundary[i].Z=val
# ---------- end python_3 ----------
python_4 = GhPythonScript(
    width=Slider(200, range=0..1000),
    length=Slider(1000, range=0..1000),
    constraint_idx=list_2,
    bottom_0=Slider(47.7, range=0..100),
    bottom_1=Slider(97.1, range=0..100),
    top_0=Slider(100, range=0..100),
    top_1=Slider(43.7, range=0..250),
    xy_constraint_idx=number_slider_2,
    tangent_shift=Slider(0.7, range=0..4))  # -> out, boundary, folds; inputs xy_constraint_idx: Int32
# ---------- python_4: Python ----------
import Rhino.Geometry as rg

def pt_on_plane(pln, pt):
    n=pln.Normal
    p0=pln.Origin
    l0=pt
    l=rg.Vector3d(0,0,1)
    
    t=(p0-l0)*n / (l*n)
    
    return rg.Point3d(l0 + l*t)

delta=tangent_shift*length

boundary=[
    rg.Point3d(delta,length,0.0),
    rg.Point3d(0.0,0.0,0.0),
    rg.Point3d(width,0.0,0.0),
    rg.Point3d(width+delta,length,0.0)
]

if constraint_idx == 0:
    main_heigth_bottom=bottom_0 if bottom_0>0.1 else bottom_1
    main_heigth_top=top_0 if top_0>0.1 else top_1
    h_0=main_heigth_bottom
    h_1=main_heigth_bottom
    h_2=main_heigth_top
    h_3=main_heigth_top
    
    h_list=[h_2, h_0, h_1, h_3]
    
    folds=False
    
elif constraint_idx == 1:
    main_heigth_left=bottom_0 if bottom_0>0.1 else top_0
    main_heigth_right=bottom_1 if bottom_1>0.1 else top_1
    h_0=main_heigth_left
    h_1=main_heigth_right
    h_2=main_heigth_left
    h_3=main_heigth_right
    
    h_list=[h_2, h_0, h_1, h_3]
    
    folds=False
    
elif constraint_idx == 2:
    h_0=bottom_0
    h_1=bottom_1
    h_2=top_0
    h_3=top_1
    
    h_list=[h_2, h_0, h_1, h_3]
    for i,val in enumerate(h_list):
        boundary[i].Z=val
        
    pt=boundary.pop(xy_constraint_idx)
    pln=rg.Plane(boundary[0], boundary[1], boundary[2])
    
    new_height=pt_on_plane(pln, pt).Z
    if new_height > 0.1:
        h_list[xy_constraint_idx]=new_height
    else:
        difference=.01 - new_height
        h_list=[val+difference for val in h_list]
        h_list[xy_constraint_idx]=.01
        
    folds=False
    
elif constraint_idx == 3:
    h_0=bottom_0
    h_1=bottom_1
    h_2=top_0
    h_3=top_1
    
    h_list=[h_2, h_0, h_1, h_3]
    
    folds=True

boundary=[
    rg.Point3d(delta,length,0.0),
    rg.Point3d(0.0,0.0,0.0),
    rg.Point3d(width,0.0,0.0),
    rg.Point3d(width+delta,length,0.0)
]

for i,val in enumerate(h_list):
    boundary[i].Z=val
# ---------- end python_4 ----------
python_5 = GhPythonScript(
    width=Slider(200, range=0..1000),
    length=Slider(440, range=0..1000),
    side_heigth=Slider(46.2, range=0..100),
    c_pt_x_percent=Slider(28, range=0..100),
    c_pt_y_percent=Slider(52.4, range=0..100),
    c_pt_heigth=Slider(100, range=0..250))  # -> out, boundary, c_pt
# ---------- python_5: Python ----------
import Rhino.Geometry as rg

boundary=[
    rg.Point3d(0.0,length,side_heigth),
    rg.Point3d(0.0,0.0,side_heigth),
    rg.Point3d(width,0.0,side_heigth),
    rg.Point3d(width,length,side_heigth)
]

c_pt=rg.Point3d(
    width*c_pt_x_percent*.01,
    length*c_pt_y_percent*.01,
    c_pt_heigth
)
# ---------- end python_5 ----------
multiplication = Multiplication(A=number_slider_4, B=number_slider_3)
optimization = GhPythonScript(
    iterations=Slider(1000, range=10..1000),
    max_width=Slider(2000, range=0..10000),
    max_length=Slider(1818.8, range=0..10000),
    optimization=list_3)  # -> out, opt_dict; inputs iterations: Int32, optimization: Int32
# ---------- optimization: Python ----------
optimization_dict = {
    "iterations" : 100,
    "max_w" : 800.,
    "max_l" : 1800.,
}

optimization_dict["preference"] = ["width","length","area"][optimization]
opt_dict=[optimization_dict]
# ---------- end optimization ----------
optimization_2 = GhPythonScript(
    iterations=Slider(1000, range=10..1000),
    max_width=Slider(2000, range=0..10000),
    max_length=Slider(1818.8, range=0..10000),
    optimization=list_4)  # -> out, opt_dict; inputs iterations: Int32, optimization: Int32; same code as optimization
optimization_3 = GhPythonScript(
    iterations=Slider(1000, range=10..1000),
    max_width=Slider(2000, range=0..10000),
    max_length=Slider(1818.8, range=0..10000),
    optimization=list_5)  # -> out, opt_dict; inputs iterations: Int32, optimization: Int32; same code as optimization
string_reading_2 = GhPythonScript(input_string=panel_3)  # -> out, data_dict
# ---------- string_reading_2: Python ----------
import sys, os

path = ghenv.Component.OnPingDocument().FilePath
path = os.path.dirname(path)
sys.path.append(path)
path = os.path.dirname(path)
sys.path.append(path)

print("############## <sys.path> ###################################")
print('\n'.join(sys.path) )
print("################# </> #######################################")

import read_link as rl
reload(rl)
        
data_dict = [rl.string_reader(input_string)]
# ---------- end string_reading_2 ----------
list_6 = ValueList({"Straight": 0, "Clockwise": 1, "Counter-Clockwise": 2, "Alternating-A": 3, "Alternating-B": 4, "Flaps": 5}, selected="Clockwise")
python_6 = GhPythonScript(
    width=Slider(200, range=0..1000),
    length=Slider(1000, range=0..1000),
    h_0=Slider(100, range=0..100),
    h_1=Slider(34.6, range=0..100),
    h_2=Slider(35, range=0..100),
    tangent=Slider(0, range=0..4))  # -> out, boundary, folds
# ---------- python_6: Python ----------
import Rhino.Geometry as rg

delta=tangent*length

print(delta)

boundary=[
    rg.Point3d(0.0,0.0,h_0),
    rg.Point3d(width,0.0,h_1),
    rg.Point3d(width*.5+delta,length,h_2)
]

folds=False
# ---------- end python_6 ----------
list_7 = ValueList({"Straight": 0, "Clockwise": 1, "Counter-Clockwise": 2, "Alternating-A": 3, "Alternating-B": 4, "Flaps": 5}, selected="Straight")
list_8 = ValueList({"Straight": 0, "Clockwise": 1, "Counter-Clockwise": 2, "Alternating-A": 3, "Alternating-B": 4, "Flaps": 5}, selected="Flaps")
list_9 = ValueList({"Straight": 0, "Clockwise": 1, "Counter-Clockwise": 2, "Alternating-A": 3, "Alternating-B": 4, "Flaps": 5}, selected="Straight")
pt = ConstructPoint(XCoordinate=number_slider_4, YCoordinate=number_slider_3, ZCoordinate=Slider(0, range=0..10))
toggle = BooleanToggle(True)
pt_2 = ConstructPoint(XCoordinate=Slider(8, range=0..10), YCoordinate=Slider(6.6, range=0..10), ZCoordinate=Slider(4, range=0..10))
random = Random(Range=Domain(0, 1), Number=multiplication, Seed=2)
division = Division(A=1, B=multiplication)
number_slider_5 = Slider(2, range=1..10)
number_slider_6 = Slider(2, range=1..10)
python_7 = GhPythonScript(
    mns=pt,
    hor_rot=Slider(2, range=0..3),
    ver_rot=Slider(2, range=0..3),
    hor_flip=Toggle(True),
    ver_flip=Toggle(False),
    hor_inside=Toggle(False),
    ver_inside=Toggle(False))  # -> out, values; inputs mns: Point3d, hor_rot: Int32, ver_rot: Int32, hor_flip: Boolean, ver_flip: Boolean, hor_inside: Boolean, ver_inside: Boolean
# ---------- python_7: Python ----------
x,y = int(mns.X), int(mns.Y)

rot_x = 0
flip_x = 0
inside_x = 0

values = []

for i in range(x):
    rot_y = 0
    flip_y = 0
    inside_y = 0
    
    for j in range(y):
        
        values.append([
            (rot_x + rot_y) % 4,
            bool( (flip_y + flip_x) % 2),
            bool( (inside_y + inside_x) % 2)
        ])
        
        rot_y += ver_rot
        flip_y += ver_flip
        inside_y += ver_inside
        
    rot_x += hor_rot
    flip_x += hor_flip
    inside_x += hor_inside
# ---------- end python_7 ----------
series = Series(Start=0, Step=division, Count=multiplication)
sort = SortList(Keys=random)  # -> Keys, ValuesA
python_8 = GhPythonScript(xyz=pt_2, frac=Slider(0.998, range=0.2..5), z_count=Slider(7, range=0..10), mns=pt)  # -> out, back_box, graft(mesh_list), graft(idx_list); inputs xyz: Point3d, z_count: Int32, x_count: Int32, mns: Point3d
# ---------- python_8: Python ----------
import math
import Rhino.Geometry as rg

z_dim = xyz.Z / z_count
x_dim = z_dim * frac

if x_count is None:
    x_count = int(math.floor(xyz.X / x_dim) )

back_box = rg.Box(
    rg.Plane.WorldXY,
    rg.Interval(0, x_dim * x_count),
    rg.Interval(0, xyz.Y),
    rg.Interval(0, xyz.Z)
)

m,n,shift = int(mns.X), int(mns.Y), int(mns.Z)

def create_msn(m, n, shift):
    mns_obj = {'m': m,'n': n,'s': shift}
    for j in range(n):
        row = []
        for i in range(m):
            row.append(j * m + i)
        mns_obj[j] = row
        
    return mns_obj

def idx_function(i,j,mns):
    shift = j * mns['s']
    row = mns[j % mns['n'] ]
    return row[(i - shift) % m]

print(m, n, shift)

mns_obj = create_msn(m, n, shift)
mesh_list = []
idx_list = []

for i in range(x_count):
    for j in range(z_count):
        msh = rg.Mesh()
        pts = [
            rg.Point3d(i * x_dim, 0, j * z_dim),
            rg.Point3d( (i + 1) * x_dim, 0, j * z_dim),
            rg.Point3d( (i + 1) * x_dim, 0, (j + 1) * z_dim),
            rg.Point3d( i * x_dim, 0, (j + 1) * z_dim)
        ]
            
        [msh.Vertices.Add(pt) for pt in pts]
        msh.Faces.AddFace(0, 1, 2, 3)
        
        idx_list.append(idx_function(i, j, mns_obj) )
        mesh_list.append(msh)
# ---------- end python_8 ----------
pt_3 = Point(Point(972.3068, 58.77198605, 0))
string_reading_3 = GhPythonScript(data_dict=string_reading.data_dict)  # -> out, data_dict, objects
# ---------- string_reading_3: Python ----------
import sys, os

path = ghenv.Component.OnPingDocument().FilePath
path = os.path.dirname(os.path.dirname(path))
sys.path.append(path + "/link_reading")

print("############## <sys.path> ###################################")
print('\n'.join(sys.path) )
print("################# </> #######################################")

import gen_b_pts as bp
reload(bp)

data_dict = bp.initialize_points(data_dict)
objects = data_dict["object_set"]
# ---------- end string_reading_3 ----------
python_9 = GhPythonScript(data_dict=string_reading.data_dict)  # -> out, mirrh, mirrv, konh, konv, roth, rotv, ftypo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
# ---------- python_9: Python ----------
print(data_dict)

mirrh = data_dict["mirrh"]
mirrv = data_dict["mirrv"]
konh = data_dict["konh"]
konv = data_dict["konv"]
roth = data_dict["roth"]
rotv = data_dict["rotv"]
# ftypo = [int(c) for c in data_dict["ftypo"].split('b')[1] ]
fgh = data_dict["fgh"]
fgv = data_dict["fgv"]
frat = data_dict["frat"]
ft = data_dict["ft"]
mid = data_dict["mid"]
hs = data_dict["hs"]
# ---------- end python_9 ----------
gradient = Gradient(
    LowerLimit=0,
    UpperLimit=1,
    Parameter=series,
    stops=[0: RGB(243, 57, 0), 0.1: RGB(236, 27, 60), 0.2: RGB(210, 0, 118), 0.3: RGB(103, 0, 120), 0.4: RGB(39, 72, 161), 0.5: RGB(1, 192, 229), 0.6: RGB(18, 178, 90), 0.7: RGB(79, 186, 8), 0.8: RGB(220, 237, 32), 0.9: RGB(247, 159, 20), 1: RGB(243, 57, 0)])
hsv_colors = GhPythonScript(values=python_7.values)  # -> out, clrs; inputs values: list
# ---------- hsv_colors: Python ----------
import Rhino.Display as rd

clrs = [rd.ColorHSV(v[0] * .25, 1.0 - v[1] * .75, 1.0 - v[2] * .5).ToArgbColor() for v in values]
# ---------- end hsv_colors ----------
item_2 = ListItem(List=python_5.boundary, Index=Slider(6, range=0..10), Wrap=True)
multiplication_2 = Multiplication(A=number_slider_6, B=number_slider_5)
delta_4_2 = GhPythonScript(
    pts=python_3.boundary,
    folds=python_3.folds,
    split_idx=number_slider,
    h_max=Slider(36.1, range=0..100),
    correction_val=Slider(0.7, range=-10..10),
    mesh_cor_val=Toggle(False),
    show_with_cor_val=Toggle(False),
    side_interlock=list_9,
    import_parameters=optimization_3.opt_dict,
    b_pt=pt_3)  # -> out, vis_mesh, vis_2d, unfolded_dict; inputs pts: list of Point3d, split_idx: Int32, mesh_cor_val: Boolean, show_with_cor_val: Boolean, side_interlock: Int32, b_pt: Point3d
# ---------- delta_4_2: Python ----------
import sys

import os
import Grasshopper

path=os.path.dirname(Grasshopper.Instances.ActiveCanvas.Document.FilePath)

sys.path.append(path)

import square as sq
reload(sq)

sqr = sq.Square(pts, correction_val, side_interlock, split_idx, mesh_cor_val, folds)
x, y, z, u = sqr.unfolded()
vis_2d = [x] + y + z + u
vis_mesh = sqr.mesh(show_with_cor_val)
unfolded_dict = [sqr.bake()]
# ---------- end delta_4_2 ----------
medges = MeshEdges(Mesh=python_8.mesh_list)  # -> NakedEdges, InteriorEdges, NonManifoldEdges
pt_4 = ConstructPoint(XCoordinate=number_slider_6, YCoordinate=number_slider_5, ZCoordinate=Slider(0, range=0..10))
pyramids = GhPythonScript(
    pts=python_5.boundary,
    c_pt=python_5.c_pt,
    h_max=Slider(59.1, range=0..100),
    correction_val=Slider(1, range=-10..10),
    show_with_cor_val=Toggle(True),
    mesh_cor_val=Toggle(True),
    side_interlock=list_8)  # -> out, vis_mesh, vis_2d, unfolded_dict; inputs pts: list of Point3d, c_pt: Point3d, side_interlock: Int32
# ---------- pyramids: Python ----------
import sys

import os
import Grasshopper

path=os.path.dirname(Grasshopper.Instances.ActiveCanvas.Document.FilePath)

sys.path.append(path)

import pyramid as pr
reload(pr)

pyr = pr.Pyramid(pts, c_pt, correction_val, side_interlock, 0, mesh_cor_val)
x, y, z, u = pyr.unfolded()
vis_2d = x + y + z + u
vis_mesh = pyr.mesh(show_with_cor_val)
unfolded_dict = [pyr.bake()]
# ---------- end pyramids ----------
diamond = GhPythonScript(
    pts=python_4.boundary,
    folds=python_4.folds,
    split_idx=number_slider_2,
    h_max=Slider(36.1, range=0..100),
    correction_val=Slider(0.7, range=-10..10),
    mesh_cor_val=Toggle(False),
    show_with_cor_val=Toggle(False),
    side_interlock=list_6,
    import_parameters=optimization.opt_dict,
    b_pt=pt_3)  # -> out, vis_mesh, vis_2d, unfolded_dict; inputs pts: list of Point3d, split_idx: Int32, mesh_cor_val: Boolean, show_with_cor_val: Boolean, side_interlock: Int32, b_pt: Point3d; same code as delta_4_2
pt_5 = ConstructPoint(XCoordinate=Slider(8, range=0..10), YCoordinate=Slider(6.6, range=0..10), ZCoordinate=Slider(4, range=0..10))
triangle = GhPythonScript(
    pts=python_6.boundary,
    folds=python_6.folds,
    split_idx=0,
    h_max=Slider(36.1, range=0..100),
    correction_val=Slider(0.8, range=-10..10),
    mesh_cor_val=Toggle(False),
    show_with_cor_val=Toggle(False),
    side_interlock=list_7,
    import_parameters=optimization_2.opt_dict,
    b_pt=pt_3)  # -> out, vis_mesh, vis_2d, unfolded_dict; inputs pts: list of Point3d, split_idx: Int32, mesh_cor_val: Boolean, show_with_cor_val: Boolean, side_interlock: Int32, b_pt: Point3d
# ---------- triangle: Python ----------
import sys

import os
import Grasshopper

path=os.path.dirname(Grasshopper.Instances.ActiveCanvas.Document.FilePath)

sys.path.append(path)

import triangle as tr
reload(tr)

tri = tr.Triangle(pts, correction_val, side_interlock, mesh_cor_val)
x, y, z, u = tri.unfolded()
vis_2d = [x] + y + z + u
vis_mesh = tri.mesh(show_with_cor_val)
unfolded_dict = [tri.bake()]
# ---------- end triangle ----------
random_2 = Random(Range=Domain(0, 1), Number=multiplication_2, Seed=2)
division_2 = Division(A=1, B=multiplication_2)
deconstruct = GhPythonScript(objs=flatten(string_reading_3.objects))  # -> out, pt_sets; inputs objs: list
# ---------- deconstruct: Python ----------
import Rhino.Geometry as rg
pt_sets = []

for row in objs:
    row_set = []
    for obj in row:
        row_set.append([rg.Point3d(pt[0] * 1000., pt[1] * 1000., pt[2] * 1000.) for pt in obj.get_pts()])
    pt_sets.append(row_set)
# ---------- end deconstruct ----------
series_2 = Series(Start=0, Step=division_2, Count=multiplication_2)
sort_2 = SortList(Keys=random_2)  # -> Keys, ValuesA
python_10 = GhPythonScript(xyz=pt_5, frac=python_9.frat, z_count=python_9.fgv, x_count=python_9.fgh, mns=pt_4, h_para=Slider(0.1, range=0..0.1))  # -> out, back_box, graft(mesh_list), graft(idx_list), base_parameters; inputs xyz: Point3d, z_count: Int32, x_count: Int32, mns: Point3d
# ---------- python_10: Python ----------
import math
import Rhino.Geometry as rg

z_dim = xyz.Z / z_count
x_dim = z_dim * frac

if x_count is None:
    x_count = int(math.floor(xyz.X / x_dim) )

back_box = rg.Box(
    rg.Plane.WorldXY,
    rg.Interval(0, x_dim * x_count),
    rg.Interval(0, xyz.Y),
    rg.Interval(0, xyz.Z)
)

m,n,shift = int(mns.X), int(mns.Y), int(mns.Z)

def create_mns(m, n, shift):
    mns_obj = {'m': m,'n': n,'s': shift}
    for j in range(n):
        row = []
        for i in range(m):
            row.append(j * m + i)
        mns_obj[j] = row
        
    return mns_obj

def idx_function(i,j,mns):
    shift = j * mns['s']
    row = mns[j % mns['n'] ]
    return row[(i - shift) % mns['m'] ]

print(m, n, shift)

mns_obj = create_mns(m, n, shift)
mesh_list = []
idx_list = []

for i in range(x_count):
    for j in range(z_count):
        msh = rg.Mesh()
        pts = [
            rg.Point3d(i * x_dim, 0, j * z_dim),
            rg.Point3d( (i + 1) * x_dim, 0, j * z_dim),
            rg.Point3d( (i + 1) * x_dim, 0, (j + 1) * z_dim),
            rg.Point3d( i * x_dim, 0, (j + 1) * z_dim)
        ]
            
        [msh.Vertices.Add(pt) for pt in pts]
        msh.Faces.AddFace(0, 1, 2, 3)
        
        idx_list.append(idx_function(i, j, mns_obj) )
        mesh_list.append(msh)
        
base_parameters = {}
base_parameters["x_cnt"] = x_count
base_parameters["z_cnt"] = z_count
base_parameters["x_dim"] = x_dim
base_parameters["z_dim"] = z_dim
base_parameters['h']     = h_para
base_parameters = [base_parameters]
# ---------- end python_10 ----------
item_3 = ListItem(List=gradient, Index=python_8.idx_list, Wrap=True)
item_4 = ListItem(List=hsv_colors.clrs, Index=python_8.idx_list, Wrap=True)
panel_4 = Panel(hsv_colors.clrs)
mcol = MeshColours(Mesh=python_8.mesh_list, Colours=item_3)  # -> flatten(Mesh)
python_11 = GhPythonScript(
    mns=pt_4,
    hor_rot=python_9.roth,
    ver_rot=python_9.rotv,
    hor_flip=python_9.mirrh,
    ver_flip=python_9.mirrv,
    hor_inside=python_9.konh,
    ver_inside=python_9.konv)  # -> out, values; inputs mns: Point3d, hor_rot: Int32, ver_rot: Int32, hor_flip: Boolean, ver_flip: Boolean, hor_inside: Boolean, ver_inside: Boolean; same code as python_7
num_2 = Number(0)
python_12 = GhPythonScript(pts=deconstruct.pt_sets)  # -> out, a
# ---------- python_12: Python ----------
print(pts)
# ---------- end python_12 ----------
hsv = ColourHSV(Alpha=1, Hue=0, Saturation=1, Value=1)
panel_5 = Panel(pyramids.out)
mcol_2 = MeshColours(Mesh=python_8.mesh_list, Colours=item_4)
gradient_2 = Gradient(
    LowerLimit=0,
    UpperLimit=1,
    Parameter=series_2,
    stops=[0: RGB(243, 57, 0), 0.1: RGB(236, 27, 60), 0.2: RGB(210, 0, 118), 0.3: RGB(103, 0, 120), 0.4: RGB(39, 72, 161), 0.5: RGB(1, 192, 229), 0.6: RGB(18, 178, 90), 0.7: RGB(79, 186, 8), 0.8: RGB(220, 237, 32), 0.9: RGB(247, 159, 20), 1: RGB(243, 57, 0)])

# ---- group: Visualisation
merge = Merge(Data1=pyramids.vis_mesh, Data2=pyramids.vis_2d)  # -> flatten(Result)
gate = StreamGate(Stream=merge, Gate=Toggle(True))  # -> Target0, Target1
geo = Geometry(gate.Target1)

# ----
bake_unpacker = GhPythonScript(x=delta_4_2.unfolded_dict)  # -> out, outlines, main_folds, sec_folds, inner_folds
# ---------- bake_unpacker: Python ----------
outlines = x["outline"]
main_folds = x["main_folds"]
sec_folds = x["sec_folds"]
inner_folds = x["inner_folds"]
# ---------- end bake_unpacker ----------

# ---- group: Visualisation
merge_2 = Merge(Data1=delta_4_2.vis_mesh, Data2=delta_4_2.vis_2d)  # -> flatten(Result)
gate_2 = StreamGate(Stream=merge_2, Gate=Toggle(False))  # -> Target0, Target1
geo_2 = Geometry(gate_2.Target1)

# ----
panel_6 = Panel(delta_4_2.out)

# ---- group: Visualisation
merge_3 = Merge(Data1=diamond.vis_mesh, Data2=diamond.vis_2d)  # -> flatten(Result)
gate_3 = StreamGate(Stream=merge_3, Gate=Toggle(False))  # -> Target0, Target1
geo_3 = Geometry(gate_3.Target1)

# ----
lng = ListLength(List=flatten(mcol))
bake_unpacker_2 = GhPythonScript(x=pyramids.unfolded_dict)  # -> out, outlines, main_folds, sec_folds, inner_folds; same code as bake_unpacker
bake_unpacker_3 = GhPythonScript(x=diamond.unfolded_dict)  # -> out, outlines, main_folds, sec_folds, inner_folds; same code as bake_unpacker
medges_2 = MeshEdges(Mesh=python_10.mesh_list)  # -> NakedEdges, InteriorEdges, NonManifoldEdges

# ---- group: Visualisation
merge_4 = Merge(Data1=triangle.vis_mesh, Data2=triangle.vis_2d)  # -> flatten(Result)
gate_4 = StreamGate(Stream=merge_4, Gate=Toggle(False))  # -> Target0, Target1
geo_4 = Geometry(gate_4.Target1)

# ----
bake_unpacker_4 = GhPythonScript(x=triangle.unfolded_dict)  # -> out, outlines, main_folds, sec_folds, inner_folds; same code as bake_unpacker
panel_7 = Panel(python_12.out)
path_mapper = PathMapper(deconstruct.pt_sets, source="{A;B;C}", target="{B;C}")
series_3 = Series(Start=0, Step=0, Count=lng)  # -> flatten(Series)
baking = GhPythonScript(
    bake_me=Button(),
    outlines=bake_unpacker.outlines,
    main_folds=bake_unpacker.main_folds,
    sec_folds=bake_unpacker.sec_folds,
    inner_folds=bake_unpacker.inner_folds)  # -> out, a; inputs bake_me: Boolean, outlines: list, main_folds: list, sec_folds: list, inner_folds: list
# ---------- baking: Python ----------
import sys
import os
import Grasshopper

path=os.path.dirname(Grasshopper.Instances.ActiveCanvas.Document.FilePath)

sys.path.append(path)

import baking as bk
reload(bk)
if bake_me:
    bk.bake(outlines, main_folds, sec_folds, inner_folds, ghdoc)
# ---------- end baking ----------
baking_2 = GhPythonScript(
    bake_me=Button(),
    outlines=bake_unpacker_3.outlines,
    main_folds=bake_unpacker_3.main_folds,
    sec_folds=bake_unpacker_3.sec_folds,
    inner_folds=bake_unpacker_3.inner_folds)  # -> out, a; inputs bake_me: Boolean, outlines: list, main_folds: list, sec_folds: list, inner_folds: list; same code as baking
baking_3 = GhPythonScript(
    bake_me=Button(),
    outlines=bake_unpacker_2.outlines,
    main_folds=bake_unpacker_2.main_folds,
    sec_folds=bake_unpacker_2.sec_folds,
    inner_folds=bake_unpacker_2.inner_folds)  # -> out, a; inputs bake_me: Boolean, outlines: list, main_folds: list, sec_folds: list, inner_folds: list; same code as baking
hsv_colors_2 = GhPythonScript(values=python_11.values)  # -> out, clrs; inputs values: list; same code as hsv_colors
baking_4 = GhPythonScript(
    bake_me=Button(),
    outlines=bake_unpacker_4.outlines,
    main_folds=bake_unpacker_4.main_folds,
    sec_folds=bake_unpacker_4.sec_folds,
    inner_folds=bake_unpacker_4.inner_folds)  # -> out, a; inputs bake_me: Boolean, outlines: list, main_folds: list, sec_folds: list, inner_folds: list; same code as baking
item_5 = ListItem(List=hsv_colors_2.clrs, Index=python_10.idx_list, Wrap=True)
num_3 = Number(0)
hsv_2 = ColourHSV(Alpha=1, Hue=0, Saturation=1, Value=1)
merge_5 = Merge(Data1=graft(series_3), Data2=graft(mcol))
mcol_3 = MeshColours(Mesh=python_10.mesh_list, Colours=item_5)  # -> flatten(Mesh)
lng_2 = ListLength(List=flatten(mcol_3))
series_4 = Series(Start=0, Step=0, Count=lng_2)  # -> flatten(Series)
item_6 = ListItem(List=merge_5, Index=graft(0), Wrap=True)
panel_8 = Panel(python_9.out)
panel_9 = Panel(python_10.idx_list)
merge_6 = Merge(Data1=graft(series_4), Data2=graft(mcol_3))
panel_10 = Panel(baking_4.out)
panel_11 = Panel(merge)
item_7 = ListItem(List=merge_6, Index=graft(python_9.ftypo), Wrap=True)
panel_12 = Panel(item_6)
panel_13 = Panel(hsv_colors_2.clrs)
item_8 = ListItem(List=path_mapper, Index=0, Wrap=True)
number_slider_7 = Slider(1, range=0..3)
list_10 = ValueList({"x constrained": 0, "y constrained": 1, "xy constrained": 2, "free": 3}, selected="free")
python_13 = GhPythonScript(x=item_8)  # -> out, a
# ---------- python_13: Python ----------
print(x)
# ---------- end python_13 ----------
panel_14 = Panel(item_7)
panel_15 = Panel(triangle.out)
list_11 = ValueList({"Optimal Width": 0, "Optimal Length": 1, "Optimal Area": 2}, selected="Optimal Length")
list_12 = ValueList({"Straight": "flat", "Clockwise": "clockwise", "Counter-Clockwise": "counter_clockwise", "Alternating-A": "alternating_A", "Alternating-B": "alternating_B", "Flaps": "negative"}, selected="Alternating-A")
python_14 = GhPythonScript(
    width=Slider(200, range=0..1000),
    length=Slider(1000, range=0..1000),
    constraint_idx=list_10,
    bottom_0=Slider(47.7, range=0..100),
    bottom_1=Slider(97.1, range=0..100),
    top_0=Slider(100, range=0..100),
    top_1=Slider(43.7, range=0..250),
    xy_constraint_idx=number_slider_7,
    tangent_shift=Slider(0.7, range=0..4))  # -> out, boundary, folds; inputs xy_constraint_idx: Int32; same code as python_4
panel_16 = Panel(python_13.out)
panel_17 = Panel(deconstruct.pt_sets)
optimization_4 = GhPythonScript(
    iterations=Slider(50, range=10..1000),
    max_width=Slider(3656.2, range=0..10000),
    max_length=Slider(4116.5, range=0..10000),
    optimization=list_11)  # -> out, opt_dict; inputs iterations: Int32, optimization: Int32
# ---------- optimization_4: Python ----------
optimization_dict = {
    "iterations" : iterations,
    "max_w" : max_width,
    "max_l" : max_length,
}

optimization_dict["preference"] = ["width","length","area"][optimization]
opt_dict=[optimization_dict]
# ---------- end optimization_4 ----------
list_13 = ValueList({"Straight": 0, "Clockwise": 1, "Counter-Clockwise": 2, "Alternating-A": 3, "Alternating-B": 4, "Flaps": 5}, selected="Clockwise")
parameter_assignment = GhPythonScript(
    flap_h_max=Slider(8.878, range=0..10),
    mesh_correction_val=Toggle(False),
    show_correction_val=Toggle(True),
    fold_idx=Slider(0, range=0..1),
    pattern=list_12)  # -> out, construction_parameters; inputs mesh_correction_val: Boolean, show_correction_val: Boolean, fold_idx: Int32, orient: Boolean
# ---------- parameter_assignment: Python ----------
construction_parameters = {
    "flap_h_max" : 30.,
    "correction_val" : .7,
    "flap_h" : 20.0,
    "flap_w" : 40.0,
    "mesh_correction_val" : False,
    "show_correction_val" : True,
    "fold_idx" : 0,
    "min_pt_height" : 50.,
    "orient" : True,
    "pattern" : "flat"
}

input_parameters = {
    "flap_h_max" : flap_h_max,
    "correction_val" : correction_val,
    "flap_h" : flap_h,
    "flap_w" : flap_w,
    "mesh_correction_val" : mesh_correction_val,
    "show_correction_val" : show_correction_val,
    "fold_idx" : fold_idx,
    "min_pt_height" : min_pt_height,
    "orient" : orient,
    "pattern" : pattern
}

for key, value in input_parameters.items():
    if not(value is None):
        construction_parameters[key]=value
        
construction_parameters=[construction_parameters]
# ---------- end parameter_assignment ----------
python_15 = GhPythonScript()  # -> out, a
# ---------- python_15: Python ----------
lst=[[i for i in range(6)], [i for i in range(3, 9, 1)]]
print(lst)
print(list(zip(*lst)))
# ---------- end python_15 ----------
python_16 = GhPythonScript(x=deconstruct.pt_sets)  # -> out, a; inputs x: list
# ---------- python_16: Python ----------
import Rhino.Geometry.Point3d as Pt3d
b_pt = Pt3d(0,0,100)

a=[[[p+b_pt for p in pt] for pt in pts] for pts in x]
print(a)
# ---------- end python_16 ----------
diamond_2 = GhPythonScript(
    input_lists=python_16.a,
    folds=python_14.folds,
    split_idx=number_slider_7,
    h_max=Slider(100, range=0..100),
    correction_val=Slider(1.1, range=-10..10),
    mesh_cor_val=Toggle(False),
    show_with_cor_val=Toggle(False),
    side_interlock=list_13,
    production_parameter=optimization_4.opt_dict,
    b_pt=pt_3)  # -> out, vis_mesh, vis_2d, unfolded_dict; inputs input_lists: list, split_idx: Int32, mesh_cor_val: Boolean, show_with_cor_val: Boolean, side_interlock: Int32, b_pt: Point3d
# ---------- diamond_2: Python ----------
import sys
import Rhino.Geometry as rg

import os
import Grasshopper

path=os.path.dirname(Grasshopper.Instances.ActiveCanvas.Document.FilePath)

sys.path.append(path)

import square as sq
reload(sq)

vis_mesh = []
vis_2d = []

for i, row in enumerate(input_lists):
    for j, pts in enumerate(row):
        t_matrix = rg.Transform.Translation(rg.Vector3d(production_parameter["max_w"] * i, production_parameter["max_l"] * j, 0.0) )
        sqr = sq.Square(pts, correction_val, side_interlock, split_idx, mesh_cor_val, folds)
        x, y, z, u = sqr.unfolded(h_max = h_max, position_optimization = production_parameter)
        vis_2d_local = [x] + y + z + u
        [object2d.Transform(t_matrix) for object2d in vis_2d_local]
        vis_2d.extend(vis_2d_local)
        vis_mesh.append(sqr.mesh(show_with_cor_val) )
        unfolded_dict = [sqr.bake()]
# ---------- end diamond_2 ----------
panel_18 = Panel(python_15.out)
print_dict = GhPythonScript(x=parameter_assignment.construction_parameters)  # -> out
# ---------- print_dict: Python ----------
string=''
for key, item in x.items():
    string+="{} : {}\n".format(key, item)
    
print(string)
# ---------- end print_dict ----------
objectsgeneration = GhPythonScript(
    input_lists=deconstruct.pt_sets,
    construction_parameters=parameter_assignment.construction_parameters,
    optimization_parameters=optimization_4.opt_dict,
    b_pt=pt_3)  # -> out, vis_mesh, b_pts, d2s; inputs input_lists: list, b_pt: Point3d
# ---------- objectsgeneration: Python ----------
import sys
import Rhino.Geometry as rg

import os
import Grasshopper

path=os.path.dirname(Grasshopper.Instances.ActiveCanvas.Document.FilePath)
path=os.path.dirname(path)
path+="/src"
sys.path.append(path)

import base_object as bo
reload(bo)

a_b_o=bo.BaseObject.simple_square(input_lists[0][0],other_parameters=construction_parameters)
print(a_b_o)
print(a_b_o.objs)
d2s=a_b_o.get_2d(optimization_parameters=optimization_parameters)
b_pts=d2s[0].b_pts
d2s=[d2s[0].bake_dict()]
# ---------- end objectsgeneration ----------
path_mapper_2 = PathMapper(diamond_2.vis_2d, source="{A;B;C}", target="{A;B}")
panel_19 = Panel(print_dict)
panel_20 = Panel(diamond_2.out)

# ---- group: Visualisation
merge_7 = Merge(Data1=diamond_2.vis_mesh, Data2=path_mapper_2)  # -> flatten(Result)
gate_5 = StreamGate(Stream=merge_7, Gate=Toggle(True))  # -> Target0, Target1
geo_5 = Geometry(gate_5.Target1)

# ----
panel_21 = Panel(python_16.out)
bake_unpacker_5 = GhPythonScript(x=objectsgeneration.d2s)  # -> out, outlines, main_folds, sec_folds, inner_folds
# ---------- bake_unpacker_5: Python ----------
outlines = x["outline_crv"]
main_folds = x["body_flap_folds"]
sec_folds = x["intra_flap_folds"]
inner_folds = x["top_face_folds"]
# ---------- end bake_unpacker_5 ----------
pt_6 = Point(objectsgeneration.b_pts)
item_9 = ListItem(List=pt_6, Index=0, Wrap=True)
crv = Curve(bake_unpacker_5.outlines)
baking_5 = GhPythonScript(
    bake_me=Button(),
    outlines=bake_unpacker_5.outlines,
    main_folds=bake_unpacker_5.main_folds,
    sec_folds=bake_unpacker_5.sec_folds,
    inner_folds=bake_unpacker_5.inner_folds)  # -> out, a; inputs bake_me: Boolean, outlines: list, main_folds: list, sec_folds: list, inner_folds: list; same code as baking
panel_22 = Panel(objectsgeneration.out)
