# Grasshopper definition link_reading.gh (Grasshopper 1.0.7)
# plug-ins: Weaverbird

panel = Panel("http://localhost/facade-maker/?ft=q1&fp=0&fgv=5&fgh=8&frat=1.244176287983739&ftypo=llllllll&mirrh=1&mirrv=1&roth=0&rotv=0&konh=1&konv=1&mat=")
panel_2 = Panel("http://jonass-imac.local/facade-maker/index.php?ft=d4&fp=0&fgv=5&fgh=5&frat=1.942&ftypo=ttvvv&mirrh=1&mirrv=0&roth=2&rotv=1&konh=1&konv=1&mat=&mid=0.3263597856369532%2C0.3488372093023256%2C0.5")
number_slider = Slider(0, range=0..3)
number_slider_2 = Slider(1, range=0..3)
panel_3 = Panel("""http://jonass-imac.local/facade-maker/index.php?ft=d2&fp=0&fgv=5&fgh=7&frat=1.3953488372093024&ftypo=vvvvvvv&mirrh=0&mirrv=0&roth=0&rotv=0&konh=0&konv=0&mat=&c00=0&c01=0&c10=0&c11=0.7
http://jonass-imac.local/facade-maker/index.php?ft=d2&fp=0&fgv=5&fgh=7&frat=1.3953488372093024&ftypo=vvvvvvv&mirrh=0&mirrv=0&roth=0&rotv=0&konh=0&konv=0&mat=&c00=0&c01=0&c10=0&c11=0.7
http://localhost/facade-maker/?ft=q1lift&fp=0&fgv=5&fgh=7&frat=1.3953488372093024&ftypo=vvvvvvv&mirrh=0&mirrv=0&roth=0&rotv=0&konh=0&konv=0&mat=&c00=0&c01=0.5&c10=0&c11=0.5
http://localhost/facade-maker/?ft=d2&fp=0&fgv=5&fgh=7&frat=1.3953488372093024&ftypo=vvvvvvv&mirrh=0&mirrv=0&roth=0&rotv=0&konh=0&konv=0&mat=&c00=0&c01=0&c10=0&c11=0.7
http://localhost/facade-maker/?ft=d2&fp=0&fgv=5&fgh=7&frat=1.3953488372093024&ftypo=vvvvvvv&mirrh=0&mirrv=0&roth=0&rotv=0&konh=0&konv=0&mat=&c00=0&c01=0&c10=0&c11=0.7
http://localhost/facade-maker/?ft=d2&fp=0&fgv=5&fgh=7&frat=1.3953488372093024&ftypo=vvvvvvv&mirrh=0&mirrv=0&roth=0&rotv=0&konh=0&konv=0&mat=&c00=0&c01=0&c10=0&c11=0.7
http://jonass-imac.local/facade-maker/index.php?ft=d2&fp=0&fgv=5&fgh=5&frat=1.942&ftypo=ttvvv&mirrh=0&mirrv=0&roth=0&rotv=0&konh=0&konv=0&mat=&c00=0&c01=0&c10=0&c11=0.7
http://jonass-imac.local/facade-maker/index.php?ft=q1lift&fp=0&fgv=5&fgh=5&frat=1.942&ftypo=ttvvv&mirrh=0&mirrv=0&roth=0&rotv=0&konh=0&konv=0&mat=&c00=0&c01=0.5&c10=0&c11=0.5
http://jonass-imac.local/facade-maker/index.php?ft=q1lift&fp=0&fgv=5&fgh=5&frat=1.942&ftypo=ttvvv&mirrh=0&mirrv=0&roth=1&rotv=1&konh=1&konv=1&mat=&c00=0&c01=0.5&c10=0&c11=0.5
http://jonass-imac.local/facade-maker/index.php?ft=q1lift&fp=0&fgv=5&fgh=5&frat=1.942&ftypo=ttvvv&mirrh=1&mirrv=0&roth=2&rotv=1&konh=1&konv=1&mat=&c00=0&c01=0.5&c10=0&c11=0.5
http://jonass-imac.local/facade-maker/index.php?ft=q1lift&fp=0&fgv=5&fgh=5&frat=1.942&ftypo=ttvvv&mirrh=1&mirrv=0&roth=2&rotv=1&konh=1&konv=1&mat=&c00=1&c01=1&c10=0&c11=0
http://jonass-imac.local/facade-maker/index.php?ft=q1lift&fp=0&fgv=5&fgh=5&frat=1.942&ftypo=ttvvv&mirrh=1&mirrv=0&roth=2&rotv=1&konh=1&konv=1&mat=&c00=1&c01=1&c10=0&c11=0
http://jonass-imac.local/facade-maker/index.php?ft=q1lift&fp=0&fgv=5&fgh=5&frat=1.942&ftypo=ttvvv&mirrh=1&mirrv=0&roth=2&rotv=1&konh=1&konv=1&mat=&c00=1&c01=1&c10=0&c11=0
http://jonass-imac.local/facade-maker/index.php?ft=d4&fp=0&fgv=5&fgh=5&frat=1.942&ftypo=ttvvv&mirrh=1&mirrv=0&roth=2&rotv=1&konh=1&konv=1&mat=&mid=0.3263597856369532%2C0.3488372093023256%2C0.5
http://jonass-imac.local/facade-maker/index.php?ft=d4&fp=0&fgv=5&fgh=5&frat=1.942&ftypo=ttvvv&mirrh=1&mirrv=0&roth=2&rotv=1&konh=1&konv=1&mat=&mid=0.3263597856369532%2C0.3488372093023256%2C0.5
http://jonass-imac.local/facade-maker/index.php?ft=q4&fp=0&fgv=5&fgh=8&frat=1.3373488492743915&ftypo=vvttvvvv&mirrh=1&mirrv=0&roth=1&rotv=3&konh=1&konv=0&mat=&c00=0&c01=0.2&c10=0.8&c11=1&mid=0.4217472966403055%2C0.3488372093023256%2C
http://jonass-imac.local/facade-maker/index.php?ft=q4&fp=0&fgv=5&fgh=8&frat=1.3373488492743915&ftypo=1111vvvv&mirrh=0&mirrv=0&roth=3&rotv=1&konh=0&konv=0&mat=&c00=0&c01=0.2&c10=0.8&c11=1&mid=0.4217472966403055%2C0.3488372093023256%2C
http://localhost/facade-maker/?ft=q1&fp=0&fgv=5&fgh=8&frat=1.244176287983739&ftypo=llllllll&mirrh=1&mirrv=1&roth=0&rotv=0&konh=1&konv=1&mat=
http://localhost/facade-maker/?ft=d4&fp=0&fgv=5&fgh=7&frat=1.3953488372093024&ftypo=vvvvvvv&mirrh=0&mirrv=0&roth=0&rotv=0&konh=0&konv=0&mat=&mid=0.5%2C0.5%2C1
http://localhost/facade-maker/?ft=d4&fp=0&fgv=5&fgh=7&frat=1.3953488372093024&ftypo=vvvvvvv&mirrh=0&mirrv=0&roth=0&rotv=0&konh=0&konv=0&mat=&mid=0.5%2C0.5%2C-1
http://localhost/facade-maker/?ft=d4&fp=0&fgv=5&fgh=7&frat=1.3953488372093024&ftypo=vvvvvvv&mirrh=0&mirrv=0&roth=0&rotv=0&konh=1&konv=1&mat=&mid=0.5%2C0.5%2C-1""")
list = ValueList({"x constrained": 0, "y constrained": 1, "xy constrained": 2, "free": 3}, selected="x constrained")
number_slider_3 = Slider(2, range=1..10)
number_slider_4 = Slider(2, range=1..10)
list_2 = ValueList({"x constrained": 0, "y constrained": 1, "xy constrained": 2, "free": 3}, selected="free")
panel_4 = Panel("http://localhost/facade-maker/?ft=q1&fp=0&fgv=5&fgh=8&frat=1.244176287983739&ftypo=llllllll&mirrh=1&mirrv=1&roth=0&rotv=0&konh=1&konv=1&mat=")
num = Number()
python = GhPythonScript(
    width=Slider(200, range=0..1000),
    length=Slider(440, range=0..1000),
    side_heigth=Slider(46.2, range=0..100),
    c_pt_x_percent=Slider(28, range=0..100),
    c_pt_y_percent=Slider(52.4, range=0..100),
    c_pt_heigth=Slider(100, range=0..250))  # -> out, boundary, c_pt
# ---------- python: Python ----------
import Rhino.Geometry as rg

boundary=[
    rg.Point3d(0.0,length,side_heigth),
    rg.Point3d(0.0,0.0,side_heigth),
    rg.Point3d(width,0.0,side_heigth),
    rg.Point3d(width,length,side_heigth)
]

c_pt=rg.Point3d(
    width*c_pt_x_percent*.01,
    length*c_pt_y_percent*.01,
    c_pt_heigth
)
# ---------- end python ----------
python_2 = GhPythonScript(
    width=Slider(200, range=0..1000),
    length=Slider(1000, range=0..1000),
    h_0=Slider(100, range=0..100),
    h_1=Slider(34.6, range=0..100),
    h_2=Slider(35, range=0..100),
    tangent=Slider(0, range=0..4))  # -> out, boundary, folds
# ---------- python_2: Python ----------
import Rhino.Geometry as rg

delta=tangent*length

print(delta)

boundary=[
    rg.Point3d(0.0,0.0,h_0),
    rg.Point3d(width,0.0,h_1),
    rg.Point3d(width*.5+delta,length,h_2)
]

folds=False
# ---------- end python_2 ----------
python_3 = GhPythonScript(
    width=Slider(200, range=0..1000),
    length=Slider(1000, range=0..1000),
    constraint_idx=list,
    bottom_0=Slider(100, range=0..100),
    bottom_1=Slider(34.6, range=0..100),
    top_0=Slider(35, range=0..100),
    top_1=Slider(149.7, range=0..250),
    xy_constraint_idx=number_slider)  # -> out, boundary, folds; inputs xy_constraint_idx: Int32
# ---------- python_3: Python ----------
import Rhino.Geometry as rg

def pt_on_plane(pln, pt):
    n=pln.Normal
    p0=pln.Origin
    l0=pt
    l=rg.Vector3d(0,0,1)
    
    t=(p0-l0)*n / (l*n)
    
    return rg.Point3d(l0 + l*t)

boundary=[
    rg.Point3d(0.0,length,0.0),
    rg.Point3d(0.0,0.0,0.0),
    rg.Point3d(width,0.0,0.0),
    rg.Point3d(width,length,0.0)
]

if constraint_idx == 0:
    main_heigth_bottom=bottom_0 if bottom_0>0.1 else bottom_1
    main_heigth_top=top_0 if top_0>0.1 else top_1
    h_0=main_heigth_bottom
    h_1=main_heigth_bottom
    h_2=main_heigth_top
    h_3=main_heigth_top
    
    h_list=[h_2, h_0, h_1, h_3]
    
    folds=False
    
elif constraint_idx == 1:
    main_heigth_left=bottom_0 if bottom_0>0.1 else top_0
    main_heigth_right=bottom_1 if bottom_1>0.1 else top_1
    h_0=main_heigth_left
    h_1=main_heigth_right
    h_2=main_heigth_left
    h_3=main_heigth_right
    
    h_list=[h_2, h_0, h_1, h_3]
    
    folds=False
    
elif constraint_idx == 2:
    h_0=bottom_0
    h_1=bottom_1
    h_2=top_0
    h_3=top_1
    
    h_list=[h_2, h_0, h_1, h_3]
    for i,val in enumerate(h_list):
        boundary[i].Z=val
        
    pt=boundary.pop(xy_constraint_idx)
    pln=rg.Plane(boundary[0], boundary[1], boundary[2])
    
    new_height=pt_on_plane(pln, pt).Z
    if new_height > 0.1:
        h_list[xy_constraint_idx]=new_height
    else:
        difference=.01 - new_height
        h_list=[val+difference for val in h_list]
        h_list[xy_constraint_idx]=.01
        
    folds=False
    
elif constraint_idx == 3:
    h_0=bottom_0
    h_1=bottom_1
    h_2=top_0
    h_3=top_1
    
    h_list=[h_2, h_0, h_1, h_3]
    
    folds=True

boundary=[
    rg.Point3d(0.0,length,0.0),
    rg.Point3d(0.0,0.0,0.0),
    rg.Point3d(width,0.0,0.0),
    rg.Point3d(width,length,0.0)
]

for i,val in enumerate(h_list):
    boundary[i].Z=val
# ---------- end python_3 ----------
python_4 = GhPythonScript()  # -> Out, A
python_5 = GhPythonScript(
    width=Slider(200, range=0..1000),
    length=Slider(1000, range=0..1000),
    constraint_idx=list_2,
    bottom_0=Slider(47.7, range=0..100),
    bottom_1=Slider(97.1, range=0..100),
    top_0=Slider(100, range=0..100),
    top_1=Slider(43.7, range=0..250),
    xy_constraint_idx=number_slider_2,
    tangent_shift=Slider(0.7, range=0..4))  # -> out, boundary, folds; inputs xy_constraint_idx: Int32
# ---------- python_5: Python ----------
import Rhino.Geometry as rg

def pt_on_plane(pln, pt):
    n=pln.Normal
    p0=pln.Origin
    l0=pt
    l=rg.Vector3d(0,0,1)
    
    t=(p0-l0)*n / (l*n)
    
    return rg.Point3d(l0 + l*t)

delta=tangent_shift*length

boundary=[
    rg.Point3d(delta,length,0.0),
    rg.Point3d(0.0,0.0,0.0),
    rg.Point3d(width,0.0,0.0),
    rg.Point3d(width+delta,length,0.0)
]

if constraint_idx == 0:
    main_heigth_bottom=bottom_0 if bottom_0>0.1 else bottom_1
    main_heigth_top=top_0 if top_0>0.1 else top_1
    h_0=main_heigth_bottom
    h_1=main_heigth_bottom
    h_2=main_heigth_top
    h_3=main_heigth_top
    
    h_list=[h_2, h_0, h_1, h_3]
    
    folds=False
    
elif constraint_idx == 1:
    main_heigth_left=bottom_0 if bottom_0>0.1 else top_0
    main_heigth_right=bottom_1 if bottom_1>0.1 else top_1
    h_0=main_heigth_left
    h_1=main_heigth_right
    h_2=main_heigth_left
    h_3=main_heigth_right
    
    h_list=[h_2, h_0, h_1, h_3]
    
    folds=False
    
elif constraint_idx == 2:
    h_0=bottom_0
    h_1=bottom_1
    h_2=top_0
    h_3=top_1
    
    h_list=[h_2, h_0, h_1, h_3]
    for i,val in enumerate(h_list):
        boundary[i].Z=val
        
    pt=boundary.pop(xy_constraint_idx)
    pln=rg.Plane(boundary[0], boundary[1], boundary[2])
    
    new_height=pt_on_plane(pln, pt).Z
    if new_height > 0.1:
        h_list[xy_constraint_idx]=new_height
    else:
        difference=.01 - new_height
        h_list=[val+difference for val in h_list]
        h_list[xy_constraint_idx]=.01
        
    folds=False
    
elif constraint_idx == 3:
    h_0=bottom_0
    h_1=bottom_1
    h_2=top_0
    h_3=top_1
    
    h_list=[h_2, h_0, h_1, h_3]
    
    folds=True

boundary=[
    rg.Point3d(delta,length,0.0),
    rg.Point3d(0.0,0.0,0.0),
    rg.Point3d(width,0.0,0.0),
    rg.Point3d(width+delta,length,0.0)
]

for i,val in enumerate(h_list):
    boundary[i].Z=val
# ---------- end python_5 ----------
string_reading = GhPythonScript(input_string=panel_2)  # -> out, data_dict
# ---------- string_reading: Python ----------
import sys, os

path = ghenv.Component.OnPingDocument().FilePath
path = os.path.dirname(path)
sys.path.append(path)
path = os.path.dirname(path)
sys.path.append(path)

print("############## <sys.path> ###################################")
print('\n'.join(sys.path) )
print("################# </> #######################################")

import read_link as rl
reload(rl)
        
data_dict = [rl.string_reader(input_string)]
# ---------- end string_reading ----------
list_3 = ValueList({"Straight": 0, "Clockwise": 1, "Counter-Clockwise": 2, "Alternating-A": 3, "Alternating-B": 4, "Flaps": 5}, selected="Alternating-B")
num_2 = Number()
multiplication = Multiplication(A=number_slider_4, B=number_slider_3)
list_4 = ValueList({"Straight": 0, "Clockwise": 1, "Counter-Clockwise": 2, "Alternating-A": 3, "Alternating-B": 4, "Flaps": 5}, selected="Straight")
list_5 = ValueList({"Straight": 0, "Clockwise": 1, "Counter-Clockwise": 2, "Alternating-A": 3, "Alternating-B": 4, "Flaps": 5}, selected="Alternating-B")
pt = ConstructPoint(XCoordinate=number_slider_4, YCoordinate=number_slider_3, ZCoordinate=Slider(0, range=0..10))
list_6 = ValueList({"Straight": 0, "Clockwise": 1, "Counter-Clockwise": 2, "Alternating-A": 3, "Alternating-B": 4, "Flaps": 5}, selected="Straight")
pt_2 = ConstructPoint(XCoordinate=Slider(8, range=0..10), YCoordinate=Slider(6.6, range=0..10), ZCoordinate=Slider(4, range=0..10))
random = Random(Range=Domain(0, 1), Number=multiplication, Seed=2)
division = Division(A=1, B=multiplication)
string_reading_2 = GhPythonScript(input_string=panel_4)  # -> out, data_dict; same code as string_reading
string_reading_3 = GhPythonScript(input_string=panel_3)  # -> out, data_dict
# ---------- string_reading_3: Python ----------
import sys, os

path = ghenv.Component.OnPingDocument().FilePath
path = os.path.dirname(path)
sys.path.append(path)
path = os.path.dirname(path)
sys.path.append(path)

print("############## <sys.path> ###################################")
print('\n'.join(sys.path) )
print("################# </> #######################################")

import read_link as rl
reload(rl)

sub_strings = input_string.split('\n')
data_dict = [rl.string_reader(sub_str) for sub_str in sub_strings]
# ---------- end string_reading_3 ----------
number_slider_5 = Slider(2, range=1..10)
number_slider_6 = Slider(2, range=1..10)
number_slider_7 = Slider(0.2, range=0..1)
python_6 = GhPythonScript(
    mns=pt,
    hor_rot=Slider(2, range=0..3),
    ver_rot=Slider(2, range=0..3),
    hor_flip=Toggle(True),
    ver_flip=Toggle(False),
    hor_inside=Toggle(False),
    ver_inside=Toggle(False))  # -> out, values; inputs mns: Point3d, hor_rot: Int32, ver_rot: Int32, hor_flip: Boolean, ver_flip: Boolean, hor_inside: Boolean, ver_inside: Boolean
# ---------- python_6: Python ----------
x,y = int(mns.X), int(mns.Y)

rot_x = 0
flip_x = 0
inside_x = 0

values = []

for i in range(x):
    rot_y = 0
    flip_y = 0
    inside_y = 0
    
    for j in range(y):
        
        values.append([
            (rot_x + rot_y) % 4,
            bool( (flip_y + flip_x) % 2),
            bool( (inside_y + inside_x) % 2)
        ])
        
        rot_y += ver_rot
        flip_y += ver_flip
        inside_y += ver_inside
        
    rot_x += hor_rot
    flip_x += hor_flip
    inside_x += hor_inside
# ---------- end python_6 ----------
series = Series(Start=0, Step=division, Count=multiplication)
sort = SortList(Keys=random)  # -> Keys, ValuesA
python_7 = GhPythonScript(xyz=pt_2, frac=Slider(0.871, range=0.2..5), z_count=Slider(7, range=0..10), mns=pt)  # -> out, back_box, graft(mesh_list), graft(idx_list); inputs xyz: Point3d, z_count: Int32, x_count: Int32, mns: Point3d
# ---------- python_7: Python ----------
import math
import Rhino.Geometry as rg

z_dim = xyz.Z / z_count
x_dim = z_dim * frac

if x_count is None:
    x_count = int(math.floor(xyz.X / x_dim) )

back_box = rg.Box(
    rg.Plane.WorldXY,
    rg.Interval(0, x_dim * x_count),
    rg.Interval(0, xyz.Y),
    rg.Interval(0, xyz.Z)
)

m,n,shift = int(mns.X), int(mns.Y), int(mns.Z)

def create_msn(m, n, shift):
    mns_obj = {'m': m,'n': n,'s': shift}
    for j in range(n):
        row = []
        for i in range(m):
            row.append(j * m + i)
        mns_obj[j] = row
        
    return mns_obj

def idx_function(i,j,mns):
    shift = j * mns['s']
    row = mns[j % mns['n'] ]
    return row[(i - shift) % m]

print(m, n, shift)

mns_obj = create_msn(m, n, shift)
mesh_list = []
idx_list = []

for i in range(x_count):
    for j in range(z_count):
        msh = rg.Mesh()
        pts = [
            rg.Point3d(i * x_dim, 0, j * z_dim),
            rg.Point3d( (i + 1) * x_dim, 0, j * z_dim),
            rg.Point3d( (i + 1) * x_dim, 0, (j + 1) * z_dim),
            rg.Point3d( i * x_dim, 0, (j + 1) * z_dim)
        ]
            
        [msh.Vertices.Add(pt) for pt in pts]
        msh.Faces.AddFace(0, 1, 2, 3)
        
        idx_list.append(idx_function(i, j, mns_obj) )
        mesh_list.append(msh)
# ---------- end python_7 ----------
pyramids = GhPythonScript(
    pts=python.boundary,
    c_pt=python.c_pt,
    h_max=Slider(47, range=0..100),
    correction_val=Slider(-1, range=-10..10),
    apply_mesh_cor_val=Toggle(False),
    apply_polyline_cor_val=Toggle(True),
    show_mesh_cor_val=Toggle(True),
    side_interlock=list_3)  # -> out, rhino_mesh, b, outline_a, outline_b, folds_a_a, folds_a_b, folds_b_a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; inputs pts: list of Point3d, c_pt: Point3d, apply_polyline_cor_val: Boolean, side_interlock: Int32
# ---------- pyramids: Python ----------
import sys

import os
import Grasshopper

path=os.path.dirname(Grasshopper.Instances.ActiveCanvas.Document.FilePath)

sys.path.append(path)

import complex as cp

reload(cp)

pattern_type = side_interlock

if pattern_type==0:
    pattern=[(0,0)]

elif pattern_type==1:
    pattern=[(1,1)]
    
elif pattern_type==2:
    pattern=[(2,2)]
    
elif pattern_type==3:
    pattern=[(3,1),(1,3)]

elif pattern_type==4:
    pattern=[(1,3),(3,1)]

elif pattern_type==5:
    pattern=[3]

test_simple=cp.Pyramid(pts, c_pt)
if apply_mesh_cor_val:
    test_simple.mesh_correction(correction_val)
elif apply_polyline_cor_val:
    test_simple.polyline_correction(correction_val)
rhino_mesh=test_simple.rhino_mesh(show_mesh_cor_val)
g=test_simple.rhino_mesh()
test_simple.unfolding()
c, b, d=test_simple.add_complex_sides(pattern=pattern)
outline_a, outline_b = c
folds_a_a, folds_a_b = b
folds_b_a, folds_b_b = d
folds_i_a, folds_i_b = test_simple.fold_lns()
# d=cp.arcs
# print(test_simple.flat_pts)
# e=[test_simple.flat_pts[i] for i in range(len(pts) )]
g=test_simple.rhino_brep(False, True, correction_val)

h,i=g[0],g[1]
# ---------- end pyramids ----------
delta_2_4 = GhPythonScript(
    pts=python_3.boundary,
    folds=python_3.folds,
    split_idx=number_slider,
    h_max=Slider(36.1, range=0..100),
    correction_val=Slider(0.7, range=-10..10),
    mesh_cor_val=Toggle(False),
    show_with_cor_val=Toggle(False),
    side_interlock=list_4)  # -> out, a, b, c, d, f; inputs pts: list of Point3d, split_idx: Int32, mesh_cor_val: Boolean, show_with_cor_val: Boolean, side_interlock: Int32
# ---------- delta_2_4: Python ----------
import sys
import Rhino.Geometry as rg

import os
import Grasshopper

path=os.path.dirname(Grasshopper.Instances.ActiveCanvas.Document.FilePath)

sys.path.append(path)

import complex as cp

reload(cp)

pattern_type = side_interlock

if pattern_type==0:
    pattern=[(0,0)]

elif pattern_type==1:
    pattern=[(1,1)]
    
elif pattern_type==2:
    pattern=[(2,2)]
    
elif pattern_type==3:
    pattern=[(3,1),(1,3)]

elif pattern_type==4:
    pattern=[(1,3),(3,1)]

elif pattern_type==5:
    pattern=[3]
    

test_simple=cp.Simple(pts, split_idx)
if mesh_cor_val:
    test_simple.mesh_correction(correction_val)
else:
    if abs(correction_val) > .01:
        test_simple.polyline_correction(correction_val)
a=test_simple.rhino_mesh(show_with_cor_val)
test_simple.unfolding()
c, b, d=test_simple.add_complex_sides(h_max=h_max, pattern=pattern)
c=rg.PolylineCurve(c)
# d=cp.arcs
# print(test_simple.flat_pts)
# e=[test_simple.flat_pts[i] for i in range(len(pts) )]
if folds:
    f=test_simple.fold_lns()
# ---------- end delta_2_4 ----------
python_8 = GhPythonScript(data_dict=string_reading.data_dict)  # -> out, mirrh, mirrv, konh, konv, roth, rotv, ftypo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
# ---------- python_8: Python ----------
print(data_dict)

mirrh = data_dict["mirrh"]
mirrv = data_dict["mirrv"]
konh = data_dict["konh"]
konv = data_dict["konv"]
roth = data_dict["roth"]
rotv = data_dict["rotv"]
# ftypo = [int(c) for c in data_dict["ftypo"].split('b')[1] ]
fgh = data_dict["fgh"]
fgv = data_dict["fgv"]
frat = data_dict["frat"]
ft = data_dict["ft"]
mid = data_dict["mid"]
hs = data_dict["hs"]
# ---------- end python_8 ----------
panel_5 = Panel(string_reading.out)
item = ListItem(List=python.boundary, Index=Slider(6, range=0..10), Wrap=True)
diamond = GhPythonScript(
    pts=python_5.boundary,
    folds=python_5.folds,
    split_idx=number_slider_2,
    h_max=Slider(37.3, range=0..100),
    correction_val=Slider(5.3, range=-10..10),
    mesh_cor_val=Toggle(False),
    show_with_cor_val=Toggle(True),
    side_interlock=list_5)  # -> out, a, b, c, d, f; inputs pts: list of Point3d, split_idx: Int32, mesh_cor_val: Boolean, show_with_cor_val: Boolean, side_interlock: Int32; same code as delta_2_4
gradient = Gradient(
    LowerLimit=0,
    UpperLimit=1,
    Parameter=series,
    stops=[0: RGB(243, 57, 0), 0.1: RGB(236, 27, 60), 0.2: RGB(210, 0, 118), 0.3: RGB(103, 0, 120), 0.4: RGB(39, 72, 161), 0.5: RGB(1, 192, 229), 0.6: RGB(18, 178, 90), 0.7: RGB(79, 186, 8), 0.8: RGB(220, 237, 32), 0.9: RGB(247, 159, 20), 1: RGB(243, 57, 0)])
triangle = GhPythonScript(
    pts=python_2.boundary,
    folds=python_2.folds,
    split_idx=0,
    h_max=Slider(36.1, range=0..100),
    correction_val=Slider(0.7, range=-10..10),
    mesh_cor_val=Toggle(False),
    show_with_cor_val=Toggle(False),
    side_interlock=list_6)  # -> out, a, b, c, d, f; inputs pts: list of Point3d, split_idx: Int32, mesh_cor_val: Boolean, show_with_cor_val: Boolean, side_interlock: Int32; same code as delta_2_4
hsv_colors = GhPythonScript(values=python_6.values)  # -> out, clrs; inputs values: list
# ---------- hsv_colors: Python ----------
import Rhino.Display as rd

clrs = [rd.ColorHSV(v[0] * .25, 1.0 - v[1] * .75, 1.0 - v[2] * .5).ToArgbColor() for v in values]
# ---------- end hsv_colors ----------
panel_6 = Panel(string_reading_2.out)
python_9 = GhPythonScript(data_dict=string_reading_2.data_dict)  # -> out, mirrh, mirrv, konh, konv, roth, rotv, ftypo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
# ---------- python_9: Python ----------
print(data_dict)

mirrh = data_dict["mirrh"]
mirrv = data_dict["mirrv"]
konh = data_dict["konh"]
konv = data_dict["konv"]
roth = data_dict["roth"]
rotv = data_dict["rotv"]
ftypo = [int(c) for c in data_dict["ftypo"].split('b')[1] ]
fgh = data_dict["fgh"]
fgv = data_dict["fgv"]
frat = data_dict["frat"]
# ---------- end python_9 ----------
python_10 = GhPythonScript(F_type=python_8.ft, Min_height=Slider(0.2, range=0..0.5), Heights=python_8.hs)  # -> Out, A
multiplication_2 = Multiplication(A=number_slider_6, B=number_slider_5)
medges = MeshEdges(Mesh=python_7.mesh_list)  # -> NakedEdges, InteriorEdges, NonManifoldEdges
pt_3 = ConstructPoint(XCoordinate=number_slider_6, YCoordinate=number_slider_5, ZCoordinate=Slider(0, range=0..10))
python_11 = GhPythonScript(
    mns=pt_3,
    hor_rot=python_8.roth,
    ver_rot=python_8.rotv,
    hor_flip=python_8.mirrh,
    ver_flip=python_8.mirrv,
    hor_inside=python_8.konh,
    ver_inside=python_8.konv)  # -> out, values; inputs mns: Point3d, hor_rot: Int32, ver_rot: Int32, hor_flip: Boolean, ver_flip: Boolean, hor_inside: Boolean, ver_inside: Boolean; same code as python_6
panel_7 = Panel(triangle.out)
pt_4 = ConstructPoint(XCoordinate=Slider(8, range=0..10), YCoordinate=Slider(6.6, range=0..10), ZCoordinate=Slider(4, range=0..10))
random_2 = Random(Range=Domain(0, 1), Number=multiplication_2, Seed=2)
division_2 = Division(A=1, B=multiplication_2)
secundary_folds = Curve(delta_2_4.d)
outline_curve = Curve(delta_2_4.c)
main_folds = Line(delta_2_4.b)
inner_folds = Line(delta_2_4.f)
mesh = Mesh(delta_2_4.a)
secundary_folds_2 = Curve(diamond.d)
outline_curve_2 = Curve(diamond.c)
secundary_folds_3 = Curve(triangle.d)
main_folds_2 = Line(diamond.b)
inner_folds_2 = Line(diamond.f)
mesh_2 = Mesh(pyramids.rhino_mesh)
mesh_3 = Mesh(diamond.a)
outline_curve_3 = Curve(triangle.c)
series_2 = Series(Start=0, Step=division_2, Count=multiplication_2)
divide = DivideCurve(Curve=outline_curve, Count=1, Kinks=True)  # -> Points, Tangents, Parameters
sort_2 = SortList(Keys=random_2)  # -> Keys, ValuesA
main_folds_3 = Line(triangle.b)
inner_folds_3 = Line(triangle.f)
python_12 = GhPythonScript(xyz=pt_4, frac=python_8.frat, z_count=python_8.fgv, x_count=python_8.fgh, mns=pt_3, h_para=Slider(0.1, range=0..0.1))  # -> out, back_box, graft(mesh_list), graft(idx_list), base_parameters; inputs xyz: Point3d, z_count: Int32, x_count: Int32, mns: Point3d
# ---------- python_12: Python ----------
import math
import Rhino.Geometry as rg

z_dim = xyz.Z / z_count
x_dim = z_dim * frac

if x_count is None:
    x_count = int(math.floor(xyz.X / x_dim) )

back_box = rg.Box(
    rg.Plane.WorldXY,
    rg.Interval(0, x_dim * x_count),
    rg.Interval(0, xyz.Y),
    rg.Interval(0, xyz.Z)
)

m,n,shift = int(mns.X), int(mns.Y), int(mns.Z)

def create_mns(m, n, shift):
    mns_obj = {'m': m,'n': n,'s': shift}
    for j in range(n):
        row = []
        for i in range(m):
            row.append(j * m + i)
        mns_obj[j] = row
        
    return mns_obj

def idx_function(i,j,mns):
    shift = j * mns['s']
    row = mns[j % mns['n'] ]
    return row[(i - shift) % mns['m'] ]

print(m, n, shift)

mns_obj = create_mns(m, n, shift)
mesh_list = []
idx_list = []

for i in range(x_count):
    for j in range(z_count):
        msh = rg.Mesh()
        pts = [
            rg.Point3d(i * x_dim, 0, j * z_dim),
            rg.Point3d( (i + 1) * x_dim, 0, j * z_dim),
            rg.Point3d( (i + 1) * x_dim, 0, (j + 1) * z_dim),
            rg.Point3d( i * x_dim, 0, (j + 1) * z_dim)
        ]
            
        [msh.Vertices.Add(pt) for pt in pts]
        msh.Faces.AddFace(0, 1, 2, 3)
        
        idx_list.append(idx_function(i, j, mns_obj) )
        mesh_list.append(msh)
        
base_parameters = {}
base_parameters["x_cnt"] = x_count
base_parameters["z_cnt"] = z_count
base_parameters["x_dim"] = x_dim
base_parameters["z_dim"] = z_dim
base_parameters['h']     = h_para
base_parameters = [base_parameters]
# ---------- end python_12 ----------
composing_bases = GhPythonScript(data_dict=string_reading.data_dict, base_parameters=python_12.base_parameters, min_height_sides=number_slider_7)  # -> out, data_dict
# ---------- composing_bases: Python ----------
import sys, os

path = ghenv.Component.OnPingDocument().FilePath
path = os.path.dirname(path)
sys.path.append(path)
path = os.path.dirname(path)
sys.path.append(path)

print("############## <sys.path> ###################################")
print('\n'.join(sys.path) )
print("################# </> #######################################")

import gen_b_pts as gb
reload(gb)

data_dict = gb.initialize_points(data_dict, base_parameters, min_height_sides)


data_dict = [data_dict]
# ---------- end composing_bases ----------
composing_bases_2 = GhPythonScript(data_dicts=string_reading_3.data_dict, base_parameters=python_12.base_parameters, min_height_sides=number_slider_7)  # -> out, data_dict; inputs data_dicts: list
# ---------- composing_bases_2: Python ----------
import sys, os

path = ghenv.Component.OnPingDocument().FilePath
path = os.path.dirname(path)
sys.path.append(path)
path = os.path.dirname(path)
sys.path.append(path)

print("############## <sys.path> ###################################")
print('\n'.join(sys.path) )
print("################# </> #######################################")

import gen_b_pts as gb
reload(gb)

data_dict = [gb.initialize_points(d_d, base_parameters, min_height_sides) for d_d in data_dicts]
# ---------- end composing_bases_2 ----------
divide_2 = DivideCurve(Curve=outline_curve_2, Count=1, Kinks=True)  # -> Points, Tangents, Parameters
mesh_4 = Mesh(triangle.a)
panel_8 = Panel(python_9.out)
divide_3 = DivideCurve(Curve=outline_curve_3, Count=1, Kinks=True)  # -> Points, Tangents, Parameters
reading_dict = GhPythonScript(data_dict=composing_bases.data_dict)  # -> out, mirrh, mirrv, konh, konv, roth, rotv, ftypo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
# ---------- reading_dict: Python ----------
print(data_dict)

mirrh = data_dict["mirrh"]
mirrv = data_dict["mirrv"]
konh = data_dict["konh"]
konv = data_dict["konv"]
roth = data_dict["roth"]
rotv = data_dict["rotv"]
ftypo = [int(c) for c in data_dict["ftypo"].split('b')[1] ]
fgh = data_dict["fgh"]
fgv = data_dict["fgv"]
frat = data_dict["frat"]
ft = data_dict["ft"]
mid = data_dict["mid"]
hs = data_dict["hs"]

for key, values in data_dict.items():
    print("{} : {}".format(key, values) )
# ---------- end reading_dict ----------
item_2 = ListItem(List=hsv_colors.clrs, Index=python_7.idx_list, Wrap=True)
panel_9 = Panel(hsv_colors.clrs)
item_3 = ListItem(List=gradient, Index=python_7.idx_list, Wrap=True)
gradient_2 = Gradient(
    LowerLimit=0,
    UpperLimit=1,
    Parameter=series_2,
    stops=[0: RGB(243, 57, 0), 0.1: RGB(236, 27, 60), 0.2: RGB(210, 0, 118), 0.3: RGB(103, 0, 120), 0.4: RGB(39, 72, 161), 0.5: RGB(1, 192, 229), 0.6: RGB(18, 178, 90), 0.7: RGB(79, 186, 8), 0.8: RGB(220, 237, 32), 0.9: RGB(247, 159, 20), 1: RGB(243, 57, 0)])
wbedges = WeaverbirdsMeshEdges(MeshOrPolylines=mesh_4)
num_3 = Number(0)
hsv = ColourHSV(Alpha=1, Hue=0, Saturation=1, Value=1)
hsv_colors_2 = GhPythonScript(values=python_11.values)  # -> out, clrs; inputs values: list; same code as hsv_colors
python_13 = GhPythonScript(loc_mesh=mesh, x=Slider(10, range=-10..10))  # -> out, a; inputs loc_mesh: Mesh
# ---------- python_13: Python ----------
import Rhino.Geometry as rg

a=loc_mesh.Offset(x)
# ---------- end python_13 ----------
list_7 = ValueList({"Optimal Width": 0, "Optimal Length": 1, "Optimal Area": 2}, selected="Optimal Width")
pt_5 = Point(Point(972.3068, 58.77198605, 0))
python_14 = GhPythonScript(loc_mesh=mesh_3, x=Slider(10, range=-10..10))  # -> out, a; inputs loc_mesh: Mesh; same code as python_13
list_8 = ValueList({"Optimal Width": 0, "Optimal Length": 1, "Optimal Area": 2}, selected="Optimal Width")
mcol = MeshColours(Mesh=python_7.mesh_list, Colours=item_2)
python_15 = GhPythonScript(loc_mesh=mesh_4, x=Slider(10, range=-10..10))  # -> out, a; inputs loc_mesh: Mesh; same code as python_13
list_9 = ValueList({"Optimal Width": 0, "Optimal Length": 1, "Optimal Area": 2}, selected="Optimal Width")
pt_6 = Point(Point(972.3068, 58.77198605, 0))
mcol_2 = MeshColours(Mesh=python_7.mesh_list, Colours=item_3)  # -> flatten(Mesh)
lng = ListLength(List=flatten(mcol_2))
series_3 = Series(Start=0, Step=0, Count=lng)  # -> flatten(Series)
pt_7 = Point(Point(972.3068, 58.77198605, 0))
medges_2 = MeshEdges(Mesh=python_12.mesh_list)  # -> NakedEdges, InteriorEdges, NonManifoldEdges
secundary_folds_4 = Curve(pyramids.folds_b_a)
outline_curve_4 = Curve(pyramids.outline_a)
panel_10 = Panel(composing_bases.out)
main_folds_4 = Line(pyramids.folds_a_a)
inner_folds_4 = Line(pyramids.folds_i_a)
secundary_folds_5 = Curve(pyramids.folds_b_b)
outline_curve_5 = Curve(pyramids.outline_b)
main_folds_5 = Line(pyramids.folds_a_b)
inner_folds_5 = Line(pyramids.folds_i_b)
reading_dict_2 = GhPythonScript(data_dict=composing_bases_2.data_dict)  # -> out, mirrh, mirrv, konh, konv, roth, rotv, ftypo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; same code as reading_dict
divide_4 = DivideCurve(Curve=outline_curve_4, Count=1, Kinks=True)  # -> Points, Tangents, Parameters
placement_optimization = GhPythonScript(
    pts=divide.Points,
    iterations=Slider(1000, range=10..1000),
    max_width=Slider(2000, range=0..10000),
    max_length=Slider(1818.8, range=0..10000),
    optimization=list_7)  # -> out, optimal_angle, width, length, area, all_data; inputs pts: list of Point3d, iterations: Int32, optimization: Int32
# ---------- placement_optimization: Python ----------
import sys
import Rhino.Geometry as rg

import os
import Grasshopper

path=os.path.dirname(Grasshopper.Instances.ActiveCanvas.Document.FilePath)

sys.path.append(path)

import complex as cp

reload(cp)

width_angle,length_angle,area_angle,data=cp.optimal_rec(pts, iterations, max_width, max_length)

if optimization == 0:
    optimal_angle=width_angle
elif optimization == 1:
    optimal_angle=length_angle
elif optimization == 2:
    optimal_angle=area_angle
    
print(optimal_angle)

str_list=[]
for key, items in data.items():
    str_list.append("for angle {}: \n  width: {}\n  length: {}\n  area: {}".format(key, items["width"], items["length"], items["area"]) )
    
all_data='\n'.join(str_list)

_width, _length, _area=data[optimal_angle]["width"], data[optimal_angle]["length"], data[optimal_angle]["area"]
# ---------- end placement_optimization ----------
python_16 = GhPythonScript(x=main_folds, y=outline_curve, z=secundary_folds, u=inner_folds, angle=placement_optimization.optimal_angle, b_pt=pt_5)  # -> out, x, y, z, u; inputs x: list of Curve, y: Curve, z: list of Curve, u: list of Curve, b_pt: Point3d
# ---------- python_16: Python ----------
import Rhino.Geometry as rg

rot_matrix=rg.Transform.Rotation(angle, rg.Point3d(0,0,0) )
trans_matrix=rg.Transform.Translation(rg.Vector3d(b_pt) )


to_transform=[x,[y],z,u ]
cleaned_objs=[]
for obj_list in to_transform:
    loc_obj_list=[]
    for obj in obj_list:
        if not(obj is None):
            loc_obj_list.append(obj)
    cleaned_objs.append(loc_obj_list)
print(cleaned_objs)
print(loc_obj_list)
x, y, z, u=tuple(cleaned_objs)
to_transform=x+y+z+u
[obj.Transform(rot_matrix) for obj in to_transform]
[obj.Transform(trans_matrix) for obj in to_transform]
# ---------- end python_16 ----------
reading_dict_3 = GhPythonScript(data_dict=composing_bases_2.data_dict)  # -> out, mirrh, mirrv, konh, konv, roth, rotv, ftypo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
# ---------- reading_dict_3: Python ----------
for key, values in data_dict.items():
    print("{} : {}".format(key, values) )
# ---------- end reading_dict_3 ----------
divide_5 = DivideCurve(Curve=outline_curve_5, Count=1, Kinks=True)  # -> Points, Tangents, Parameters
merge = Merge(Data1=graft(series_3), Data2=graft(mcol_2))
placement_optimization_2 = GhPythonScript(
    pts=divide_2.Points,
    iterations=Slider(1000, range=10..1000),
    max_width=Slider(2000, range=0..10000),
    max_length=Slider(1818.8, range=0..10000),
    optimization=list_8)  # -> out, optimal_angle, width, length, area, all_data; inputs pts: list of Point3d, iterations: Int32, optimization: Int32; same code as placement_optimization
python_17 = GhPythonScript(
    x=main_folds_2,
    y=outline_curve_2,
    z=secundary_folds_2,
    u=inner_folds_2,
    angle=placement_optimization_2.optimal_angle,
    b_pt=pt_6)  # -> out, x, y, z, u; inputs x: list of Curve, y: Curve, z: list of Curve, u: list of Curve, b_pt: Point3d; same code as python_16
placement_optimization_3 = GhPythonScript(
    pts=divide_3.Points,
    iterations=Slider(1000, range=10..1000),
    max_width=Slider(2000, range=0..10000),
    max_length=Slider(1818.8, range=0..10000),
    optimization=list_9)  # -> out, optimal_angle, width, length, area, all_data; inputs pts: list of Point3d, iterations: Int32, optimization: Int32; same code as placement_optimization
python_18 = GhPythonScript(
    x=main_folds_3,
    y=outline_curve_3,
    z=secundary_folds_3,
    u=inner_folds_3,
    angle=placement_optimization_3.optimal_angle,
    b_pt=pt_7)  # -> out, x, y, z, u; inputs x: list of Curve, y: Curve, z: list of Curve, u: list of Curve, b_pt: Point3d; same code as python_16
panel_11 = Panel(hsv_colors_2.clrs)
item_4 = ListItem(List=hsv_colors_2.clrs, Index=python_12.idx_list, Wrap=True)

# ---- group: Visualisation
merge_2 = Merge(Data1=mesh_4, Data2=main_folds_3, Data3=outline_curve_3, Data4=secundary_folds_3, Data5=inner_folds_3)  # -> flatten(Result)
gate = StreamGate(Stream=merge_2, Gate=Toggle(True))  # -> Target0, Target1
geo = Geometry(gate.Target1)

# ----
item_5 = ListItem(List=merge, Index=graft(python_9.ftypo), Wrap=True)
num_4 = Number(0)
list_10 = ValueList({"Optimal Width": 0, "Optimal Length": 1, "Optimal Area": 2}, selected="Optimal Width")
hsv_2 = ColourHSV(Alpha=1, Hue=0, Saturation=1, Value=1)
list_11 = ValueList({"Optimal Width": 0, "Optimal Length": 1, "Optimal Area": 2}, selected="Optimal Width")
panel_12 = Panel(python_8.out)

# ---- group: Visualisation
merge_3 = Merge(Data1=mesh, Data2=main_folds, Data3=outline_curve, Data4=secundary_folds, Data5=inner_folds)  # -> flatten(Result)
gate_2 = StreamGate(Stream=merge_3, Gate=Toggle(False))  # -> Target0, Target1
geo_2 = Geometry(gate_2.Target1)

# ----
pt_8 = Point(Point(1754.706497, 250.7562925, 0))
pt_9 = Point(Point(972.3068, 58.77198605, 0))
panel_13 = Panel(python_7.idx_list)
mcol_3 = MeshColours(Mesh=python_12.mesh_list, Colours=item_4)  # -> flatten(Mesh)
lng_2 = ListLength(List=flatten(mcol_3))
baking = GhPythonScript(
    bake_me=Button(),
    main_folds=python_16.x,
    outline_crv=python_16.y,
    secundary_folds=python_16.z,
    inner_folds=python_16.u,
    delay_time=Slider(1, range=0.5..10))  # -> out, a; inputs bake_me: Boolean, main_folds: list, outline_crv: list, secundary_folds: list, inner_folds: list
# ---------- baking: Python ----------
import rhinoscriptsyntax as rs
import scriptcontext as sc
import Rhino
import time

def bake_objects(layer, geo):
    
    sc.doc=Rhino.RhinoDoc.ActiveDoc
    
    if not rs.IsLayer(layer):
        rs.AddLayer(layer)
    
    for i in range(len(geo) ):
        
        geo_id=geo[i]
        
        sc.doc=ghdoc
        
        doc_object=rs.coercerhinoobject(geo_id)
        
        geometry=doc_object.Geometry
        attributes=doc_object.Attributes
        
        sc.doc=Rhino.RhinoDoc.ActiveDoc
        
        rhino_ref=sc.doc.Objects.Add(geometry)
            
        rs.ObjectLayer(rhino_ref, layer)
        
    sc.doc=ghdoc

waiting_time=delay_time

if bake_me and time.time() - sc.sticky["start_time"] > waiting_time:
    print("baking")
    print("time since last press: {}".format(time.time() - sc.sticky["start_time"] ) )
    sc.sticky["start_time"]=time.time()
    
    bake_objects("outline", outline_crv )
    bake_objects("folds_main", main_folds )
    bake_objects("folds_secundary", secundary_folds )
    bake_objects("folds_inner", inner_folds)
        
    C=True
elif bake_me and time.time() - sc.sticky["start_time"] < waiting_time:
    print("pressing too soon again! ")
    print("time since last press: {}".format(time.time() - sc.sticky["start_time"] ) )
    print("should wait for {} seconds!".format(waiting_time) )
else:
    
    sc.sticky["start_time"]=time.time()
    
    C=False
# ---------- end baking ----------
series_4 = Series(Start=0, Step=0, Count=lng_2)  # -> flatten(Series)
panel_14 = Panel(placement_optimization.width)
panel_15 = Panel(placement_optimization.length)
panel_16 = Panel(placement_optimization.area)
baking_2 = GhPythonScript(
    bake_me=Button(),
    main_folds=python_17.x,
    outline_crv=python_17.y,
    secundary_folds=python_17.z,
    inner_folds=python_17.u,
    delay_time=Slider(1, range=0.5..10))  # -> out, a; inputs bake_me: Boolean, main_folds: list, outline_crv: list, secundary_folds: list, inner_folds: list; same code as baking

# ---- group: Visualisation
merge_4 = Merge(Data1=mesh_3, Data2=main_folds_2, Data3=outline_curve_2, Data4=secundary_folds_2, Data5=inner_folds_2)  # -> flatten(Result)
gate_3 = StreamGate(Stream=merge_4, Gate=Toggle(False))  # -> Target0, Target1
geo_3 = Geometry(gate_3.Target1)

# ----
baking_3 = GhPythonScript(
    bake_me=Button(),
    main_folds=python_18.x,
    outline_crv=python_18.y,
    secundary_folds=python_18.z,
    inner_folds=python_18.u,
    delay_time=Slider(1, range=0.5..10))  # -> out, a; inputs bake_me: Boolean, main_folds: list, outline_crv: list, secundary_folds: list, inner_folds: list
# ---------- baking_3: Python ----------
import sys

sys.path.append("/Users/jonas/Documents/reps/facademaker_reading/grasshopper")

import baking as bk
reload(bk)

global ghdoc

if bake_me:
    bk.bake(outline_crv, main_folds, secundary_folds, inner_folds, ghdoc)
# ---------- end baking_3 ----------
panel_17 = Panel(placement_optimization_2.width)
panel_18 = Panel(placement_optimization_2.length)
panel_19 = Panel(placement_optimization_2.area)
panel_20 = Panel(placement_optimization_3.width)
panel_21 = Panel(placement_optimization_3.length)
panel_22 = Panel(placement_optimization_3.area)
placement_optimization_4 = GhPythonScript(
    pts=divide_4.Points,
    iterations=Slider(1000, range=10..1000),
    max_width=Slider(2000, range=0..10000),
    max_length=Slider(1818.8, range=0..10000),
    optimization=list_10)  # -> out, optimal_angle, width, length, area, all_data; inputs pts: list of Point3d, iterations: Int32, optimization: Int32; same code as placement_optimization
panel_23 = Panel(item_5)
placement_optimization_5 = GhPythonScript(
    pts=divide_5.Points,
    iterations=Slider(1000, range=10..1000),
    max_width=Slider(2000, range=0..10000),
    max_length=Slider(1818.8, range=0..10000),
    optimization=list_11)  # -> out, optimal_angle, width, length, area, all_data; inputs pts: list of Point3d, iterations: Int32, optimization: Int32
# ---------- placement_optimization_5: Python ----------
import sys

import Rhino.Geometry as rg

import os
import Grasshopper

path=os.path.dirname(Grasshopper.Instances.ActiveCanvas.Document.FilePath)

sys.path.append(path)

import complex as cp

reload(cp)

width_angle,length_angle,area_angle,data=cp.optimal_rec(pts, iterations, max_width, max_length)

if optimization == 0:
    optimal_angle=width_angle
elif optimization == 1:
    optimal_angle=length_angle
elif optimization == 2:
    optimal_angle=area_angle
    
print(optimal_angle)

str_list=[]
for key, items in data.items():
    str_list.append("for angle {}: \n  width: {}\n  length: {}\n  area: {}".format(key, items["width"], items["length"], items["area"]) )
    
all_data='\n'.join(str_list)

_width, _length, _area=data[optimal_angle]["width"], data[optimal_angle]["length"], data[optimal_angle]["area"]
# ---------- end placement_optimization_5 ----------
panel_24 = Panel(composing_bases_2.out)
merge_5 = Merge(Data1=graft(series_4), Data2=graft(mcol_3))
python_19 = GhPythonScript(
    x=main_folds_4,
    y=outline_curve_4,
    z=secundary_folds_4,
    u=inner_folds_4,
    angle=placement_optimization_4.optimal_angle,
    b_pt=pt_8)  # -> out, x, y, z, u; inputs x: list of Curve, y: Curve, z: list of Curve, u: list of Curve, b_pt: Point3d; same code as python_16
python_20 = GhPythonScript(
    x=main_folds_5,
    y=outline_curve_5,
    z=secundary_folds_5,
    u=inner_folds_5,
    angle=placement_optimization_5.optimal_angle,
    b_pt=pt_9)  # -> out, x, y, z, u; inputs x: list of Curve, y: Curve, z: list of Curve, u: list of Curve, b_pt: Point3d; same code as python_16
panel_25 = Panel(baking.out)
panel_26 = Panel(baking_2.out)
panel_27 = Panel(baking_3.out)
item_6 = ListItem(List=merge_5, Index=graft(python_8.ftypo), Wrap=True)
panel_28 = Panel(placement_optimization_4.width)
panel_29 = Panel(placement_optimization_4.length)
panel_30 = Panel(placement_optimization_4.area)
panel_31 = Panel(placement_optimization_5.width)
panel_32 = Panel(placement_optimization_5.length)
panel_33 = Panel(placement_optimization_5.area)
panel_34 = Panel(python_12.idx_list)
panel_35 = Panel(placement_optimization_5.out)
panel_36 = Panel(item_6)
merge_6 = Merge(Data1=python_19.x, Data2=python_20.x)
merge_7 = Merge(Data1=python_19.z, Data2=python_20.z)
merge_8 = Merge(Data1=python_19.u, Data2=python_20.u)
merge_9 = Merge(Data1=python_19.y, Data2=python_20.y)

# ---- group: Visualisation
merge_10 = Merge(Data1=merge_6, Data2=merge_9, Data3=merge_7, Data4=mesh_2, Data5=merge_8)  # -> flatten(Result)
gate_4 = StreamGate(Stream=merge_10, Gate=Toggle(True))  # -> Target0, Target1
geo_4 = Geometry(gate_4.Target1)

# ----
baking_4 = GhPythonScript(
    bake_me=Button(),
    main_folds=merge_6,
    outline_crv=merge_9,
    secundary_folds=merge_7,
    inner_folds=merge_8,
    delay_time=Slider(1, range=0.5..10))  # -> out, a; inputs bake_me: Boolean, main_folds: list, outline_crv: list, secundary_folds: list, inner_folds: list; same code as baking
