# Grasshopper definition merging.gh (Grasshopper 1.0.7)

panel = Panel("""http://jonass-imac.local/facade-maker/index.php?ft=d2&fp=0&fgv=5&fgh=7&frat=1.3953488372093024&ftypo=vvvvvvv&mirrh=0&mirrv=0&roth=0&rotv=0&konh=0&konv=0&mat=&c00=0&c01=0&c10=0&c11=0.7
http://jonass-imac.local/facade-maker/index.php?ft=d2&fp=0&fgv=5&fgh=7&frat=1.3953488372093024&ftypo=vvvvvvv&mirrh=0&mirrv=0&roth=0&rotv=0&konh=0&konv=0&mat=&c00=0&c01=0&c10=0&c11=0.7
http://localhost/facade-maker/?ft=q1lift&fp=0&fgv=5&fgh=7&frat=1.3953488372093024&ftypo=vvvvvvv&mirrh=0&mirrv=0&roth=0&rotv=0&konh=0&konv=0&mat=&c00=0&c01=0.5&c10=0&c11=0.5
http://localhost/facade-maker/?ft=d2&fp=0&fgv=5&fgh=7&frat=1.3953488372093024&ftypo=vvvvvvv&mirrh=0&mirrv=0&roth=0&rotv=0&konh=0&konv=0&mat=&c00=0&c01=0&c10=0&c11=0.7
http://localhost/facade-maker/?ft=d2&fp=0&fgv=5&fgh=7&frat=1.3953488372093024&ftypo=vvvvvvv&mirrh=0&mirrv=0&roth=0&rotv=0&konh=0&konv=0&mat=&c00=0&c01=0&c10=0&c11=0.7
http://localhost/facade-maker/?ft=d2&fp=0&fgv=5&fgh=7&frat=1.3953488372093024&ftypo=vvvvvvv&mirrh=0&mirrv=0&roth=0&rotv=0&konh=0&konv=0&mat=&c00=0&c01=0&c10=0&c11=0.7
http://jonass-imac.local/facade-maker/index.php?ft=d2&fp=0&fgv=5&fgh=5&frat=1.942&ftypo=ttvvv&mirrh=0&mirrv=0&roth=0&rotv=0&konh=0&konv=0&mat=&c00=0&c01=0&c10=0&c11=0.7
http://jonass-imac.local/facade-maker/index.php?ft=q1lift&fp=0&fgv=5&fgh=5&frat=1.942&ftypo=ttvvv&mirrh=0&mirrv=0&roth=0&rotv=0&konh=0&konv=0&mat=&c00=0&c01=0.5&c10=0&c11=0.5
http://jonass-imac.local/facade-maker/index.php?ft=q1lift&fp=0&fgv=5&fgh=5&frat=1.942&ftypo=ttvvv&mirrh=0&mirrv=0&roth=1&rotv=1&konh=1&konv=1&mat=&c00=0&c01=0.5&c10=0&c11=0.5
http://jonass-imac.local/facade-maker/index.php?ft=q1lift&fp=0&fgv=5&fgh=5&frat=1.942&ftypo=ttvvv&mirrh=1&mirrv=0&roth=2&rotv=1&konh=1&konv=1&mat=&c00=0&c01=0.5&c10=0&c11=0.5
http://jonass-imac.local/facade-maker/index.php?ft=q1lift&fp=0&fgv=5&fgh=5&frat=1.942&ftypo=ttvvv&mirrh=1&mirrv=0&roth=2&rotv=1&konh=1&konv=1&mat=&c00=1&c01=1&c10=0&c11=0
http://jonass-imac.local/facade-maker/index.php?ft=q1lift&fp=0&fgv=5&fgh=5&frat=1.942&ftypo=ttvvv&mirrh=1&mirrv=0&roth=2&rotv=1&konh=1&konv=1&mat=&c00=1&c01=1&c10=0&c11=0
http://jonass-imac.local/facade-maker/index.php?ft=q1lift&fp=0&fgv=5&fgh=5&frat=1.942&ftypo=ttvvv&mirrh=1&mirrv=0&roth=2&rotv=1&konh=1&konv=1&mat=&c00=1&c01=1&c10=0&c11=0
http://jonass-imac.local/facade-maker/index.php?ft=d4&fp=0&fgv=5&fgh=5&frat=1.942&ftypo=ttvvv&mirrh=1&mirrv=0&roth=2&rotv=1&konh=1&konv=1&mat=&mid=0.3263597856369532%2C0.3488372093023256%2C0.5
http://jonass-imac.local/facade-maker/index.php?ft=d4&fp=0&fgv=5&fgh=5&frat=1.942&ftypo=ttvvv&mirrh=1&mirrv=0&roth=2&rotv=1&konh=1&konv=1&mat=&mid=0.3263597856369532%2C0.3488372093023256%2C0.5
http://jonass-imac.local/facade-maker/index.php?ft=q4&fp=0&fgv=5&fgh=8&frat=1.3373488492743915&ftypo=vvttvvvv&mirrh=1&mirrv=0&roth=1&rotv=3&konh=1&konv=0&mat=&c00=0&c01=0.2&c10=0.8&c11=1&mid=0.4217472966403055%2C0.3488372093023256%2C
http://jonass-imac.local/facade-maker/index.php?ft=q4&fp=0&fgv=5&fgh=8&frat=1.3373488492743915&ftypo=1111vvvv&mirrh=0&mirrv=0&roth=3&rotv=1&konh=0&konv=0&mat=&c00=0&c01=0.2&c10=0.8&c11=1&mid=0.4217472966403055%2C0.3488372093023256%2C
http://localhost/facade-maker/?ft=q1&fp=0&fgv=5&fgh=8&frat=1.244176287983739&ftypo=llllllll&mirrh=1&mirrv=1&roth=0&rotv=0&konh=1&konv=1&mat=
http://localhost/facade-maker/?ft=d4&fp=0&fgv=5&fgh=7&frat=1.3953488372093024&ftypo=vvvvvvv&mirrh=0&mirrv=0&roth=0&rotv=0&konh=0&konv=0&mat=&mid=0.5%2C0.5%2C1
http://localhost/facade-maker/?ft=d4&fp=0&fgv=5&fgh=7&frat=1.3953488372093024&ftypo=vvvvvvv&mirrh=0&mirrv=0&roth=0&rotv=0&konh=0&konv=0&mat=&mid=0.5%2C0.5%2C-1
http://localhost/facade-maker/?ft=d4&fp=0&fgv=5&fgh=7&frat=1.3953488372093024&ftypo=vvvvvvv&mirrh=0&mirrv=0&roth=0&rotv=0&konh=1&konv=1&mat=&mid=0.5%2C0.5%2C-1
http://ugdsolver.de/fcm/?ft=t2&fp=0&fgv=5&fgh=7&frat=1.395&ftypo2=1h9u1h_1h9u1h_1h9u1h_1h9u1h_1h9u1h&mirrh=0&mirrv=0&roth=0&rotv=0&konh=0&konv=0&mat=&c00=0&c01=0&c10=0.7
http://ugdsolver.de/fcm/?ft=d2&fp=0&fgv=5&fgh=7&frat=1.395&ftypo2=7di_12g_7e1_7kp_502&mirrh=0&mirrv=0&roth=0&rotv=0&konh=0&konv=0&mat=&c00=0&c01=0&c10=0&c11=0.7""")
panel_2 = Panel("""http://ugdsolver.de/fcm/?ft=d2&fp=0&fgv=5&fgh=7&frat=1.395&ftypo2=47p_47p_47p_47p_47p&mirrh=0&mirrv=0&roth=0&rotv=0&konh=0&konv=0&mat=&c00=0&c01=0&c10=0&c11=0.7
http://ugdsolver.de/fcm/?ft=q1lift&fp=0&fgv=5&fgh=7&frat=1.395&ftypo2=4eu_47k_4gl_47p_47p&mirrh=0&mirrv=0&roth=0&rotv=0&konh=0&konv=0&mat=&c00=0&c01=0.7&c10=0&c11=0.7
http://ugdsolver.de/fcm/?ft=d2&fp=0&fgv=5&fgh=7&frat=1.395&ftypo2=47p_47p_47p_47p_47p&mirrh=0&mirrv=0&roth=0&rotv=0&konh=0&konv=0&mat=&c00=0&c01=0&c10=0&c11=0.7
http://ugdsolver.de/fcm/?ft=d2&fp=0&fgv=5&fgh=7&frat=1.395&ftypo2=4eu_47k_4gl_47p_47p&mirrh=1&mirrv=0&roth=1&rotv=1&konh=0&konv=0&mat=&c00=0&c01=0&c10=0&c11=0.7
http://ugdsolver.de/fcm/?ft=d4&fp=0&fgv=5&fgh=7&frat=1.395&ftypo2=4eu_47k_4gl_47p_47p&mirrh=1&mirrv=0&roth=1&rotv=1&konh=0&konv=0&mat=&mid=0.7%2C0.348%2C0.5
http://ugdsolver.de/fcm/?ft=q4&fp=0&fgv=5&fgh=7&frat=1.395&ftypo2=4eu_47k_4gl_47p_47p&mirrh=1&mirrv=0&roth=1&rotv=1&konh=0&konv=0&mat=&c00=0&c01=0.2&c10=0.8&c11=0.4&mid=0.5%2C0.5%2C
http://ugdsolver.de/fcm/?ft=t1&fp=0&fgv=5&fgh=7&frat=1.395&ftypo2=5x3c5x_5x3c5x_5x3c5x_5x3c5x_5x3c5x&mirrh=1&mirrv=0&roth=1&rotv=1&konh=0&konv=0&mat=&c00=0&c01=0&c10=0.7
http://ugdsolver.de/fcm/?ft=t1&fp=0&fgv=5&fgh=8&frat=1.267&ftypo2=2mphemt_2mphemt_2mphemt_2mphemt_2mphemt&mirrh=1&mirrv=0&roth=1&rotv=1&konh=0&konv=0&mat=&c00=0&c01=0&c10=0.527
http://ugdsolver.de/fcm/?ft=t2&fp=0&fgv=5&fgh=8&frat=1.267&ftypo2=nodcnp_nodcnp_nodcnp_nodcnp_nodcnp&mirrh=1&mirrv=0&roth=1&rotv=1&konh=0&konv=0&mat=&c00=0&c01=0&c10=0.7
http://ugdsolver.de/fcm/?ft=t3&fp=0&fgv=5&fgh=8&frat=1.267&ftypo2=1vf9_1vf9_1vf9_1vf9_1vf9_1vf9&mirrh=1&mirrv=0&roth=1&rotv=1&konh=0&konv=0&mat=&c00=0&c01=0&c10=0&c11=0.7
http://ugdsolver.de/fcm/?ft=t4&fp=0&fgv=5&fgh=8&frat=1.267&ftypo2=1vf9_1vf9_1vf9_1vf9_1vf9&mirrh=1&mirrv=0&roth=1&rotv=1&konh=0&konv=0&mat=&c00=1&c01=1&c10=0&c11=0&mid=0.7%2C0%2C0""")
# http://jonass-imac.local/facade-maker/index.php?ft=d4&fp=0&fgv=5&fgh=5&frat=1.942&ftypo=ttvvv&mirrh=1&mirrv=0&roth=2&rotv=1&konh=1&konv=1&mat=&mid=0.3263597856369532%2C0.3488372093023256%2C0.5
panel_3 = Panel("http://localhost/facade-maker/?ft=q1&fp=0&fgv=5&fgh=8&frat=1.244176287983739&ftypo=llllllll&mirrh=1&mirrv=1&roth=0&rotv=0&konh=1&konv=1&mat=")
python = GhPythonScript(x=panel_2)  # -> out, a
# ---------- python: Python ----------
a = x.split('\n')
# ---------- end python ----------
item = ListItem(List=python.a, Index=Slider(14, range=0..15), Wrap=True)
python_2 = GhPythonScript(x=panel)  # -> out, a; same code as python
number_slider = Slider(0, range=0..3)
number_slider_2 = Slider(1, range=0..3)
stringreading = GhPythonScript(string=item)  # -> out, flatten(data_dict)
# ---------- stringreading: Python ----------
import sys
import Rhino.Geometry as rg

import os
import Grasshopper

path=os.path.dirname(Grasshopper.Instances.ActiveCanvas.Document.FilePath)
path=os.path.dirname(path)
path+="/src"
sys.path.append(path)

import read_link as rl
reload(rl)

data_dict=[rl.string_reader(string)]
# ---------- end stringreading ----------
number_slider_3 = Slider(2, range=1..10)
number_slider_4 = Slider(2, range=1..10)
list = ValueList({"x constrained": 0, "y constrained": 1, "xy constrained": 2, "free": 3}, selected="free")
list_2 = ValueList({"x constrained": 0, "y constrained": 1, "xy constrained": 2, "free": 3}, selected="free")
panel_4 = Panel("http://localhost/facade-maker/?ft=q1&fp=0&fgv=5&fgh=8&frat=1.244176287983739&ftypo=llllllll&mirrh=1&mirrv=1&roth=0&rotv=0&konh=1&konv=1&mat=")
list_3 = ValueList({"Optimal Width": 0, "Optimal Length": 1, "Optimal Area": 2}, selected="Optimal Width")
list_4 = ValueList({"Optimal Width": 0, "Optimal Length": 1, "Optimal Area": 2}, selected="Optimal Width")
list_5 = ValueList({"Optimal Width": 0, "Optimal Length": 1, "Optimal Area": 2}, selected="Optimal Width")
num = Number()
item_2 = ListItem(List=python_2.a, Index=Slider(19, range=0..100), Wrap=True)
panel_5 = Panel(item_2)
string_reading = GhPythonScript(input_string=item_2)  # -> out, data_dict
# ---------- string_reading: Python ----------
import sys, os

path = ghenv.Component.OnPingDocument().FilePath
path = os.path.dirname(path)
path = os.path.dirname(path)
sys.path.append(path + "/link_reading")

print("############## <sys.path> ###################################")
print('\n'.join(sys.path) )
print("################# </> #######################################")

import read_link as rl
reload(rl)
        
data_dict = [rl.string_reader(input_string)]
# ---------- end string_reading ----------
print_dict = GhPythonScript(x=stringreading.data_dict)  # -> flatten(out)
# ---------- print_dict: Python ----------
string=''
for key, item in x.items():
    string+="{} : {}\n".format(key, item)
    
print(string)
# ---------- end print_dict ----------
python_3 = GhPythonScript()  # -> Out, A
multiplication = Multiplication(A=number_slider_4, B=number_slider_3)
python_4 = GhPythonScript(
    width=Slider(200, range=0..1000),
    length=Slider(1000, range=0..1000),
    constraint_idx=list,
    bottom_0=Slider(100, range=0..100),
    bottom_1=Slider(34.6, range=0..100),
    top_0=Slider(35, range=0..100),
    top_1=Slider(149.7, range=0..250),
    xy_constraint_idx=number_slider)  # -> out, boundary, folds; inputs xy_constraint_idx: Int32
# ---------- python_4: Python ----------
import Rhino.Geometry as rg

def pt_on_plane(pln, pt):
    n=pln.Normal
    p0=pln.Origin
    l0=pt
    l=rg.Vector3d(0,0,1)
    
    t=(p0-l0)*n / (l*n)
    
    return rg.Point3d(l0 + l*t)

boundary=[
    rg.Point3d(0.0,length,0.0),
    rg.Point3d(0.0,0.0,0.0),
    rg.Point3d(width,0.0,0.0),
    rg.Point3d(width,length,0.0)
]

if constraint_idx == 0:
    main_heigth_bottom=bottom_0 if bottom_0>0.1 else bottom_1
    main_heigth_top=top_0 if top_0>0.1 else top_1
    h_0=main_heigth_bottom
    h_1=main_heigth_bottom
    h_2=main_heigth_top
    h_3=main_heigth_top
    
    h_list=[h_2, h_0, h_1, h_3]
    
    folds=False
    
elif constraint_idx == 1:
    main_heigth_left=bottom_0 if bottom_0>0.1 else top_0
    main_heigth_right=bottom_1 if bottom_1>0.1 else top_1
    h_0=main_heigth_left
    h_1=main_heigth_right
    h_2=main_heigth_left
    h_3=main_heigth_right
    
    h_list=[h_2, h_0, h_1, h_3]
    
    folds=False
    
elif constraint_idx == 2:
    h_0=bottom_0
    h_1=bottom_1
    h_2=top_0
    h_3=top_1
    
    h_list=[h_2, h_0, h_1, h_3]
    for i,val in enumerate(h_list):
        boundary[i].Z=val
        
    pt=boundary.pop(xy_constraint_idx)
    pln=rg.Plane(boundary[0], boundary[1], boundary[2])
    
    new_height=pt_on_plane(pln, pt).Z
    if new_height > 0.1:
        h_list[xy_constraint_idx]=new_height
    else:
        difference=.01 - new_height
        h_list=[val+difference for val in h_list]
        h_list[xy_constraint_idx]=.01
        
    folds=False
    
elif constraint_idx == 3:
    h_0=bottom_0
    h_1=bottom_1
    h_2=top_0
    h_3=top_1
    
    h_list=[h_2, h_0, h_1, h_3]
    
    folds=True

boundary=[
    rg.Point3d(0.0,length,0.0),
    rg.Point3d(0.0,0.0,0.0),
    rg.Point3d(width,0.0,0.0),
    rg.Point3d(width,length,0.0)
]

for i,val in enumerate(h_list):
    boundary[i].Z=val
# ---------- end python_4 ----------
python_5 = GhPythonScript(
    width=Slider(200, range=0..1000),
    length=Slider(1000, range=0..1000),
    constraint_idx=list_2,
    bottom_0=Slider(47.7, range=0..100),
    bottom_1=Slider(97.1, range=0..100),
    top_0=Slider(100, range=0..100),
    top_1=Slider(43.7, range=0..250),
    xy_constraint_idx=number_slider_2,
    tangent_shift=Slider(0.7, range=0..4))  # -> out, boundary, folds; inputs xy_constraint_idx: Int32
# ---------- python_5: Python ----------
import Rhino.Geometry as rg

def pt_on_plane(pln, pt):
    n=pln.Normal
    p0=pln.Origin
    l0=pt
    l=rg.Vector3d(0,0,1)
    
    t=(p0-l0)*n / (l*n)
    
    return rg.Point3d(l0 + l*t)

delta=tangent_shift*length

boundary=[
    rg.Point3d(delta,length,0.0),
    rg.Point3d(0.0,0.0,0.0),
    rg.Point3d(width,0.0,0.0),
    rg.Point3d(width+delta,length,0.0)
]

if constraint_idx == 0:
    main_heigth_bottom=bottom_0 if bottom_0>0.1 else bottom_1
    main_heigth_top=top_0 if top_0>0.1 else top_1
    h_0=main_heigth_bottom
    h_1=main_heigth_bottom
    h_2=main_heigth_top
    h_3=main_heigth_top
    
    h_list=[h_2, h_0, h_1, h_3]
    
    folds=False
    
elif constraint_idx == 1:
    main_heigth_left=bottom_0 if bottom_0>0.1 else top_0
    main_heigth_right=bottom_1 if bottom_1>0.1 else top_1
    h_0=main_heigth_left
    h_1=main_heigth_right
    h_2=main_heigth_left
    h_3=main_heigth_right
    
    h_list=[h_2, h_0, h_1, h_3]
    
    folds=False
    
elif constraint_idx == 2:
    h_0=bottom_0
    h_1=bottom_1
    h_2=top_0
    h_3=top_1
    
    h_list=[h_2, h_0, h_1, h_3]
    for i,val in enumerate(h_list):
        boundary[i].Z=val
        
    pt=boundary.pop(xy_constraint_idx)
    pln=rg.Plane(boundary[0], boundary[1], boundary[2])
    
    new_height=pt_on_plane(pln, pt).Z
    if new_height > 0.1:
        h_list[xy_constraint_idx]=new_height
    else:
        difference=.01 - new_height
        h_list=[val+difference for val in h_list]
        h_list[xy_constraint_idx]=.01
        
    folds=False
    
elif constraint_idx == 3:
    h_0=bottom_0
    h_1=bottom_1
    h_2=top_0
    h_3=top_1
    
    h_list=[h_2, h_0, h_1, h_3]
    
    folds=True

boundary=[
    rg.Point3d(delta,length,0.0),
    rg.Point3d(0.0,0.0,0.0),
    rg.Point3d(width,0.0,0.0),
    rg.Point3d(width+delta,length,0.0)
]

for i,val in enumerate(h_list):
    boundary[i].Z=val
# ---------- end python_5 ----------
python_6 = GhPythonScript(
    width=Slider(200, range=0..1000),
    length=Slider(440, range=0..1000),
    side_heigth=Slider(46.2, range=0..100),
    c_pt_x_percent=Slider(28, range=0..100),
    c_pt_y_percent=Slider(52.4, range=0..100),
    c_pt_heigth=Slider(100, range=0..250))  # -> out, boundary, c_pt
# ---------- python_6: Python ----------
import Rhino.Geometry as rg

boundary=[
    rg.Point3d(0.0,length,side_heigth),
    rg.Point3d(0.0,0.0,side_heigth),
    rg.Point3d(width,0.0,side_heigth),
    rg.Point3d(width,length,side_heigth)
]

c_pt=rg.Point3d(
    width*c_pt_x_percent*.01,
    length*c_pt_y_percent*.01,
    c_pt_heigth
)
# ---------- end python_6 ----------
list_6 = ValueList({"Straight": 0, "Clockwise": 1, "Counter-Clockwise": 2, "Alternating-A": 3, "Alternating-B": 4, "Flaps": 5}, selected="Clockwise")
list_7 = ValueList({"Straight": 0, "Clockwise": 1, "Counter-Clockwise": 2, "Alternating-A": 3, "Alternating-B": 4, "Flaps": 5}, selected="Straight")
list_8 = ValueList({"Straight": 0, "Clockwise": 1, "Counter-Clockwise": 2, "Alternating-A": 3, "Alternating-B": 4, "Flaps": 5}, selected="Flaps")
list_9 = ValueList({"Straight": 0, "Clockwise": 1, "Counter-Clockwise": 2, "Alternating-A": 3, "Alternating-B": 4, "Flaps": 5}, selected="Straight")
optimization = GhPythonScript(
    iterations=Slider(1000, range=10..1000),
    max_width=Slider(2000, range=0..10000),
    max_length=Slider(1818.8, range=0..10000),
    optimization=list_3)  # -> out, opt_dict; inputs iterations: Int32, optimization: Int32
# ---------- optimization: Python ----------
optimization_dict = {
    "iterations" : 100,
    "max_w" : 800.,
    "max_l" : 1800.,
}

optimization_dict["preference"] = ["width","length","area"][optimization]
opt_dict=[optimization_dict]
# ---------- end optimization ----------
optimization_2 = GhPythonScript(
    iterations=Slider(1000, range=10..1000),
    max_width=Slider(2000, range=0..10000),
    max_length=Slider(1818.8, range=0..10000),
    optimization=list_4)  # -> out, opt_dict; inputs iterations: Int32, optimization: Int32; same code as optimization
optimization_3 = GhPythonScript(
    iterations=Slider(1000, range=10..1000),
    max_width=Slider(2000, range=0..10000),
    max_length=Slider(1818.8, range=0..10000),
    optimization=list_5)  # -> out, opt_dict; inputs iterations: Int32, optimization: Int32; same code as optimization
string_reading_2 = GhPythonScript(input_string=panel_4)  # -> out, data_dict
# ---------- string_reading_2: Python ----------
import sys, os

path = ghenv.Component.OnPingDocument().FilePath
path = os.path.dirname(path)
sys.path.append(path)
path = os.path.dirname(path)
sys.path.append(path)

print("############## <sys.path> ###################################")
print('\n'.join(sys.path) )
print("################# </> #######################################")

import read_link as rl
reload(rl)
        
data_dict = [rl.string_reader(input_string)]
# ---------- end string_reading_2 ----------
python_7 = GhPythonScript(
    width=Slider(200, range=0..1000),
    length=Slider(1000, range=0..1000),
    h_0=Slider(100, range=0..100),
    h_1=Slider(34.6, range=0..100),
    h_2=Slider(35, range=0..100),
    tangent=Slider(0, range=0..4))  # -> out, boundary, folds
# ---------- python_7: Python ----------
import Rhino.Geometry as rg

delta=tangent*length

print(delta)

boundary=[
    rg.Point3d(0.0,0.0,h_0),
    rg.Point3d(width,0.0,h_1),
    rg.Point3d(width*.5+delta,length,h_2)
]

folds=False
# ---------- end python_7 ----------
pt = ConstructPoint(XCoordinate=number_slider_4, YCoordinate=number_slider_3, ZCoordinate=Slider(0, range=0..10))
panel_6 = Panel(print_dict)
toggle = BooleanToggle(True)
stringreading_2 = GhPythonScript(string=item_2)  # -> out, data_dict; same code as stringreading
pt_2 = ConstructPoint(XCoordinate=Slider(8, range=0..10), YCoordinate=Slider(6.6, range=0..10), ZCoordinate=Slider(4, range=0..10))
random = Random(Range=Domain(0, 1), Number=multiplication, Seed=2)
division = Division(A=1, B=multiplication)
item_3 = ListItem(List=stringreading.data_dict, Index=0, Wrap=True)
python_8 = GhPythonScript(
    mns=pt,
    hor_rot=Slider(2, range=0..3),
    ver_rot=Slider(2, range=0..3),
    hor_flip=Toggle(True),
    ver_flip=Toggle(False),
    hor_inside=Toggle(False),
    ver_inside=Toggle(False))  # -> out, values; inputs mns: Point3d, hor_rot: Int32, ver_rot: Int32, hor_flip: Boolean, ver_flip: Boolean, hor_inside: Boolean, ver_inside: Boolean
# ---------- python_8: Python ----------
x,y = int(mns.X), int(mns.Y)

rot_x = 0
flip_x = 0
inside_x = 0

values = []

for i in range(x):
    rot_y = 0
    flip_y = 0
    inside_y = 0
    
    for j in range(y):
        
        values.append([
            (rot_x + rot_y) % 4,
            bool( (flip_y + flip_x) % 2),
            bool( (inside_y + inside_x) % 2)
        ])
        
        rot_y += ver_rot
        flip_y += ver_flip
        inside_y += ver_inside
        
    rot_x += hor_rot
    flip_x += hor_flip
    inside_x += hor_inside
# ---------- end python_8 ----------
panel_7 = Panel(stringreading.out)
string_reading_3 = GhPythonScript(data_dict=string_reading.data_dict)  # -> out, data_dict, objects
# ---------- string_reading_3: Python ----------
import sys, os

path = ghenv.Component.OnPingDocument().FilePath
path = os.path.dirname(os.path.dirname(path))
sys.path.append(path + "/link_reading")

print("############## <sys.path> ###################################")
print('\n'.join(sys.path) )
print("################# </> #######################################")

import gen_b_pts as bp
reload(bp)

data_dict = bp.initialize_points(data_dict)
objects = data_dict["object_set"]
data_dict=[data_dict]
# ---------- end string_reading_3 ----------
series = Series(Start=0, Step=division, Count=multiplication)
sort = SortList(Keys=random)  # -> Keys, ValuesA
python_9 = GhPythonScript(xyz=pt_2, frac=Slider(0.998, range=0.2..5), z_count=Slider(7, range=0..10), mns=pt)  # -> out, back_box, graft(mesh_list), graft(idx_list); inputs xyz: Point3d, z_count: Int32, x_count: Int32, mns: Point3d
# ---------- python_9: Python ----------
import math
import Rhino.Geometry as rg

z_dim = xyz.Z / z_count
x_dim = z_dim * frac

if x_count is None:
    x_count = int(math.floor(xyz.X / x_dim) )

back_box = rg.Box(
    rg.Plane.WorldXY,
    rg.Interval(0, x_dim * x_count),
    rg.Interval(0, xyz.Y),
    rg.Interval(0, xyz.Z)
)

m,n,shift = int(mns.X), int(mns.Y), int(mns.Z)

def create_msn(m, n, shift):
    mns_obj = {'m': m,'n': n,'s': shift}
    for j in range(n):
        row = []
        for i in range(m):
            row.append(j * m + i)
        mns_obj[j] = row
        
    return mns_obj

def idx_function(i,j,mns):
    shift = j * mns['s']
    row = mns[j % mns['n'] ]
    return row[(i - shift) % m]

print(m, n, shift)

mns_obj = create_msn(m, n, shift)
mesh_list = []
idx_list = []

for i in range(x_count):
    for j in range(z_count):
        msh = rg.Mesh()
        pts = [
            rg.Point3d(i * x_dim, 0, j * z_dim),
            rg.Point3d( (i + 1) * x_dim, 0, j * z_dim),
            rg.Point3d( (i + 1) * x_dim, 0, (j + 1) * z_dim),
            rg.Point3d( i * x_dim, 0, (j + 1) * z_dim)
        ]
            
        [msh.Vertices.Add(pt) for pt in pts]
        msh.Faces.AddFace(0, 1, 2, 3)
        
        idx_list.append(idx_function(i, j, mns_obj) )
        mesh_list.append(msh)
# ---------- end python_9 ----------
stringreading_3 = GhPythonScript(data_dict=stringreading.data_dict)  # -> out, f, flatten(data_dict)
# ---------- stringreading_3: Python ----------
import sys
import Rhino.Geometry as rg

import os
import Grasshopper

path=os.path.dirname(Grasshopper.Instances.ActiveCanvas.Document.FilePath)
path=os.path.dirname(path)
path+="/src"
sys.path.append(path)

import facade_from_dict as ffd
reload(ffd)

f=ffd.facade_from_dict(data_dict)
data_dict=[data_dict]
# ---------- end stringreading_3 ----------
stringreading_4 = GhPythonScript(data_dict=stringreading.data_dict)  # -> out, f, flatten(data_dict)
# ---------- stringreading_4: Python ----------
import sys
import Rhino.Geometry as rg

import os
import Grasshopper

path=os.path.dirname(Grasshopper.Instances.ActiveCanvas.Document.FilePath)
path=os.path.dirname(path)
path+="/src"
sys.path.append(path)

import front_end_set as fes
reload(fes)

print(data_dict["hs"])

f=fes.SquareSet(
    x=data_dict["x_spacing"],
    y=data_dict["z_spacing"],
    hs=data_dict["hs"]
)
# ---------- end stringreading_4 ----------
pt_3 = Point(Point(972.3068, 58.77198605, 0))
stringreading_5 = GhPythonScript(data_dict=item_3)  # -> out, f, ptsss, flatten(data_dict)
# ---------- stringreading_5: Python ----------
import sys
import Rhino.Geometry as rg

import os
import Grasshopper

path=os.path.dirname(Grasshopper.Instances.ActiveCanvas.Document.FilePath)
path=os.path.dirname(path)
path+="/src"
sys.path.append(path)

import front_end_set as fes
reload(fes)

print(data_dict["hs"])

f=fes.SquareSet(
    x=data_dict["x_spacing"],
    y=data_dict["z_spacing"],
    hs=data_dict["hs"]
)

f.h_kon()
ptsss=f.generate()
print(f.generate())
# ---------- end stringreading_5 ----------
gradient = Gradient(
    LowerLimit=0,
    UpperLimit=1,
    Parameter=series,
    stops=[0: RGB(243, 57, 0), 0.1: RGB(236, 27, 60), 0.2: RGB(210, 0, 118), 0.3: RGB(103, 0, 120), 0.4: RGB(39, 72, 161), 0.5: RGB(1, 192, 229), 0.6: RGB(18, 178, 90), 0.7: RGB(79, 186, 8), 0.8: RGB(220, 237, 32), 0.9: RGB(247, 159, 20), 1: RGB(243, 57, 0)])
print_dict_2 = GhPythonScript(x=string_reading.data_dict)  # -> out; same code as print_dict
print_dict_3 = GhPythonScript(x=stringreading_2.data_dict)  # -> out
# ---------- print_dict_3: Python ----------
string=''
for key, item in x.items():
    string+="{} : {}\n".format(key, item)
    
print(string)
print(x)
# ---------- end print_dict_3 ----------
hsv_colors = GhPythonScript(values=python_8.values)  # -> out, clrs; inputs values: list
# ---------- hsv_colors: Python ----------
import Rhino.Display as rd

clrs = [rd.ColorHSV(v[0] * .25, 1.0 - v[1] * .75, 1.0 - v[2] * .5).ToArgbColor() for v in values]
# ---------- end hsv_colors ----------
item_4 = ListItem(List=python_6.boundary, Index=Slider(6, range=0..10), Wrap=True)
deconstruct = GhPythonScript(objs=flatten(string_reading_3.objects))  # -> out, pt_sets; inputs objs: list
# ---------- deconstruct: Python ----------
import Rhino.Geometry as rg
pt_sets = []

for row in objs:
    row_set = []
    for obj in row:
        row_set.append([rg.Point3d(pt[0] * 1000., pt[1] * 1000., pt[2] * 1000.) for pt in obj.get_pts()])
    pt_sets.append(row_set)
# ---------- end deconstruct ----------
delta_4_2 = GhPythonScript(
    pts=python_4.boundary,
    folds=python_4.folds,
    split_idx=number_slider,
    h_max=Slider(36.1, range=0..100),
    correction_val=Slider(0.7, range=-10..10),
    mesh_cor_val=Toggle(False),
    show_with_cor_val=Toggle(False),
    side_interlock=list_9,
    import_parameters=optimization_3.opt_dict,
    b_pt=pt_3)  # -> out, vis_mesh, vis_2d, unfolded_dict; inputs pts: list of Point3d, split_idx: Int32, mesh_cor_val: Boolean, show_with_cor_val: Boolean, side_interlock: Int32, b_pt: Point3d
# ---------- delta_4_2: Python ----------
import sys

import os
import Grasshopper

path=os.path.dirname(Grasshopper.Instances.ActiveCanvas.Document.FilePath)

sys.path.append(path)

import square as sq
reload(sq)

sqr = sq.Square(pts, correction_val, side_interlock, split_idx, mesh_cor_val, folds)
x, y, z, u = sqr.unfolded()
vis_2d = [x] + y + z + u
vis_mesh = sqr.mesh(show_with_cor_val)
unfolded_dict = [sqr.bake()]
# ---------- end delta_4_2 ----------
panel_8 = Panel(print_dict_2)
medges = MeshEdges(Mesh=python_9.mesh_list)  # -> NakedEdges, InteriorEdges, NonManifoldEdges
pyramids = GhPythonScript(
    pts=python_6.boundary,
    c_pt=python_6.c_pt,
    h_max=Slider(59.1, range=0..100),
    correction_val=Slider(1, range=-10..10),
    show_with_cor_val=Toggle(True),
    mesh_cor_val=Toggle(True),
    side_interlock=list_8)  # -> out, vis_mesh, vis_2d, unfolded_dict; inputs pts: list of Point3d, c_pt: Point3d, side_interlock: Int32
# ---------- pyramids: Python ----------
import sys

import os
import Grasshopper

path=os.path.dirname(Grasshopper.Instances.ActiveCanvas.Document.FilePath)

sys.path.append(path)

import pyramid as pr
reload(pr)

pyr = pr.Pyramid(pts, c_pt, correction_val, side_interlock, 0, mesh_cor_val)
x, y, z, u = pyr.unfolded()
vis_2d = x + y + z + u
vis_mesh = pyr.mesh(show_with_cor_val)
unfolded_dict = [pyr.bake()]
# ---------- end pyramids ----------
print_dict_4 = GhPythonScript(x=stringreading_3.data_dict)  # -> flatten(out); same code as print_dict_3
diamond = GhPythonScript(
    pts=python_5.boundary,
    folds=python_5.folds,
    split_idx=number_slider_2,
    h_max=Slider(36.1, range=0..100),
    correction_val=Slider(0.7, range=-10..10),
    mesh_cor_val=Toggle(False),
    show_with_cor_val=Toggle(False),
    side_interlock=list_6,
    import_parameters=optimization.opt_dict,
    b_pt=pt_3)  # -> out, vis_mesh, vis_2d, unfolded_dict; inputs pts: list of Point3d, split_idx: Int32, mesh_cor_val: Boolean, show_with_cor_val: Boolean, side_interlock: Int32, b_pt: Point3d; same code as delta_4_2
triangle = GhPythonScript(
    pts=python_7.boundary,
    folds=python_7.folds,
    split_idx=0,
    h_max=Slider(36.1, range=0..100),
    correction_val=Slider(0.8, range=-10..10),
    mesh_cor_val=Toggle(False),
    show_with_cor_val=Toggle(False),
    side_interlock=list_7,
    import_parameters=optimization_2.opt_dict,
    b_pt=pt_3)  # -> out, vis_mesh, vis_2d, unfolded_dict; inputs pts: list of Point3d, split_idx: Int32, mesh_cor_val: Boolean, show_with_cor_val: Boolean, side_interlock: Int32, b_pt: Point3d
# ---------- triangle: Python ----------
import sys

import os
import Grasshopper

path=os.path.dirname(Grasshopper.Instances.ActiveCanvas.Document.FilePath)

sys.path.append(path)

import triangle as tr
reload(tr)

tri = tr.Triangle(pts, correction_val, side_interlock, mesh_cor_val)
x, y, z, u = tri.unfolded()
vis_2d = [x] + y + z + u
vis_mesh = tri.mesh(show_with_cor_val)
unfolded_dict = [tri.bake()]
# ---------- end triangle ----------
panel_9 = Panel(stringreading_3.out)
panel_10 = Panel(stringreading_2.out)
genmesh = GhPythonScript(f=stringreading_3.f)  # -> out, vis_mesh, b_pts, d2s, mshs
# ---------- genmesh: Python ----------
mshs=f.populate()
# ---------- end genmesh ----------
item_5 = ListItem(List=gradient, Index=python_9.idx_list, Wrap=True)
item_6 = ListItem(List=hsv_colors.clrs, Index=python_9.idx_list, Wrap=True)
panel_11 = Panel(hsv_colors.clrs)
mcol = MeshColours(Mesh=python_9.mesh_list, Colours=item_5)  # -> flatten(Mesh)
num_2 = Number(0)
panel_12 = Panel(print_dict_4)
python_10 = GhPythonScript(pts=deconstruct.pt_sets)  # -> out, a
# ---------- python_10: Python ----------
print(pts)
# ---------- end python_10 ----------
hsv = ColourHSV(Alpha=1, Hue=0, Saturation=1, Value=1)
panel_13 = Panel(pyramids.out)
mcol_2 = MeshColours(Mesh=python_9.mesh_list, Colours=item_6)
mesh = Mesh(genmesh.mshs)

# ---- group: Visualisation
merge = Merge(Data1=pyramids.vis_mesh, Data2=pyramids.vis_2d)  # -> flatten(Result)
gate = StreamGate(Stream=merge, Gate=Toggle(True))  # -> Target0, Target1
geo = Geometry(gate.Target1)

# ----
bake_unpacker = GhPythonScript(x=delta_4_2.unfolded_dict)  # -> out, outlines, main_folds, sec_folds, inner_folds
# ---------- bake_unpacker: Python ----------
outlines = x["outline"]
main_folds = x["main_folds"]
sec_folds = x["sec_folds"]
inner_folds = x["inner_folds"]
# ---------- end bake_unpacker ----------

# ---- group: Visualisation
merge_2 = Merge(Data1=delta_4_2.vis_mesh, Data2=delta_4_2.vis_2d)  # -> flatten(Result)
gate_2 = StreamGate(Stream=merge_2, Gate=Toggle(False))  # -> Target0, Target1
geo_2 = Geometry(gate_2.Target1)

# ----
panel_14 = Panel(delta_4_2.out)

# ---- group: Visualisation
merge_3 = Merge(Data1=diamond.vis_mesh, Data2=diamond.vis_2d)  # -> flatten(Result)
gate_3 = StreamGate(Stream=merge_3, Gate=Toggle(False))  # -> Target0, Target1
geo_3 = Geometry(gate_3.Target1)

# ----
lng = ListLength(List=flatten(mcol))
bake_unpacker_2 = GhPythonScript(x=pyramids.unfolded_dict)  # -> out, outlines, main_folds, sec_folds, inner_folds; same code as bake_unpacker
bake_unpacker_3 = GhPythonScript(x=diamond.unfolded_dict)  # -> out, outlines, main_folds, sec_folds, inner_folds; same code as bake_unpacker

# ---- group: Visualisation
merge_4 = Merge(Data1=triangle.vis_mesh, Data2=triangle.vis_2d)  # -> flatten(Result)
gate_4 = StreamGate(Stream=merge_4, Gate=Toggle(False))  # -> Target0, Target1
geo_4 = Geometry(gate_4.Target1)

# ----
bake_unpacker_4 = GhPythonScript(x=triangle.unfolded_dict)  # -> out, outlines, main_folds, sec_folds, inner_folds; same code as bake_unpacker
panel_15 = Panel(python_10.out)
series_2 = Series(Start=0, Step=0, Count=lng)  # -> flatten(Series)
baking = GhPythonScript(
    bake_me=Button(),
    outlines=bake_unpacker.outlines,
    main_folds=bake_unpacker.main_folds,
    sec_folds=bake_unpacker.sec_folds,
    inner_folds=bake_unpacker.inner_folds)  # -> out, a; inputs bake_me: Boolean, outlines: list, main_folds: list, sec_folds: list, inner_folds: list
# ---------- baking: Python ----------
import sys
import os
import Grasshopper

path=os.path.dirname(Grasshopper.Instances.ActiveCanvas.Document.FilePath)

sys.path.append(path)

import baking as bk
reload(bk)
if bake_me:
    bk.bake(outlines, main_folds, sec_folds, inner_folds, ghdoc)
# ---------- end baking ----------
panel_16 = Panel(stringreading_5.out)
baking_2 = GhPythonScript(
    bake_me=Button(),
    outlines=bake_unpacker_3.outlines,
    main_folds=bake_unpacker_3.main_folds,
    sec_folds=bake_unpacker_3.sec_folds,
    inner_folds=bake_unpacker_3.inner_folds)  # -> out, a; inputs bake_me: Boolean, outlines: list, main_folds: list, sec_folds: list, inner_folds: list; same code as baking
baking_3 = GhPythonScript(
    bake_me=Button(),
    outlines=bake_unpacker_2.outlines,
    main_folds=bake_unpacker_2.main_folds,
    sec_folds=bake_unpacker_2.sec_folds,
    inner_folds=bake_unpacker_2.inner_folds)  # -> out, a; inputs bake_me: Boolean, outlines: list, main_folds: list, sec_folds: list, inner_folds: list; same code as baking
baking_4 = GhPythonScript(
    bake_me=Button(),
    outlines=bake_unpacker_4.outlines,
    main_folds=bake_unpacker_4.main_folds,
    sec_folds=bake_unpacker_4.sec_folds,
    inner_folds=bake_unpacker_4.inner_folds)  # -> out, a; inputs bake_me: Boolean, outlines: list, main_folds: list, sec_folds: list, inner_folds: list; same code as baking
merge_5 = Merge(Data1=graft(series_2), Data2=graft(mcol))
item_7 = ListItem(List=merge_5, Index=graft(0), Wrap=True)
panel_17 = Panel(baking_4.out)
panel_18 = Panel(merge)
panel_19 = Panel(item_7)
relay = Relay()
list_10 = ValueList({"Straight": "flat", "Clockwise": "clockwise", "Counter-Clockwise": "counter_clockwise", "Alternating-A": "alternating_A", "Alternating-B": "alternating_B", "Flaps": "flaps"}, selected="Alternating-A")
item_8 = ListItem(List=relay, Index=0, Wrap=True)
number_slider_5 = Slider(1, range=0..3)
list_11 = ValueList({"x constrained": 0, "y constrained": 1, "xy constrained": 2, "free": 3}, selected="free")
python_11 = GhPythonScript(x=item_8)  # -> out, a
# ---------- python_11: Python ----------
print(x)
# ---------- end python_11 ----------
panel_20 = Panel(triangle.out)
list_12 = ValueList({"Optimal Width": 0, "Optimal Length": 1, "Optimal Area": 2}, selected="Optimal Length")
parameter_assignment = GhPythonScript(
    flap_h_max=Slider(10, range=0..10),
    correction_val=Slider(10, range=0..10),
    flap_h=Slider(3.568, range=0..10),
    flap_w=Slider(3.418, range=0..10),
    mesh_correction_val=Toggle(False),
    show_correction_val=Toggle(True),
    fold_idx=Slider(1, range=0..1),
    orient=Toggle(False),
    pattern=list_10)  # -> out, construction_parameters; inputs mesh_correction_val: Boolean, show_correction_val: Boolean, fold_idx: Int32, orient: Boolean
# ---------- parameter_assignment: Python ----------
construction_parameters = {
    "flap_h_max" : 30.,
    "correction_val" : .7,
    "flap_h" : 20.0,
    "flap_w" : 40.0,
    "mesh_correction_val" : False,
    "show_correction_val" : True,
    "fold_idx" : 0,
    "min_pt_height" : 50.,
    "orient" : True,
    "pattern" : "flat"
}

input_parameters = {
    "flap_h_max" : flap_h_max,
    "correction_val" : correction_val,
    "flap_h" : flap_h,
    "flap_w" : flap_w,
    "mesh_correction_val" : mesh_correction_val,
    "show_correction_val" : show_correction_val,
    "fold_idx" : fold_idx,
    "min_pt_height" : min_pt_height,
    "orient" : orient,
    "pattern" : pattern
}

for key, value in input_parameters.items():
    if not(value is None):
        construction_parameters[key]=value
        
construction_parameters=[construction_parameters]
# ---------- end parameter_assignment ----------
python_12 = GhPythonScript(
    width=Slider(200, range=0..1000),
    length=Slider(1000, range=0..1000),
    constraint_idx=list_11,
    bottom_0=Slider(47.7, range=0..100),
    bottom_1=Slider(97.1, range=0..100),
    top_0=Slider(100, range=0..100),
    top_1=Slider(43.7, range=0..250),
    xy_constraint_idx=number_slider_5,
    tangent_shift=Slider(0.7, range=0..4))  # -> out, boundary, folds; inputs xy_constraint_idx: Int32; same code as python_5
panel_21 = Panel(python_11.out)
panel_22 = Panel(deconstruct.pt_sets)
optimization_4 = GhPythonScript(
    iterations=Slider(50, range=10..1000),
    max_width=Slider(3656.2, range=0..10000),
    max_length=Slider(4116.5, range=0..10000),
    optimization=list_12)  # -> out, opt_dict; inputs iterations: Int32, optimization: Int32
# ---------- optimization_4: Python ----------
optimization_dict = {
    "iterations" : iterations,
    "max_w" : max_width,
    "max_l" : max_length,
}

optimization_dict["preference"] = ["width","length","area"][optimization]
opt_dict=[optimization_dict]
# ---------- end optimization_4 ----------
objectsgeneration = GhPythonScript(
    input_lists=stringreading_5.ptsss,
    construction_parameters=parameter_assignment.construction_parameters,
    optimization_parameters=optimization_4.opt_dict,
    b_pt=pt_3)  # -> out, vis_mesh, b_pts, d2s; inputs input_lists: list, b_pt: Point3d
# ---------- objectsgeneration: Python ----------
import sys
import Rhino.Geometry as rg

import os
import Grasshopper

path=os.path.dirname(Grasshopper.Instances.ActiveCanvas.Document.FilePath)
path=os.path.dirname(path)
path+="/src"
sys.path.append(path)

import base_object as bo
reload(bo)

a_b_o=bo.BaseObject.simple_square(input_lists[0][0],other_parameters=construction_parameters)
print(a_b_o)
print(a_b_o.objs)
d2s=a_b_o.get_2d(optimization_parameters=optimization_parameters)
b_pts=d2s[0].b_pts
d2s=[d2s[0].bake_dict()]
# ---------- end objectsgeneration ----------
list_13 = ValueList({"Straight": 0, "Clockwise": 1, "Counter-Clockwise": 2, "Alternating-A": 3, "Alternating-B": 4, "Flaps": 5}, selected="Clockwise")
python_13 = GhPythonScript()  # -> out, a
# ---------- python_13: Python ----------
lst=[[i for i in range(6)], [i for i in range(3, 9, 1)]]
print(lst)
print(list(zip(*lst)))
# ---------- end python_13 ----------
python_14 = GhPythonScript(x=deconstruct.pt_sets)  # -> out, a; inputs x: list
# ---------- python_14: Python ----------
import Rhino.Geometry.Point3d as Pt3d
b_pt = Pt3d(0,0,100)

a=[[[p+b_pt for p in pt] for pt in pts] for pts in x]
print(a)
# ---------- end python_14 ----------
diamond_2 = GhPythonScript(
    input_lists=python_14.a,
    folds=python_12.folds,
    split_idx=number_slider_5,
    h_max=Slider(100, range=0..100),
    correction_val=Slider(1.1, range=-10..10),
    mesh_cor_val=Toggle(False),
    show_with_cor_val=Toggle(False),
    side_interlock=list_13,
    production_parameter=optimization_4.opt_dict,
    b_pt=pt_3)  # -> out, vis_mesh, vis_2d, unfolded_dict; inputs input_lists: list, split_idx: Int32, mesh_cor_val: Boolean, show_with_cor_val: Boolean, side_interlock: Int32, b_pt: Point3d
# ---------- diamond_2: Python ----------
import sys
import Rhino.Geometry as rg

import os
import Grasshopper

path=os.path.dirname(Grasshopper.Instances.ActiveCanvas.Document.FilePath)

sys.path.append(path)

import square as sq
reload(sq)

vis_mesh = []
vis_2d = []

for i, row in enumerate(input_lists):
    for j, pts in enumerate(row):
        t_matrix = rg.Transform.Translation(rg.Vector3d(production_parameter["max_w"] * i, production_parameter["max_l"] * j, 0.0) )
        sqr = sq.Square(pts, correction_val, side_interlock, split_idx, mesh_cor_val, folds)
        x, y, z, u = sqr.unfolded(h_max = h_max, position_optimization = production_parameter)
        vis_2d_local = [x] + y + z + u
        [object2d.Transform(t_matrix) for object2d in vis_2d_local]
        vis_2d.extend(vis_2d_local)
        vis_mesh.append(sqr.mesh(show_with_cor_val) )
        unfolded_dict = [sqr.bake()]
# ---------- end diamond_2 ----------
panel_23 = Panel(python_13.out)
objectsgeneration_2 = GhPythonScript(
    input_lists=deconstruct.pt_sets,
    construction_parameters=parameter_assignment.construction_parameters,
    optimization_parameters=optimization_4.opt_dict,
    b_pt=pt_3)  # -> out, vis_mesh, b_pts, d2s; inputs input_lists: list, b_pt: Point3d; same code as objectsgeneration
print_dict_5 = GhPythonScript(x=parameter_assignment.construction_parameters)  # -> out; same code as print_dict
objectsgeneration_3 = GhPythonScript(
    input_lists=deconstruct.pt_sets,
    construction_parameters=parameter_assignment.construction_parameters,
    optimization_parameters=optimization_4.opt_dict,
    data_dict=string_reading_3.data_dict,
    b_pt=pt_3)  # -> out, vis_mesh, b_pts, d2s, mshs; inputs input_lists: list, b_pt: Point3d
# ---------- objectsgeneration_3: Python ----------
import sys
import Rhino.Geometry as rg

import os
import Grasshopper

path=os.path.dirname(Grasshopper.Instances.ActiveCanvas.Document.FilePath)
path=os.path.dirname(path)
path+="/src"
sys.path.append(path)

import facade as fc
reload(fc)

a_facade=fc.FacademakerFacade(
    x_spacing=data_dict["xy_dim"]*1000.*data_dict["frat"],
    z_spacing=data_dict["xy_dim"]*1000.,
    x_count=int(data_dict["fgh"]),
    z_count=int(data_dict["fgv"])
)
a_facade.set_selection_pattern(data_dict["ftypo"],0)
a_facade.set_multi_squares(input_lists, construction_parameters)
mshs=a_facade.populate()
print(mshs)
print(a_facade.layer_shift)
print(a_facade.all_base_objects)
# ---------- end objectsgeneration_3 ----------
path_mapper = PathMapper(diamond_2.vis_2d, source="{A;B;C}", target="{A;B}")
panel_24 = Panel(print_dict_5)
panel_25 = Panel(diamond_2.out)

# ---- group: Visualisation
merge_6 = Merge(Data1=diamond_2.vis_mesh, Data2=path_mapper)  # -> flatten(Result)
gate_5 = StreamGate(Stream=merge_6, Gate=Toggle(True))  # -> Target0, Target1
geo_5 = Geometry(gate_5.Target1)

# ----
panel_26 = Panel(python_14.out)
medges_2 = MeshEdges(Mesh=objectsgeneration_3.mshs)  # -> NakedEdges, InteriorEdges, NonManifoldEdges
bake_unpacker_5 = GhPythonScript(x=objectsgeneration_2.d2s)  # -> out, outlines, main_folds, sec_folds, inner_folds
# ---------- bake_unpacker_5: Python ----------
outlines = x["outline_crv"]
main_folds = x["body_flap_folds"]
sec_folds = x["intra_flap_folds"]
inner_folds = x["top_face_folds"]
# ---------- end bake_unpacker_5 ----------
mesh_2 = Mesh(objectsgeneration_3.mshs)
pt_4 = Point(objectsgeneration_2.b_pts)
item_9 = ListItem(List=pt_4, Index=0, Wrap=True)
crv = Curve(bake_unpacker_5.outlines)
baking_5 = GhPythonScript(
    bake_me=Button(),
    outlines=bake_unpacker_5.outlines,
    main_folds=bake_unpacker_5.main_folds,
    sec_folds=bake_unpacker_5.sec_folds,
    inner_folds=bake_unpacker_5.inner_folds)  # -> out, a; inputs bake_me: Boolean, outlines: list, main_folds: list, sec_folds: list, inner_folds: list; same code as baking
panel_27 = Panel(objectsgeneration_3.out)
panel_28 = Panel(objectsgeneration_2.out)
